# Grasshopper definition ArduinoStepper.gh (Grasshopper 1.0.7)
# plug-ins: Wombat

md_slider = MDSlider(
    SliderMode=0,
    slider_value=Point(0.8169169254, 0.3484887844, 0.5),
    x_domain=Domain(-0.5, 0.5),
    y_domain=Domain(-0.5, 0.5),
    z_domain=Domain(0, 1))
# ArduinoStepper.
# 
# Step 1. Get an Arduino and a CNCshield v3 and set up with two steppers.
# Step 2. Program the Arduino with the code in ‘Arduino_CNCshieldv3_Two_Stepper_Input’.
# Step 3. Confirm that it works by sending a command such as ‘S1 1000 S2 500’.
# 
# Step 4. Move the MD slider and turn on the ‘send’ toggle to send movement messages to Arduino.
panel = Panel("S1 {S1VAL} S2 {S2VAL}")
multiplication = Multiplication(A=md_slider, B=Slider(1000, range=0..1000))
deconstruct = Deconstruct(Point=multiplication)  # -> XComponent, YComponent, ZComponent
integer = Integer(deconstruct.YComponent)
integer_2 = Integer(deconstruct.XComponent)

send_to_arduino = BooleanToggle(True)

s1val = Number(integer_2)
s2val = Number(integer)
# Set this to the port you see in Arduino application > Tools > Port
panel_2 = Panel("/dev/tty.usbmodem101")
panel_3 = Panel("""{S1VAL}
{S2VAL}""")
merge = Merge(Data1=s1val, Data2=s2val)

connect_to_arduino = BooleanToggle(True)

replace_text_multiple = ReplaceTextMultiple(Text=panel, Fragment=panel_3, Replacement=merge)
stream_filter = StreamFilter(Gate=send_to_arduino, Stream1=replace_text_multiple)
panel_4 = Panel(replace_text_multiple)
serial_connect = CSharpScript(connect=connect_to_arduino, port=panel_2, baud="115200")  # -> out, msg, sp; inputs connect: Boolean, port: String, baud: Int32
# ---------- serial_connect: C# usings ----------
using System.IO.Ports;
# ---------- serial_connect: C# ----------
SerialPort _serialPort;

if(connect) {

    _serialPort = new SerialPort(port, baud);
    _serialPort.ReadTimeout = 500;
    _serialPort.WriteTimeout = 500;


    _serialPort.Open();



    msg = "Serial port open";
    sp = _serialPort;

} else {
    //if(_serialPort) { _serialPort.Close(); }
    msg = "Serial port closed";
}
# ---------- serial_connect: C# additional code ----------
  /// <summary>
  /// This method will be called once every solution, before any calls to RunScript.
  /// </summary>
  public override void BeforeRunScript()
  { }
  /// <summary>
  /// This method will be called once every solution, after any calls to RunScript.
  /// </summary>
  public override void AfterRunScript()
  { }
# ---------- end serial_connect ----------
combine_data = CombineData(Input1=stream_filter)  # -> Result, Index

# ---- group: To refresh this, enable and disable this component
serial_list_ports = CSharpScript()  # -> out, ports
# ---------- serial_list_ports: C# ----------
ports = SerialPort.GetPortNames();
# ---------- end serial_list_ports ----------

# ----
serial_send = CSharpScript(sp=serial_connect.sp, message=combine_data.Result)  # -> out, res; inputs message: String
# ---------- serial_send: C# usings ----------
using System.ComponentModel;
using System.IO.Ports;
# ---------- serial_send: C# ----------
SerialPort _sp;

if(sp != null) {

    _sp = (SerialPort) sp;


    if(_sp.IsOpen) {

        _sp.WriteLine(message);
        res = _sp.ReadExisting();
    }

 }
# ---------- end serial_send ----------
panel_5 = Panel(serial_list_ports.ports)
