# Grasshopper definition Base64Serializer.gh (Grasshopper 1.0.7)

# ---- group: fine-tuned adjustments
md_slider = MDSlider(
    SliderMode=0,
    slider_value=Point(0.5066385967, 0.3860049364, 0.5),
    x_domain=Domain(-10, 10),
    y_domain=Domain(-10, 10),
    z_domain=Domain(0, 1))

# ----
# Base64Serializer
# Dan Taeyoung (@dantaeyoung) : http://github.com/provolot/GrasshopperArsenal
panel = Panel("""MMX
Adjustment""")
num = Number([-183.1649594, -83.15661455, 1, -274.7234923, 83.15661455, -1, 274.7234923, 141.2908417, 1])
entwine = Entwine(Branch00=num, Branch01=md_slider, FlattenInputs=True)
txt = Text(graft(panel))
panel_2 = Panel(entwine)

# ---- group: Everything has to be text!
txt_2 = Text(entwine)

# ----
serializedata = SerializeData(keys=txt, vals=txt_2)  # -> jsondump, or_2, b64dump
panel_3 = Panel(serializedata.b64dump)
# (this data can be sent over... the network! and other things)
panel_4 = Panel(serializedata.jsondump)
deserializedata = DEserializeData(b64dump=serializedata.b64dump)  # -> keys, vals
panel_5 = Panel(deserializedata.keys)
panel_6 = Panel(deserializedata.vals)

# ==== cluster SerializeData
keys = ClusterInput()
vals = ClusterInput()
python = GhPythonScript(keys=keys, vals=vals)  # -> out, jsondump, b64dump; inputs keys: tree, vals: tree
# ---------- python: Python ----------
import ghpythonlib.treehelpers as th
import json
import base64

vals = th.tree_to_list(vals)
keys = th.tree_to_list(keys)

if len(vals) != len(keys):
    print "Key/Value length mismatch"
else:
    d = { "keys": keys, "vals": vals }
    jsondump = json.dumps(d)
    b64dump = base64.b64encode(jsondump)
# ---------- end python ----------
or = Data()
or_2 = ClusterOutput(or)
jsondump = ClusterOutput(python.jsondump)
b64dump = ClusterOutput(python.b64dump)

# ==== cluster DEserializeData
jsondump = ClusterInput()
b64dump = ClusterInput()
or = ClusterInput()
or_2 = Data(or)
python = GhPythonScript(jsondump=jsondump, b64dump=b64dump)  # -> out, keys, vals
# ---------- python: Python ----------
import ghpythonlib.treehelpers as th
import json
import base64


thisjsondump = jsondump
if(b64dump):
    thisjsondump = base64.b64decode(b64dump)

d = json.loads(thisjsondump)
keys = th.list_to_tree(d["keys"])
vals = th.list_to_tree(d["vals"])
# ---------- end python ----------
vals = ClusterOutput(python.vals)
keys = ClusterOutput(python.keys)
