# Grasshopper definition camera_tracer_v2.ghx (Grasshopper 0.9.76)
# plug-ins: Python Interpreter, Firefly.X

# ---- group: Firefly to Image
video_stream = WebCamVideoStream()  # disabled
dam = DataDam(DataA=video_stream, BufferDelay=10000000, BufferMode=0)
saturation = BrightnessAndSaturation(BitmapToModify=dam, SaturationMultiplier=Slider(0, range=0..1), BrightnessMultiplier=1)
contrast = Contrast(BitmapToModify=saturation, ContrastMultiplier=Slider(0.801, range=0..1))
invert = Invert(BitmapToModify=contrast)
painter = BitmapPainter(BitmapToPaint=invert)
mesh = MeshFromImage(Bmp=invert, Sx=Domain(0, 24), Sy=Domain(0, 18), Z=1, C=True)
demesh = DeconstructMesh(Mesh=mesh)  # -> Vertices, Faces, Colours, Normals

# ----
geo = Geometry(demesh.Vertices)
pdecon = Deconstruct(Point=geo)  # -> XComponent, YComponent, ZComponent
stddev = STDDEV(data=pdecon.ZComponent)
avr = Average(Input=pdecon.ZComponent)
multiplication = Multiplication(A=stddev, B=Slider(2.7, range=1..4))
addition = Addition(A=avr, B=multiplication)
larger = LargerThan(FirstNumber=pdecon.ZComponent, SecondNumber=addition)  # -> LargerThan, OrEqualTo
dispatch = Dispatch(List=geo, DispatchPattern=larger.LargerThan)  # -> ListA, ListB
deconstruct = Deconstruct(Point=dispatch.ListA)  # -> XComponent, YComponent, ZComponent
construct_point = ConstructPoint(XCoordinate=deconstruct.XComponent, YCoordinate=deconstruct.YComponent, ZCoordinate=0)
geometry = Geometry(construct_point)

# ---- group: K-means clustering to try to reduce number of points
geo_2 = Geometry(flatten(geometry))
pdecon_2 = Deconstruct(Point=graft(geo_2))  # -> XComponent, YComponent, ZComponent
merge = Merge(Data1=pdecon_2.XComponent, Data2=pdecon_2.YComponent)
lng = ListLength(List=geo_2)
integer_division = IntegerDivision(A=lng, B=Slider(4, range=0..10))
panel = Panel(integer_division)

# ---- group: K-means clustering to try to reduce number of points / Inputs
number_of_clusters = Slider(30, range=0..30)
max_iterations = Slider(30, range=0..30)
objects = Data(geo_2)
keys = Number(simplify(merge))

# ---- group: K-means clustering to try to reduce number of points (continued)
k_means = CSharpScript(objects=objects, keys=keys, k=panel, maxIterations=max_iterations)  # -> out, clusteredObjects; inputs objects: list, keys: tree of Double, k: Int32, maxIterations: Double
# ---------- k_means: C# ----------
    //check data is ok.
    if(objects == null || keys == null)
    {
      Print("Please set objects and keys");
      return;
    } else if(objects.Count != keys.BranchCount)
    {
      Print("Keys do not match objects");
      return;
    } else if(k <= 0 || maxIterations <= 0)
    {
      Print("K and max iterations need to be > 0");
      return;
    }

    //set up the vectors. Each vector coresponds to an object.
    int vectorLength = keys.Branch(0).Count;
    vector[] vectors = new vector[objects.Count];
    for(int i = 0; i < vectors.Length; i++)
    {
      vectors[i] = new vector(keys.Branch(i));
      if(vectors[i].getVector().Length != vectorLength)
      {
        Print("Keys are not the same length");
        return;
      }
    }

    //set up the clusters, each vector represents the center of the cluster
    vector[] clusters = new vector[k];
    int step = (int) Math.Floor((double) (objects.Count / k));

    for(int i = 0; i < clusters.Length; i++)
    {
      clusters[i] = new vector(keys.Branch(i * step));
    }



    //Now assign the vectors to their nearest cluster
    //and move the cluster center to the middle of the vectors.
    //Repeat until they do not change, or max iterations is reached.
    bool changed = true;
    int n = 0;

    while(changed == true && n < maxIterations)
    {
      changed = false;

      //put the vector into its closest cluster.
      for(int i = 0; i < vectors.Length; i++)
      {
        int bestId = 0;
        double bestDistance = vectors[i].distance(clusters[0]);

        for(int j = 0; j < clusters.Length; j++)
        {
          double testDistance = vectors[i].distance(clusters[j]);
          if(testDistance < bestDistance)
          {
            bestDistance = testDistance;
            bestId = j;
          }
        }

        if(vectors[i].getCluster() != bestId)
        {
          vectors[i].setCluster(bestId);
          changed = true;
        }
      }


      //reset the clusters to the centroids of all the vectors in the cluster.
      double[,] newCentroids = new double[clusters.Length, vectors[0].getVector().Length];
      int[] count = new int[clusters.Length];

      foreach(vector v in vectors)
      {
        double[] myVector = v.getVector();
        for(int i = 0; i < myVector.Length; i++)
        {
          newCentroids[v.getCluster(), i] += myVector[i];
        }
        count[v.getCluster()]++;
      }

      for(int i = 0; i < newCentroids.GetLength(0); i++)
      {
        double[] newCentroid = new double[newCentroids.GetLength(1)];

        for(int j = 0; j < newCentroids.GetLength(1); j++)
        {
          newCentroid[j] = newCentroids[i, j] / count[i];
        }

        clusters[i].setVector(newCentroid);
      }

      n++;
    }

    String text = "took " + n + " iterations";
    Print(text);


    //now groups all the objects into clusters to be outputted.
    DataTree<object> objectsOut = new DataTree<object>();
    for(int i = 0; i < vectors.Length; i++)
    {
      Grasshopper.Kernel.Data.GH_Path path = new Grasshopper.Kernel.Data.GH_Path(vectors[i].getCluster());
      objectsOut.Add(objects[i], path);
    }

    clusteredObjects = objectsOut;
# ---------- k_means: C# additional code ----------
  /// <summary>
  /// Holds the vector as an array of doubles.
  /// And the cluster it is in as an integer.
  /// </summary>
  class vector
  {
    int cluster = 0;
    double[] myVector;

    public vector(List<double> _myVector)
    {
      myVector = _myVector.ToArray();
    }

    //######################
    // GETS
    //######################

    /// <summary>
    ///
    /// </summary>
    /// <returns></returns>
    public int getCluster()
    {
      return cluster;
    }

    public double[] getVector()
    {
      return myVector;
    }

    //######################
    // SETS
    //######################

    public void setVector(double[] _myVector)
    {
      myVector = _myVector;
    }

    public void setCluster(int _cluster)
    {
      cluster = _cluster;
    }

    //######################
    // METHODS
    //######################

    public double distance(vector otherV)
    {
      double[] otherVector = otherV.getVector();
      double distance = 0;

      if(myVector.Length == otherVector.Length)
      {
        for(int i = 0; i < myVector.Length; i++)
        {
          distance += Math.Pow(myVector[i] - otherVector[i], 2);
        }
        distance = Math.Sqrt(distance);
      }

      return distance;
    }
  }
# ---------- end k_means ----------
panel_2 = Panel(k_means.out)
avr_2 = Average(Input=k_means.clusteredObjects)  # -> flatten(ArithmeticMean)

# ---- group: Traveling Salesman-based Ordering
geometry_2 = Geometry(avr_2)
xy = XYPlane(Origin=Point(0, 0, 0))
cluster = Cluster(pt=geometry_2, pln=xy)  # -> int_2, pt_4
lng_2 = ListLength(List=geometry_2)
subtraction = Subtraction(A=lng_2, B="3")
item = ListItem(List=cluster.int_2, Index=0, Wrap=True)
travelingsalesman = PythonScript(allPts=geometry_2, startIndex=item, iterations=subtraction)  # -> out, simplify(a); inputs allPts: list of Point3d, startIndex: Int32, iterations: Int32
# ---------- travelingsalesman: Python ----------
import rhinoscriptsyntax
import Rhino
firstPt = allPts[startIndex]
del allPts[startIndex]

visitedPts = [firstPt]
def TravelingSalesMan(fromPt,i):
    nextIndex = Rhino.Collections.Point3dList.ClosestIndexInList(allPts,fromPt)
    nextPt = allPts[nextIndex]
    visitedPts.append(nextPt)
    del allPts[nextIndex]
    if(i>0):
        TravelingSalesMan(nextPt,i-1)
TravelingSalesMan(firstPt,iterations)
a = visitedPts
# ---------- end travelingsalesman ----------
geo_3 = Geometry(flatten(travelingsalesman.a))
cluster_2 = Cluster_2(geo=travelingsalesman.a)  # -> int_2, geo_4
travelingsalesman_2 = PythonScript(allPts=travelingsalesman.a, startIndex=cluster_2.int_2, iterations=subtraction)  # -> out, simplify(a); inputs allPts: list of Point3d, startIndex: Int32, iterations: Int32; same code as travelingsalesman

# ----
interpolate = Interpolate(Vertices=travelingsalesman_2.a, Degree=3, Periodic=False, KnotStyle=1)  # -> Curve, Length, Domain
geometry_3 = Geometry(interpolate.Curve)

# ==== cluster Cluster
pt = ClusterInput()
pln = ClusterInput()
pt_2 = Point(pt)
pln_2 = Plane(pln)
project = Project(Geometry=pt_2, Plane=pln_2)
bbox = BoundingBox(Content=project, Union="true", Plane=pln_2)  # -> Box, Box_2
lng = ListLength(List=pt_2)
edges = BrepEdges(Brep=bbox.Box)  # -> Naked, Interior, NonManifold
series = Series(Start=0, Step=1, Count=lng)
join = JoinCurves(Curves=edges.Naked, Preserve=False)
crv_cp = CurveCP(Point=pt_2, Curve=join)  # -> Point, Parameter, Distance
sort = SortList(Keys=crv_cp.Parameter, ValuesA=pt_2)  # -> List, ValuesA
sort_2 = SortList(Keys=crv_cp.Parameter, ValuesA=series)  # -> List, ValuesA
pt_3 = Point(sort.ValuesA)
int = Integer(sort_2.ValuesA)
pt_4 = ClusterOutput(pt_3)
int_2 = ClusterOutput(int)

# ==== cluster Cluster_2
geo = ClusterInput()
geo_2 = Geometry(geo)
shift = ShiftList(List=geo_2, Shift=1, Wrap=True)
short = ShortestList(ListA=shift, ListB=geo_2, TrimMode=2)  # -> ListA, ListB
dist = Distance(PointA=short.ListA, PointB=short.ListB)
avr = Average(Input=dist)
subtraction = Subtraction(A=dist, B=avr)
abs = Absolute(Value=subtraction)
lng = ListLength(List=geo_2)
series = Series(Start=0, Step=1, Count=lng)
number_slider = Slider(0, range=0..10)
sort = SortList(Keys=abs, ValuesA=series)  # -> Keys, reverse(ValuesA)
sort_2 = SortList(Keys=abs, ValuesA=geo_2)  # -> Keys, reverse(ValuesA)
item = ListItem(List=sort_2.ValuesA, Index=number_slider, Wrap=True)
item_2 = ListItem(List=sort.ValuesA, Index=number_slider, Wrap=True)
geo_3 = Geometry(item)
int = Integer(item_2)
geo_4 = ClusterOutput(geo_3)
int_2 = ClusterOutput(int)

# ==== cluster STDDEV
data = ClusterInput()
data_2 = Data(data)
avr = Average(Input=data_2)
subtraction = Subtraction(A=data_2, B=avr)
sqr = Square(Value=subtraction)
avr_2 = Average(Input=sqr)
sqrt = SquareRoot(Value=avr_2)
y = ClusterOutput(sqrt)
