# Grasshopper definition camera_tracer_v3.ghx (Grasshopper 1.0.7)
# plug-ins: Firefly.X, Pufferfish

# ---- group: Firefly to Image
dam = DataDam(BufferDelay=10000000, BufferMode=0)
saturation = BrightnessAndSaturation(BitmapToModify=dam, SaturationMultiplier=Slider(0, range=0..1), BrightnessMultiplier=1)
contrast = Contrast(BitmapToModify=saturation, ContrastMultiplier=Slider(0.801, range=0..1))
invert = Invert(BitmapToModify=contrast)
mesh = MeshFromImage(Bmp=invert, Sx=Domain(0, 24), Sy=Domain(0, 18), Z=1, C=True)
demesh = DeconstructMesh(Mesh=mesh)  # -> Vertices, Faces, Colours, Normals

# ----
geo = Geometry(demesh.Vertices)
pdecon = Deconstruct(Point=geo)  # -> XComponent, YComponent, ZComponent
stddev = STDDEV(data=pdecon.ZComponent)
avr = Average(Input=pdecon.ZComponent)
multiplication = Multiplication(A=stddev, B=Slider(2.7, range=1..4))
addition = Addition(A=avr, B=multiplication)
larger = LargerThan(FirstNumber=pdecon.ZComponent, SecondNumber=addition)  # -> LargerThan, OrEqualTo
dispatch = Dispatch(List=geo, DispatchPattern=larger.LargerThan)  # -> ListA, ListB
deconstruct = Deconstruct(Point=dispatch.ListA)  # -> XComponent, YComponent, ZComponent
construct_point = ConstructPoint(XCoordinate=deconstruct.XComponent, YCoordinate=deconstruct.YComponent, ZCoordinate=0)
geometry = Geometry(construct_point)

# ---- group: get most likely line endpoint
point = Point(geometry)
proximity_2d = Proximity2D(Points=point, Plane=PlaneXY(0, 0, 0), Group=5)  # -> simplify(Links), simplify(Topology)
end_points = EndPoints(Curve=proximity_2d.Links)  # -> Start, End
vector_2pt = Vector2Pt(PointA=end_points.Start, PointB=end_points.End, Unitize=False)  # -> Vector, Length
average = Average(Input=vector_2pt.Vector)
xy_plane = XYPlane(Origin=Point(0, 0, 0))
angle = Angle(VectorA=average, VectorB=vector_2pt.Vector, Plane=xy_plane)  # -> Angle, Reflex
minimum = Minimum(A=angle.Angle, B=angle.Reflex)
degrees = Degrees(Radians=minimum)
bounds = Bounds(Numbers=degrees)
number = Number(flatten(bounds))
sort_list = SortList(Keys=number, ValuesA=point)  # -> Keys, ValuesA
list_item = ListItem(List=sort_list.ValuesA, Index=0, Wrap=True)
point_2 = Point(list_item)

# ---- group: generate curve (using Pufferfish Plugin)
point_sort_items = PointSortItems(Start=point_2, Points=geometry)  # -> SortedItems, SortedIndices, SortedPoints
nurbs_curve = NurbsCurve(Vertices=point_sort_items.SortedPoints, Degree=3, Periodic=False)  # -> Curve, Length, Domain
smooth_curve = SmoothCurve(
    Curve=nurbs_curve.Curve,
    Steps=Slider(10, range=0..10),
    StartType=0,
    EndType=0,
    DeviationTolerance=1,
    AngleTolerance=0.05)

# ----
geometry_2 = Geometry(smooth_curve)

# ==== cluster STDDEV
data = ClusterInput()
data_2 = Data(data)
avr = Average(Input=data_2)
subtraction = Subtraction(A=data_2, B=avr)
sqr = Square(Value=subtraction)
avr_2 = Average(Input=sqr)
sqrt = SquareRoot(Value=avr_2)
y = ClusterOutput(sqrt)
