# Grasshopper definition PCA_example.gh (Grasshopper 0.9.76)
# plug-ins: Python Interpreter, GH_CPython

pt = Point(Tree({0}: [Point(3, 2, 5)], {1}: [Point(-2, 1, 6)], {2}: [Point(-1, 0, 4)], {3}: [Point(4, 3, 4)], {4}: [Point(10, -5, -6)]))
pdecon = Deconstruct(Point=pt)  # -> XComponent, YComponent, ZComponent
dots = DotDisplay(Point=pt, Colour=ColourSwatch(SwatchColor=RGB(139, 77, 240)), Size=Slider(0.061, range=0..0.2))
merge = Merge(Data1=pdecon.XComponent, Data2=pdecon.YComponent, Data3=pdecon.ZComponent)
principal_component_analysis = PrincipalComponentAnalysis(data=merge)  # -> output, corrcoef, pca_y; inputs data: tree
#   port data: [required] - [type = int] - [default = None] Descripe your input here * bullet point. * bullet point
#   port output: indicate your output description here. refers to a new line.
# ---------- principal_component_analysis: Python ----------
import numpy as np
from matplotlib.mlab import PCA


from numpy import mean,cov,double,cumsum,dot,linalg,array,rank
from pylab import plot,subplot,axis,stem,show,figure

def princomp(A):
     """ performs principal components analysis 
         (PCA) on the n-by-p data matrix A
         Rows of A correspond to observations, columns to variables. 

     Returns :  
      coeff :
        is a p-by-p matrix, each column containing coefficients 
        for one principal component.
      score : 
        the principal component scores; that is, the representation 
        of A in the principal component space. Rows of SCORE 
        correspond to observations, columns to components.
      latent : 
        a vector containing the eigenvalues 
        of the covariance matrix of A.
     """
     # computing eigenvalues and eigenvectors of covariance matrix
     M = (A-mean(A.T,axis=1)).T # subtract the mean (along columns)
     [latent,coeff] = linalg.eig(cov(M)) # attention:not always sorted
     score = dot(coeff.T,M) # projection of the data in the new space
     return coeff,score,latent


def raggedListToDataTree(raggedList):
    rl = raggedList
    result = DataTree[object]()
    for i in range(len(rl)):
        temp = []
        for j in range(len(rl[i])):
            temp.append(rl[i][j])
        path = GH_Path(i)
        result.AddRange(temp, path)
    return result

npdata = np.array(_data)
pca = PCA(npdata)

pca_y_ = pca.Y.tolist()


corrcoef = np.corrcoef(npdata)
corrcoef_ = np.nan_to_num(corrcoef).tolist()
# ---------- end principal_component_analysis ----------
ghcpy_to_datatree = PythonScript(input=principal_component_analysis.pca_y)  # -> output
# ---------- ghcpy_to_datatree: Python ----------
import rhinoscriptsyntax as rs

import Rhino.Geometry as rg
from clr import AddReference as addr
addr("Grasshopper")

from System import Object
from Grasshopper import DataTree
from Grasshopper.Kernel.Data import GH_Path

def raggedListToDataTree(raggedList):
    rl = raggedList
    result = DataTree[object]()
    for i in range(len(rl)):
        temp = []
        for j in range(len(rl[i])):
            temp.append(rl[i][j])
        #print i, " - ",temp
        path = GH_Path(i)
        result.AddRange(temp, path)
    return result

def dataTreeToList(aTree):
    theList = []
    for i in range(aTree.BranchCount ):
        thisListPart = []
        thisBranch = aTree.Branch(i)
        for j in range(len(thisBranch)):
            thisListPart.append( thisBranch[j] )
        theList.append(thisListPart)
    return theList

print _input
eval_input = eval(_input) # this is so hacky
output_ =  raggedListToDataTree(eval_input)
# ---------- end ghcpy_to_datatree ----------
panel = Panel("""A
B
C
D
E""")
item = ListItem(List=ghcpy_to_datatree, Index=0, Wrap=True)  # -> Item, Item1
pt_2 = ConstructPoint(XCoordinate=item.Item, YCoordinate=item.Item1, ZCoordinate=0)
Y = UnitY(Factor=Slider(0.1, range=0..1))
dots_2 = DotDisplay(Point=pt_2, Colour=RGB(0, 0, 0), Size=Slider(0.061, range=0..0.2))
move = Move(Geometry=pt_2, Motion=Y)  # -> Geometry, Transform
tag = TextTag(Location=move.Geometry, Text=graft(panel))
panel_2 = Panel(ghcpy_to_datatree)
