# Grasshopper definition PCA_example_3d.gh (Grasshopper 0.9.76)
# plug-ins: Python Interpreter, GH_CPython

# mpg disp  hp drat    wt  qsec
# Mazda RX4         21.0  160 110 3.90 2.620 16.46
# Mazda RX4 Wag     21.0  160 110 3.90 2.875 17.02
# Datsun 710        22.8  108  93 3.85 2.320 18.61
# Hornet 4 Drive    21.4  258 110 3.08 3.215 19.44
# Hornet Sportabout 18.7  360 175 3.15 3.440 17.02
# Valiant           18.1  225 105 2.76 3.460 20.22
panel = Panel("""21.0,160,110,3.90,2.620,16.46
21.0,160,110,3.90,2.875,17.02
22.8,108,93,3.85,2.320,18.61
21.4,258,110,3.08,3.215,19.44
18.7,360,175,3.15,3.440,17.02
18.1,225,105,2.76,3.460,20.22""")
panel_2 = Panel("""Mazda RX4
Mazda RX4 Wag     
Datsun 710        
Hornet 4 Drive    
Hornet Sportabout 
Valiant          """)
split = TextSplit(Text=panel, Separators=",")
principal_component_analysis = PrincipalComponentAnalysis(data=split)  # -> output, corrcoef, pca_y, pca_wt; inputs data: tree
#   port data: [required] - [type = int] - [default = None] Descripe your input here * bullet point. * bullet point
#   port output: indicate your output description here. refers to a new line.
# ---------- principal_component_analysis: Python ----------
import numpy as np
from matplotlib.mlab import PCA


from numpy import mean,cov,double,cumsum,dot,linalg,array,rank
from pylab import plot,subplot,axis,stem,show,figure

def princomp(A):
     """ performs principal components analysis 
         (PCA) on the n-by-p data matrix A
         Rows of A correspond to observations, columns to variables. 

     Returns :  
      coeff :
        is a p-by-p matrix, each column containing coefficients 
        for one principal component.
      score : 
        the principal component scores; that is, the representation 
        of A in the principal component space. Rows of SCORE 
        correspond to observations, columns to components.
      latent : 
        a vector containing the eigenvalues 
        of the covariance matrix of A.
     """
     # computing eigenvalues and eigenvectors of covariance matrix
     M = (A-mean(A.T,axis=1)).T # subtract the mean (along columns)
     [latent,coeff] = linalg.eig(cov(M)) # attention:not always sorted
     score = dot(coeff.T,M) # projection of the data in the new space
     return coeff,score,latent


def raggedListToDataTree(raggedList):
    rl = raggedList
    result = DataTree[object]()
    for i in range(len(rl)):
        temp = []
        for j in range(len(rl[i])):
            temp.append(rl[i][j])
        path = GH_Path(i)
        result.AddRange(temp, path)
    return result

npdata = np.array(_data)
pca = PCA(npdata)

pca_y_ = pca.Y.tolist()

pca_wt_ = pca.Wt.tolist()

corrcoef = np.corrcoef(npdata)
corrcoef_ = np.nan_to_num(corrcoef).tolist()
# ---------- end principal_component_analysis ----------
ghcpy_to_datatree = PythonScript(input=principal_component_analysis.pca_y)  # -> output
# ---------- ghcpy_to_datatree: Python ----------
import rhinoscriptsyntax as rs

import Rhino.Geometry as rg
from clr import AddReference as addr
addr("Grasshopper")

from System import Object
from Grasshopper import DataTree
from Grasshopper.Kernel.Data import GH_Path

def raggedListToDataTree(raggedList):
    rl = raggedList
    result = DataTree[object]()
    for i in range(len(rl)):
        temp = []
        for j in range(len(rl[i])):
            temp.append(rl[i][j])
        #print i, " - ",temp
        path = GH_Path(i)
        result.AddRange(temp, path)
    return result

def dataTreeToList(aTree):
    theList = []
    for i in range(aTree.BranchCount ):
        thisListPart = []
        thisBranch = aTree.Branch(i)
        for j in range(len(thisBranch)):
            thisListPart.append( thisBranch[j] )
        theList.append(thisListPart)
    return theList

print _input
eval_input = eval(_input) # this is so hacky
output_ =  raggedListToDataTree(eval_input)
# ---------- end ghcpy_to_datatree ----------
ghcpy_to_datatree_2 = PythonScript(input=principal_component_analysis.pca_wt)  # -> output; same code as ghcpy_to_datatree
ghcpy_to_datatree_3 = PythonScript(input=principal_component_analysis.corrcoef)  # -> output; same code as ghcpy_to_datatree

item = ListItem(List=ghcpy_to_datatree, Index=0, Wrap=True)  # -> Item, Item1, Item2
pt = ConstructPoint(XCoordinate=item.Item, YCoordinate=item.Item1, ZCoordinate=item.Item2)
Y = UnitY(Factor=Slider(0.1, range=0..1))
dots = DotDisplay(Point=pt, Colour=RGB(0, 0, 0), Size=Slider(0.061, range=0..0.2))
move = Move(Geometry=pt, Motion=Y)  # -> Geometry, Transform
tag = TextTag(Location=move.Geometry, Text=graft(panel_2))

panel_3 = Panel(ghcpy_to_datatree_2)

split_2 = TextSplit(Text="mpg,disp,hp,drat,wt,qsec", Separators=",")
tstat = TreeStatistics(Tree=ghcpy_to_datatree_3)  # -> Paths, Length, Count
data = Data(flatten(ghcpy_to_datatree_3))
series = Series(Start=0, Step=1, Count=tstat.Count)
series_2 = Series(Start=0, Step=1, Count=tstat.Count)
matrix = ConstructMatrix(Rows=tstat.Count, Columns=tstat.Count, Values=flatten(data))
pt_2 = ConstructPoint(XCoordinate=series, YCoordinate=graft(series_2), ZCoordinate=0)
pt_3 = ConstructPoint(XCoordinate=Slider(4.8, range=0..10), YCoordinate=Slider(0, range=0..10), ZCoordinate=0)
addition = Addition(A=pt_3, B=pt_2)  # -> flatten(Result)
gradient = Gradient(LowerLimit=0, UpperLimit=1, Parameter=data, stops=[0.15: RGB(130, 197, 255), 1: RGB(220, 0, 40)])
swatch = ColourSwatch(SwatchColor=RGB(0, 0, 0))
tag_2 = TextTag3D(Location=addition, Text=flatten(data), Size=Slider(0.084, range=0..1), Colour=gradient, Justification=5)
matrix_2 = DisplayMatrix(matrix, Digits=4)
panel_4 = Panel(ghcpy_to_datatree_3)

panel_5 = Panel(ghcpy_to_datatree)
