# Grasshopper definition pluto_1_extrude.gh (Grasshopper 0.9.76)

geometry = Geometry([<curve referenced from the Rhino model> x946])
getuserstringsfromgeo = GetUserStringsFromGeo(geometry=geometry)  # -> out, U, simplify(K), simplify(V)
panel = Panel(getuserstringsfromgeo.K)
keysearch = KeyValueSearch(Keys=getuserstringsfromgeo.K, Values=getuserstringsfromgeo.V, Search="BuiltFAR")
num = Number(flatten(keysearch))
simplify = SimplifyCurve(Curve=geometry)  # -> Curve, Simplified
multiplication = Multiplication(A=Slider(12, range=0..100), B=num)
cp = ControlPoints(Curve=simplify.Curve)  # -> Points, Weights, Knots
Z = UnitZ(Factor=multiplication)
boundary = BoundarySurfaces(Edges=simplify.Curve)
lng = ListLength(List=cp.Points)  # -> flatten(Length)
panel_2 = Panel(num)
extr = Extrude(Base=boundary, Direction=Z)
panel_3 = Panel(lng)
mesh = MeshBrep(
    Brep=extr,
    Settings={GridMaxCount=0, GridMinCount=16, JaggedSeams=False, MaxEdgeLength=0, MinEdgeLength=0.0001, MinTolerance=0, Refine=True, RefineAngle=0, RelativeTolerance=0.65, SimplePlanes=True, Tolerance=0})

# ==== cluster GetUserStringsFromGeo
geometry = ClusterInput()
key = ClusterInput()
getuserstringsfromgeo = PythonScript(geometry=geometry, key=key)  # -> out, U, K, V; inputs geometry: GeometryBase
# ---------- getuserstringsfromgeo: Python ----------
"""
Heavily based off (read: copy-pasted) of Finches, by Benjamin Golder and Nicholas de Monchaux
https://github.com/localcode/finches
shpToPoints modification by Scott Overall, 2014

"""

if geometry:
    data = geometry.GetUserStrings()
    d = {}
    k = []
    v = []
    d = data
    if key:
        for u in data: 
            if(u == key):            
                k = u
                v = data[u]
    else:
        for u in data:   
            k.append(u)
            v.append(data[u])
    U = d
    K = k
    V = v
# ---------- end getuserstringsfromgeo ----------
out = ClusterOutput(getuserstringsfromgeo.out)
U = ClusterOutput(getuserstringsfromgeo.U)
K = ClusterOutput(getuserstringsfromgeo.K)
V = ClusterOutput(getuserstringsfromgeo.V)
