# Grasshopper definition pluto_2_PCA.gh (Grasshopper 0.9.76)
# plug-ins: Python Interpreter, Human, GH_CPython, Owl.GH

geometry = Geometry([<curve referenced from the Rhino model> x946])
getuserstringsfromgeo = GetUserStringsFromGeo(geometry=geometry)  # -> out, U, simplify(K), simplify(V)
preview = CustomPreview(Geometry=geometry, Shader=ColourSwatch(SwatchColor=RGB(56, 56, 56)))
panel = Panel(getuserstringsfromgeo.K)

keysearch = KeyValueSearch(Keys=getuserstringsfromgeo.K, Values=getuserstringsfromgeo.V, Search="BuiltFAR")  # disabled
number_slider = Slider(12, range=0..100)  # disabled
num = Number(flatten(keysearch))  # disabled
simplify = SimplifyCurve(Curve=geometry)  # -> Curve, Simplified; disabled
multiplication = Multiplication(A=number_slider, B=num)  # disabled
cp = ControlPoints(Curve=simplify.Curve)  # -> Points, Weights, Knots; disabled
Z = UnitZ(Factor=multiplication)  # disabled
boundary = BoundarySurfaces(Edges=simplify.Curve)  # disabled
lng = ListLength(List=cp.Points)  # -> flatten(Length); disabled
extr = Extrude(Base=boundary, Direction=Z)  # disabled
panel_2 = Panel(lng)  # disabled
mesh = MeshBrep(
    Brep=extr,
    Settings={GridMaxCount=0, GridMinCount=16, JaggedSeams=False, MaxEdgeLength=0, MinEdgeLength=0.0001, MinTolerance=0, Refine=True, RefineAngle=0, RelativeTolerance=0.65, SimplePlanes=True, Tolerance=0})  # disabled

# ----
# Gather data
panel_3 = Panel("""BuiltFAR
YearBuilt
LandUse
NumFloors
UnitsTotal""")
keysearch_2 = KeyValueSearch(Keys=getuserstringsfromgeo.K, Values=getuserstringsfromgeo.V, Search=panel_3)
num_2 = Number(keysearch_2)
tensor = ConstructTensor(Values=num_2)  # -> flatten(Tensor)
tensorset = ConstructTensorSet(Tensors=tensor)

tensorset_to_datatree = TensorSetToDataTree(TensorSet=tensorset)  # "TS->DT"

principal_component_analysis = PrincipalComponentAnalysis(data=tensorset_to_datatree)  # -> output, corrcoef, pca_y, pca_wt; inputs data: tree
#   port data: [required] - [type = int] - [default = None] Descripe your input here * bullet point. * bullet point
#   port output: indicate your output description here. refers to a new line.
# ---------- principal_component_analysis: Python ----------
import numpy as np
from matplotlib.mlab import PCA


from numpy import mean,cov,double,cumsum,dot,linalg,array,rank
from pylab import plot,subplot,axis,stem,show,figure

def princomp(A):
     """ performs principal components analysis 
         (PCA) on the n-by-p data matrix A
         Rows of A correspond to observations, columns to variables. 

     Returns :  
      coeff :
        is a p-by-p matrix, each column containing coefficients 
        for one principal component.
      score : 
        the principal component scores; that is, the representation 
        of A in the principal component space. Rows of SCORE 
        correspond to observations, columns to components.
      latent : 
        a vector containing the eigenvalues 
        of the covariance matrix of A.
     """
     # computing eigenvalues and eigenvectors of covariance matrix
     M = (A-mean(A.T,axis=1)).T # subtract the mean (along columns)
     [latent,coeff] = linalg.eig(cov(M)) # attention:not always sorted
     score = dot(coeff.T,M) # projection of the data in the new space
     return coeff,score,latent


def raggedListToDataTree(raggedList):
    rl = raggedList
    result = DataTree[object]()
    for i in range(len(rl)):
        temp = []
        for j in range(len(rl[i])):
            temp.append(rl[i][j])
        path = GH_Path(i)
        result.AddRange(temp, path)
    return result

npdata = np.array(_data)
pca = PCA(npdata)

pca_y_ = pca.Y.tolist()

pca_wt_ = pca.Wt.tolist()

corrcoef = np.corrcoef(npdata)
corrcoef_ = np.nan_to_num(corrcoef).tolist()
# ---------- end principal_component_analysis ----------
# PCA
ghcpy_to_datatree = PythonScript(input=principal_component_analysis.pca_y)  # -> output
# ---------- ghcpy_to_datatree: Python ----------
import rhinoscriptsyntax as rs

import Rhino.Geometry as rg
from clr import AddReference as addr
addr("Grasshopper")

from System import Object
from Grasshopper import DataTree
from Grasshopper.Kernel.Data import GH_Path

def raggedListToDataTree(raggedList):
    rl = raggedList
    result = DataTree[object]()
    for i in range(len(rl)):
        temp = []
        for j in range(len(rl[i])):
            temp.append(rl[i][j])
        #print i, " - ",temp
        path = GH_Path(i)
        result.AddRange(temp, path)
    return result

def dataTreeToList(aTree):
    theList = []
    for i in range(aTree.BranchCount ):
        thisListPart = []
        thisBranch = aTree.Branch(i)
        for j in range(len(thisBranch)):
            thisListPart.append( thisBranch[j] )
        theList.append(thisListPart)
    return theList

print _input
eval_input = eval(_input) # this is so hacky
output_ =  raggedListToDataTree(eval_input)
# ---------- end ghcpy_to_datatree ----------
ghcpy_to_datatree_2 = PythonScript(input=principal_component_analysis.corrcoef)  # -> output; same code as ghcpy_to_datatree

item = ListItem(List=ghcpy_to_datatree, Index=0, Wrap=True)  # -> Item, Item1, Item2
pt = ConstructPoint(XCoordinate=item.Item, YCoordinate=item.Item1, ZCoordinate=item.Item2)
Y = UnitY(Factor=Slider(0.1, range=0..1))
dots = DotDisplay(Point=pt, Colour=RGB(0, 0, 0), Size=Slider(0.061, range=0..0.2))
move = Move(Geometry=pt, Motion=Y)  # -> Geometry, Transform
tag = TextTag(Location=move.Geometry)

geo = Geometry(geometry)
geo_2 = Geometry(geo)

# ---- group: get center of initial geometry
area = Area(Geometry=geo_2)  # -> Area, Centroid
bbox = BoundingBox(Content=area.Centroid, Plane=PlaneXY(0, 0, 0), UnionBox=True)  # -> Box, Box_2
area_2 = Area(Geometry=bbox.Box)  # -> Area, Centroid
avr = Average(Input=flatten(area_2.Centroid))

# ----
data = Data(flatten(pt))

# ---- group: Move result points next to initial geometry
# Move result points next to initial geometry
avr_2 = Average(Input=flatten(data))
scale = Scale(Geometry=data, Center=avr_2, Factor=Slider(48.88, range=0..110))  # -> Geometry, Transform
vec2pt = Vector2Pt(PointA=avr_2, PointB=avr, Unitize=False)  # -> Vector, Length
move_2 = Move(Geometry=scale.Geometry, Motion=vec2pt.Vector)  # -> Geometry, Transform
X = UnitX(Factor=Slider(4169, range=0..11000))
move_3 = Move(Geometry=move_2.Geometry, Motion=X)  # -> Geometry, Transform

# ----
geo_3 = Geometry(geo)
area_3 = Area(Geometry=geo_3)  # -> Area, Centroid
scale_2 = Scale(Geometry=geo_3, Center=area_3.Centroid, Factor=Slider(0.02151, range=0..1))  # -> Geometry, Transform
area_4 = Area(Geometry=scale_2.Geometry)  # -> Area, Centroid
orient = Orient(Geometry=scale_2.Geometry, Source=area_4.Centroid, Target=move_3.Geometry)  # -> Geometry, Transform
preview_2 = CustomPreview(Geometry=orient.Geometry, Shader=ColourSwatch(SwatchColor=RGB(31, 9, 24)))

# ----
# Select geometry
pipeline = GeometryPipeline(
    GroupByLayer=False,
    GroupByType=False,
    IncludeHidden=True,
    IncludeLocked=True,
    LayerFilter="UI",
    NameFilter="*",
    TypeFilter=4)
incurves = PointInCurves(Point=move_3.Geometry, Curves=pipeline)  # -> Relationship, Index, Point
bool = Boolean(simplify(graft(incurves.Relationship)))

# ---- group: result
panel_4 = Panel(panel_3)
# Result data to nice text
panel_5 = Panel(": ")
dispatch = Dispatch(List=num_2, DispatchPattern=bool)  # -> ListA, ListB
concat = Concatenate(FragmentA=panel_4, FragmentC=panel_5, FragmentB=dispatch.ListA)
null = NullItem(Item=dispatch.ListA)  # -> NullFlags, InvalidFlags, Description
ma = MassAddition(Input=null.NullFlags)  # -> Result, PartialResults
bool_2 = Boolean(ma.Result)
dispatch_2 = Dispatch(List=concat, DispatchPattern=bool_2)  # -> ListA, ListB
txt = Text(dispatch_2.ListB)
join = TextJoin(Text=txt, Join="  ")

# ----
dispatch_3 = Dispatch(List=getuserstringsfromgeo.K, DispatchPattern=bool)  # -> ListA, ListB
dispatch_4 = Dispatch(List=getuserstringsfromgeo.V, DispatchPattern=bool)  # -> ListA, ListB
panel_6 = Panel(dispatch_4.ListA)
tag_2 = TextTag(Location=move_3.Geometry, Text=flatten(join), Colour=ColourSwatch(SwatchColor=RGB(255, 255, 255)))

sift = SiftPattern(List=geometry, SiftPattern=flatten(bool))  # -> Output0, Output1
# Display on map
number_slider_2 = Slider(5, range=0..10)
area_5 = Area(Geometry=sift.Output1)  # -> Area, Centroid
join_2 = TextJoin(Text=txt)
previewlw = CustomPreviewLineweights(Geometry=sift.Output1, Shader=ColourSwatch(SwatchColor=RGB(175, 250, 95)), Thickness=number_slider_2, Absolute=False)
tag_3 = TextTag3D(
    Location=area_5.Centroid,
    Text=flatten(join_2),
    Size=Slider(16, range=0..1000),
    Colour=ColourSwatch(SwatchColor=RGB(255, 255, 255)),
    Justification=7)

panel_7 = Panel(join)

# ==== cluster GetUserStringsFromGeo
geometry = ClusterInput()
key = ClusterInput()
getuserstringsfromgeo = PythonScript(geometry=geometry, key=key)  # -> out, U, K, V; inputs geometry: GeometryBase
# ---------- getuserstringsfromgeo: Python ----------
"""
Heavily based off (read: copy-pasted) of Finches, by Benjamin Golder and Nicholas de Monchaux
https://github.com/localcode/finches
shpToPoints modification by Scott Overall, 2014

"""

if geometry:
    data = geometry.GetUserStrings()
    d = {}
    k = []
    v = []
    d = data
    if key:
        for u in data: 
            if(u == key):            
                k = u
                v = data[u]
    else:
        for u in data:   
            k.append(u)
            v.append(data[u])
    U = d
    K = k
    V = v
# ---------- end getuserstringsfromgeo ----------
out = ClusterOutput(getuserstringsfromgeo.out)
U = ClusterOutput(getuserstringsfromgeo.U)
K = ClusterOutput(getuserstringsfromgeo.K)
V = ClusterOutput(getuserstringsfromgeo.V)
