# Grasshopper definition Receiving_FaceOSC_Data.gh (Grasshopper 1.0.7)
# plug-ins: gHowl

# @dantaeyoung
# Receiving Data from FaceOSC
panel = Panel("8338")

# ---- group: Receiving OSC messages from Wekinator
udp = UDPReceiver(Port=panel, Pattern="999")  # -> Info, Data

# ----
dam = DataDam(DataA=udp.Data, BufferDelay=2500000, BufferMode=2)

# ---- group: Structure FaceOSC output as numbers only
# 1. Receiving info from FaceOSC
lng = ListLength(List=dam)
larger = LargerThan(FirstNumber=lng, SecondNumber="2")  # -> LargerThan, OrEqualTo
filter = StreamFilter(Gate=larger.LargerThan, Stream1=dam)
tmatch = MatchText(Text=filter, Pattern="/*", Case=True)
data = Data(graft(filter))
ma = MassAddition(Input=tmatch)  # -> Result, graft(PartialResults)
tstat = TreeStatistics(Tree=data)  # -> Paths, Length, Count
path = ConstructPath(Indices=ma.PartialResults)  # -> flatten(Branch)
replace = ReplacePaths(Data=data, Search=tstat.Paths, Replace=path)
split = SplitList(List=replace, Index="1")  # -> ListA, flatten(ListB)

# ----
panel_2 = Panel(split.ListB)

# ---- group: This gets the openness of your mouth!
list_item = ListItem(List=split.ListB, Index="8", Wrap=True)

# ---- group: This gets the X, Y coordinates of the center of your face and turns it into a point!
# 2. Processing data
list_item_2 = ListItem(List=split.ListB, Index=0, Wrap=True)  # -> Item, Item1, Item2
construct_point = ConstructPoint(XCoordinate=list_item_2.Item1, YCoordinate=list_item_2.Item2, ZCoordinate=0)

# ----
panel_3 = Panel(list_item)
