# Grasshopper definition FunctionalReduce.ghx (Grasshopper 0.9.76)
# plug-ins: Python Interpreter

series = Series(Start=Slider(1, range=0..1), Step=1, Count=10)
# FunctionalReduce - takes a Lambda, does a reduce/foldl function
# Dan Taeyoung (@dantaeyoung) : http://github.com/provolot/GrasshopperArsenal
panel = Panel(series)

# ---- group: Lambda can be an expression (with params 'a' or 'b')
reduce = PythonScript(Lambda="x + y", List=series)  # -> Result; inputs List: list
# ---------- reduce: Python ----------
import rhinoscriptsyntax as rs
import ghpythonlib.components as ghcomp

lambdaIndex = int(ghenv.Component.Params.IndexOfInputParam('Lambda'))
lambdaFunc =  ghenv.Component.Params.Input[lambdaIndex].Sources[0].Attributes.GetTopLevel.DocObject.Name
lambdaFunc = lambdaFunc.replace(" ", "")

if(Lambda):
    def ghFunc(x, y):
        return eval(Lambda)
else:
    ghFunc = getattr(ghcomp, lambdaFunc)

###########

if(not Initial):
    Initial = 0

Result = reduce(lambda x, y: ghFunc(x, y), List, Initial)
# ---------- end reduce ----------

# ----
multiplication = Multiplication()

# ---- group: Lambda can also be a Grasshopper component
addition = Addition()
reduce_2 = PythonScript(Lambda=addition, List=series)  # -> Result; inputs List: list; same code as reduce

# ---- group: Reduce can also take an initial value
reduce_3 = PythonScript(Lambda=multiplication, List=series, Initial=Slider(1, range=0..1))  # -> Result; inputs List: list
# ---------- reduce_3: Python ----------
import rhinoscriptsyntax as rs
import ghpythonlib.components as ghcomp

lambdaIndex = int(ghenv.Component.Params.IndexOfInputParam('Lambda'))
lambdaFunc =  ghenv.Component.Params.Input[lambdaIndex].Sources[0].Attributes.GetTopLevel.DocObject.Name
lambdaFunc = lambdaFunc.replace(" ", "")

if(Lambda):
    def ghFunc(x, y):
        return eval(Lambda)
else:
    ghFunc = getattr(ghcomp, lambdaFunc)

###########

if(not Initial):
    Initial = 0

    
Result = reduce(lambda x, y: ghFunc(x, y), List, Initial)
# ---------- end reduce_3 ----------

# ----
panel_2 = Panel(reduce_3)
panel_3 = Panel(reduce_2)
panel_4 = Panel(reduce)
