# Grasshopper definition GeometrySelector_v0.1.ghx (Grasshopper 0.9.76)
# plug-ins: Python Interpreter, HDTReference

# GeometrySelector: Select Geometry with the mouse and send that info to others
# Dan Taeyoung (@dantaeyoung) : http://github.com/provolot/GrasshopperArsenal
boolean_toggle = BooleanToggle(False)
gate_not = GateNot(A=boolean_toggle)
timerlocker = TimerLocker(DisableTimers=gate_not)
# ---------- timerlocker: VB ----------
    'We need to disable the timer that is associated with this VB component.
    'First, find the document that contains this VB component
      Dim ghdoc As GH_Document = owner.OnPingDocument()
      If (ghdoc Is Nothing) Then Return
      'Then, iterate over all objects in the document to find all timers.
      For Each docobj As IGH_DocumentObject In ghdoc.Objects
        'Try to cast the object to a GH_Timer
        Dim timer As Special.GH_Timer = TryCast(docobj, Special.GH_Timer)
        If (timer Is Nothing) Then Continue For
        'If the cast was successful, then see if this component is
        'part of the timer target list.
        If (timer.Targets.Contains(owner.InstanceGuid)) Then

          'If it is,

          If(DisableTimers) Then
            'lock the timer.
            print("Timer Locked")
            timer.Locked = True
          Else
            print("Timer Unlocked")
            Timer.Locked = False
          End If

        End If
      Next
# ---------- end timerlocker ----------
timer = Timer(TimerInterval=100, Target=[objects_by_selection, timerlocker])  # disabled
objects_by_selection = ObjectsBySelection(Reset=boolean_toggle)  # -> SelectedGeometry, ObjectAttributes
getguidfromrhinogeometry = PythonScript(RhinoGeometry=objects_by_selection.SelectedGeometry)  # -> out, GUID
# ---------- getguidfromrhinogeometry: Python ----------
import rhinoscriptsyntax as rs

print RhinoGeometry.Id
GUID = str(RhinoGeometry.Id)
# ---------- end getguidfromrhinogeometry ----------
to_flux = Geometry(getguidfromrhinogeometry.GUID)
geometry_pipeline = GeometryPipeline(
    GroupByLayer=False,
    GroupByType=False,
    IncludeHidden=True,
    IncludeLocked=True,
    LayerFilter="*",
    NameFilter="*",
    TypeFilter=1073741852)
from_flux = Geometry(to_flux)
getgeometrythatmatchesguid = GetGeometryThatMatchesGuid(geometry=geometry_pipeline, guid=from_flux)
unit_z = UnitZ(Factor=Slider(19, range=0..1000))
move = Move(Geometry=getgeometrythatmatchesguid, Motion=unit_z)  # -> Geometry, Transform

# ==== cluster GetGeometryThatMatchesGuid
guid = ClusterInput()
geometry = ClusterInput()
geometrytoguid = GeometryToGuid(geometry=geometry)
guid_2 = Guid(guid)
getguidfrom = PythonScript(GUIDs=geometrytoguid, GUIDKey=guid_2)  # -> out, flatten(FoundGUIDs); inputs GUIDs: list
# ---------- getguidfrom: Python ----------
import Rhino
import rhinoscriptsyntax as rs
import scriptcontext
import System.Guid

FoundGUIDs = filter(lambda y: str(GUIDKey) == y, map(lambda x: str(x), GUIDs))
# ---------- end getguidfrom ----------
guidtogeometry = GUIDToGeometry(guid=getguidfrom.FoundGUIDs)
geometry_2 = ClusterOutput(guidtogeometry)

# ==== cluster GeometryToGuid
geometry = ClusterInput()
geometry_2 = Geometry(geometry)
guid = Guid(geometry_2)
guid_2 = ClusterOutput(guid)

# ==== cluster GUIDToGeometry
guid = ClusterInput()
guid_2 = Guid(guid)
geometry = Geometry(guid_2)
geometry_2 = ClusterOutput(geometry)
