# Grasshopper definition GoogleTranslate.gh (Grasshopper 1.0.7)
# plug-ins: Wombat

text = Panel("Hello World!")
language = ValueList({"Afrikaans": "af", "Albanian": "sq", "Amharic": "am", "Arabic": "ar", "Armenian": "hy", "Assamese": "as", "Aymara": "ay", "Azerbaijani": "az", "Bambara": "bm", "Basque": "eu"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}, selected="Korean": "ko")
language_2 = ValueList({"Afrikaans": "af", "Albanian": "sq", "Amharic": "am", "Arabic": "ar", "Armenian": "hy", "Assamese": "as", "Aymara": "ay", "Azerbaijani": "az", "Bambara": "bm", "Basque": "eu"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}, selected="English": "en")
# Google Translate for Grasshopper
# (using GhPython to call Google Translate v2 API)
# https://github.com/dantaeyoung/grasshopperarsenal
# @dantaeyoung
# Set up Google Cloud Translation and get an API Key here:
# https://cloud.google.com/translate/docs/setup
api_key = Panel("")
google_translate = GhPythonScript(api_key=api_key, source_language=language_2, source_text=text, target_language=language)  # -> translated_text
# ---------- google_translate: Python ----------
import clr
clr.AddReference("System")
from System import Uri
from System.Net import HttpWebRequest, WebRequest, WebResponse
from System.IO import StreamReader
from System.Text import Encoding
import json

def make_rest_request(url):
    request = WebRequest.Create(url)
    request.Method = "GET"

    try:
        response = request.GetResponse()
        stream = response.GetResponseStream()
        stream_reader = StreamReader(stream)
        result = stream_reader.ReadToEnd()
        stream_reader.Close()
        stream.Close()
        response.Close()

        return json.loads(result)  # Convert the JSON string to a Python object

    except Exception as e:
        return {"error": str(e)}

def translate_text(source_language, text, target_language, api_key):
    base_url = "https://translation.googleapis.com/language/translate/v2"
    query = "?q=" + text + "&source=" + source_language + "&target=" + target_language + "&key=" + api_key
    url = base_url + query
    response = make_rest_request(url)

    if 'data' in response and 'translations' in response['data']:
        return response['data']['translations'][0]['translatedText']
    else:
        return "Error: Unable to translate the text."


if(api_key.strip() == ""):
    translated_text = "API KEY MISSING!"
else:
    translated_text = translate_text(source_language, source_text, target_language, api_key)

# Output the translated text
# ---------- end google_translate ----------
panel = Panel(google_translate)
# Use the Wombat plugin's Text Outlines component to draw outlines
text_outlines = TextOutlines(TextContent=google_translate, Plane=PlaneXY(0, 0, 0), Face="Arial", Size=12, Bold=False, Italics=False)  # -> TextCurves, TextBoundingBox
