# Grasshopper definition GrasshopperGRBL.gh (Grasshopper 1.0.7)
# plug-ins: Wombat

md_slider = MDSlider(
    SliderMode=0,
    slider_value=Point(0.809731088, 0.2353136016, 0.5),
    x_domain=Domain(-0.5, 0.5),
    y_domain=Domain(-0.5, 0.5),
    z_domain=Domain(0, 1))
coordinate_system = ValueList({"Absolute": "G90", "Relative": "G91"}, selected="Relative")
units = ValueList({"Imperial (in)": "G20", "Metric (mm)": "G21"}, selected="Metric (mm)")
deconstruct = Deconstruct(Point=md_slider)  # -> XComponent, YComponent, ZComponent
panel = Panel(coordinate_system)
coordsystem = Text(coordinate_system)
xval = Number(deconstruct.XComponent)
feedrate = Number(Slider(10, range=0..10))
units_2 = Text(units)
yval = Number(deconstruct.YComponent)
panel_2 = Panel("""{UNITS}
{COORDSYSTEM}
{XVAL}
{YVAL}
{FEEDRATE}""")
merge = Merge(Data1=units_2, Data2=coordsystem, Data3=xval, Data4=yval, Data5=feedrate)
stop = Button()
replace_text_multiple = ReplaceTextMultiple(Text="$J={UNITS}{COORDSYSTEM}X{XVAL}Y{YVAL}F{FEEDRATE}", Fragment=panel_2, Replacement=merge)
panel_3 = Panel("""!
~""")
panel_4 = Panel("$J=G20G91X#XVAL#Y#YVAL#F#FEEDRATE#")
panel_5 = Panel(replace_text_multiple)
stream_filter = StreamFilter(Gate=stop, Stream1="$#")
stream_filter_2 = StreamFilter(Gate=Button(), Stream1=replace_text_multiple)
serial_connect = CSharpScript(connect=Toggle(True), port="/dev/tty.usbmodem11301", baud="115200")  # -> out, msg, sp; inputs connect: Boolean, port: String, baud: Int32
# ---------- serial_connect: C# usings ----------
using System.IO.Ports;
# ---------- serial_connect: C# ----------
SerialPort _serialPort;

if(connect) {

    _serialPort = new SerialPort(port, baud);
    _serialPort.ReadTimeout = 500;
    _serialPort.WriteTimeout = 500;


    _serialPort.Open();



    msg = "Serial port open";
    sp = _serialPort;

} else {
    //if(_serialPort) { _serialPort.Close(); }
    msg = "Serial port closed";
}
# ---------- serial_connect: C# additional code ----------
  /// <summary>
  /// This method will be called once every solution, before any calls to RunScript.
  /// </summary>
  public override void BeforeRunScript()
  { }
  /// <summary>
  /// This method will be called once every solution, after any calls to RunScript.
  /// </summary>
  public override void AfterRunScript()
  { }
# ---------- end serial_connect ----------
serial_list_ports = CSharpScript()  # -> out, ports
# ---------- serial_list_ports: C# ----------
ports = SerialPort.GetPortNames();
# ---------- end serial_list_ports ----------
panel_6 = Panel("g92")
combine_data = CombineData(Input0=stream_filter, Input1=stream_filter_2)  # -> Result, Index
serial_send = CSharpScript(sp=serial_connect.sp, message=combine_data.Result)  # -> out, res; inputs message: String
# ---------- serial_send: C# usings ----------
using System.ComponentModel;
using System.IO.Ports;
# ---------- serial_send: C# ----------
SerialPort _sp;

if(sp != null) {

    _sp = (SerialPort) sp;


    if(_sp.IsOpen) {

        _sp.WriteLine(message);
        res = _sp.ReadExisting();
    }

 }
# ---------- end serial_send ----------
panel_7 = Panel(serial_list_ports.ports)
panel_8 = Panel(serial_send.res)
