# Grasshopper definition Grasshopper_To_Firebase.gh (Grasshopper 1.0.7)
# plug-ins: Swiftlet, jSwan, Human, FirebaseListener

# ---- group: This is another way to combine the text!
# Adding data
# Adding an entry to a list of data (e.g. adding a chat message)
panel = Panel("https://cdp-colloquium-database-default-rtdb.firebaseio.com/")
concatenate = Concatenate(A=panel, Fragment_A="ourchat", Fragment_B=".json")

# ----
# @dantaeyoung
# Grasshopper <-> Firebase connection
# Plugins needed: Swiftlet, JSwan, FirebaseListener (available via PackageManager)
# 
# (FirebaseListener was built by Andrew Heumann upon request: thank you!)
# Listening to data
# This script shows two ways to ‘listen’ to a Firebase database. On the left, with the plugin FirebaseListener; on the right, with HTTP requests with the plugin Swiftlet.
# 
# The method on the left is highly recommended, as it is event-based, and will only trigger grasshopper updates downstream, when the database value changes.
# However, this requires you to have an API secret to the firebase database; anybody with this script will be able to add/delete information to/from the database.
# 
# If you’re dealing with secure or private data, use the HTTP request method on the right!
# FirebaseListener method (recommended)
# Getting data from a field or list of data
panel_2 = Panel("https://cdp-colloquium-database-default-rtdb.firebaseio.com")

# ---- group: This is another way to combine the text!
# Setting/changing data
# Setting a data field
panel_3 = Panel("https://cdp-colloquium-database-default-rtdb.firebaseio.com/")
concatenate_2 = Concatenate(A=panel_3, Fragment_A="ourname", Fragment_B=".json")

# ---- group: make sure that this doesn't have any whitespace (new lines, spaces) before or after it!
panel_4 = Panel("objects")

# ----
# Firebase Console -> [Your Project] -> Project Settings -> Service Accounts -> Database Secrets (Legacy Credentials)
panel_5 = Panel("35MKMVBaBGmdGYQdgbOY12hC2O8bZu6bd4Gs7XxJ")

# ---- group: Turn this on to start listening! Turn this off when you close the script.
boolean_toggle = BooleanToggle(False)

# ----
geometry_pipeline = GeometryPipeline(
    GroupByLayer=False,
    GroupByType=False,
    IncludeHidden=True,
    IncludeLocked=True,
    LayerFilter="*",
    NameFilter="*",
    SublayerFiltering=True,
    TypeFilter=1073741885)
firebase_listener = FirebaseListener(DatabaseURL=panel_2, AppSecret=panel_5, Key=panel_4, Listen=boolean_toggle)
# Extra-Challenge 1: Can you create a chatroom, where the size of an object is changed in Grasshopper based off of what percentage of total messages that person has had?
message_names = Panel("""dan
bob
joe
sarah
yasmeen
sarah
yasmeen
shirin
dan
joe
dan
yasmeen
shirin
dan""")

# ---- group: This is another way to combine the text!
# Setting a data field composed of several sub-fields (I.e. a list of users and their info)
panel_6 = Panel("https://cdp-colloquium-database-default-rtdb.firebaseio.com/")
concatenate_3 = Concatenate(A=panel_6, B="objects", C="/", D="grasshopper", E=".json")

# ----
# Challenge 2:
# Using the following components, can you create a ‘spatial chatroom’ - a web interface that lets you display 3d text on Rhino objects that have a particular ‘name’?
panel_7 = Panel("https://cdp-colloquium-database-default-rtdb.firebaseio.com")
# Challenges
# Challenge 1: Can you create a web interface where people can allow parts of a grasshopper script to be visible/hidden, using checkboxes?
panel_8 = Panel("https://cdp-colloquium-database-default-rtdb.firebaseio.com")
object_attributes = ObjectAttributes(ObjectOrAttributes=geometry_pipeline)  # -> Name, LayerName, LayerFullPath, Color, MaterialName, LinetypeName, GroupIndices, PlotWeight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

# ----
# Firebase Console -> [Your Project] -> Project Settings -> Service Accounts -> Database Secrets (Legacy Credentials)
panel_9 = Panel("35MKMVBaBGmdGYQdgbOY12hC2O8bZu6bd4Gs7XxJ")

# ----
# Firebase Console -> [Your Project] -> Project Settings -> Service Accounts -> Database Secrets (Legacy Credentials)
panel_10 = Panel("35MKMVBaBGmdGYQdgbOY12hC2O8bZu6bd4Gs7XxJ")

# ----
# Extra-Challenge 2: Can you create a web interface that lets you position a specific object in Grasshopper with the mouse, based on its name?
message_names_2 = Text(message_names)

# ---- group: Turn this on to start listening! Turn this off when you close the script.
boolean_toggle_2 = BooleanToggle(False)

boolean_toggle_3 = BooleanToggle(False)

# ----
deserialize_keys_and_values = DeserializeKeysAndValues(JSON=firebase_listener)  # -> Key, Value
panel_11 = Panel("https://cdp-colloquium-database-default-rtdb.firebaseio.com")

# ---- group: Try changing these!
panel_12 = Panel("grasshopper")
panel_13 = Panel("Change this!")

# ----
create_set = CreateSet(List=message_names_2)  # -> Set, Map

# ----
# Firebase Console -> [Your Project] -> Project Settings -> Service Accounts -> Database Secrets (Legacy Credentials)
panel_14 = Panel("35MKMVBaBGmdGYQdgbOY12hC2O8bZu6bd4Gs7XxJ")

deserialize_json = DeserializeJson(JSON=deserialize_keys_and_values.Value, OutputsLocked=False)  # -> Age, Name

# ---- group: geometry names
text = Text(object_attributes.Name)

# ----
panel_15 = Panel(firebase_listener)
list_length = ListLength(List=message_names_2)

# ---- group: Turn this on to start listening!
boolean_toggle_4 = BooleanToggle(False)

# ----
firebase_listener_2 = FirebaseListener(DatabaseURL=panel_7, AppSecret=panel_9, Key="objects", Listen=boolean_toggle_2)
firebase_listener_3 = FirebaseListener(DatabaseURL=panel_8, AppSecret=panel_10, Key="objects", Listen=boolean_toggle_3)
merge = Merge(Data1=panel_12, Data2=panel_13)
member_index = MemberIndex(Set=message_names_2, Member=create_set.Set)  # -> Index, Count
merge_2 = Merge(Data1="username", Data2="msg")

# ---- group: gets centers of geometry
bounding_box = BoundingBox(Content=geometry_pipeline, Plane=PlaneXY(0, 0, 0))  # -> Box, Box_2
volume = Volume(Geometry=bounding_box.Box)  # -> Volume, Centroid
point = Point(volume.Centroid)

# ----
panel_16 = Panel("""name
age""")
panel_17 = Panel(deserialize_json.Age)
panel_18 = Panel(deserialize_json.Name)

# ---- group: Change me!
panel_19 = Panel("test")

# ----
deserialize_keys_and_values_2 = DeserializeKeysAndValues(JSON=firebase_listener_3)  # -> Key, Value
merge_3 = Merge(Data1="grasshopper", Data2=Slider(89, range=0..100))
serialize_keys_and_values = SerializeKeysAndValues(Key=merge_2, Value=merge)
messages_per_name = Panel(member_index.Count)
unique_names = Panel(create_set.Set)
of_mesages = Panel(list_length)
firebase_listener_4 = FirebaseListener(DatabaseURL=panel_11, AppSecret=panel_14, Key="objects", Listen=boolean_toggle_4)
serialize_keys_and_values_2 = SerializeKeysAndValues(Key="name", Value=panel_19)
deserialize_keys_and_values_3 = DeserializeKeysAndValues(JSON=firebase_listener_2)  # -> Key, Value
panel_20 = Panel("""dan
alice
grasshopper""")

# ---- group: This 'Data dam' slows down the input, so that we're not changing the database a million times when we move the slider.
data_dam = DataDam(DataDataA=merge_3, BufferDelay=10000000, BufferMode=2)

# ----
text_2 = Text(serialize_keys_and_values)
division = Division()

# ---- group: This forces the JSON output to be read as text. Keep this in otherwise the next component will complain.
text_3 = Text(serialize_keys_and_values_2)

# ----
serialize_keys_and_values_3 = SerializeKeysAndValues(Key=panel_16, Value=data_dam)
create_text_body = CreateTextBody(
    Content=text_2,
    IsHtmlChecked=False,
    IsJavascriptChecked=False,
    IsJsonChecked=True,
    IsTextChecked=False,
    IsXmlChecked=False)
panel_21 = Panel(firebase_listener_2)
scale = Scale(Center=Point(0, 0, 0), Factor=0.5)  # -> Geometry, Transform

# ---- group: only get json values that match our input list of names
names = Text(panel_20)
member_index_2 = MemberIndex(Set=names, Member=deserialize_keys_and_values_3.Key)  # -> Index, Count
list_item = ListItem(List=graft(deserialize_keys_and_values_3.Value), Index=member_index_2.Index, Wrap=True)
data = Data(list_item)

# ----
create_text_body_2 = CreateTextBody(
    Content=text_3,
    IsHtmlChecked=False,
    IsJavascriptChecked=False,
    IsJsonChecked=True,
    IsTextChecked=False,
    IsXmlChecked=False)

# ---- group: This forces the JSON output to be read as text. Keep this in otherwise the next component will complain.
text_4 = Text(serialize_keys_and_values_3)

# ----
deserialize_keys_and_values_4 = DeserializeKeysAndValues(JSON=firebase_listener_4)  # -> Key, Value
post_request = POSTRequest(URL=concatenate, Body=create_text_body)  # -> Status, Content, Response
create_text_body_3 = CreateTextBody(
    Content=text_4,
    IsHtmlChecked=False,
    IsJavascriptChecked=False,
    IsJsonChecked=True,
    IsTextChecked=False,
    IsXmlChecked=False)
put_request = PUTRequest(URL=concatenate_2, Body=create_text_body_2)  # -> Status, Content, Response
panel_22 = Panel(firebase_listener_4)
deserialize_keys_and_values_5 = DeserializeKeysAndValues(JSON=deserialize_keys_and_values_4.Value)  # -> Key, Value
panel_23 = Panel(deserialize_keys_and_values_4.Key)
panel_24 = Panel(post_request.Content)
# Swiftlet
# Getting data from a field
panel_25 = Panel("https://cdp-colloquium-database-default-rtdb.firebaseio.com/ourname.json")
put_request_2 = PUTRequest(URL=concatenate_3, Body=create_text_body_3)  # -> Status, Content, Response

# ---- group: This is another way to combine the text!
# Getting data from a list of data (i.e, a chat)
panel_26 = Panel("https://cdp-colloquium-database-default-rtdb.firebaseio.com/")
concatenate_4 = Concatenate(A=panel_26, Fragment_A="park_requests", Fragment_B=".json")

# ----
panel_27 = Panel(deserialize_keys_and_values_5.Value)
panel_28 = Panel(deserialize_keys_and_values_5.Key)
panel_29 = Panel(put_request.Content)
panel_30 = Panel(put_request_2.Content)

# ---- group: Click the 'play' button to turn the trigger on. Be careful with this! Don't set it to update too often (max once per 2 s) or you may crash your computer, or get blocked by Firebase
trigger = Trigger(Interval=5000, TimerInterval=5000, Target=get_request)  # disabled

# ----
deserialize_json_2 = DeserializeJson(JSON=data, OutputsLocked=False)  # -> Age, Name
panel_31 = Panel(data)
text_tag_3d = TextTag3D(Size=Slider(33, range=0..100), Colour=ColourSwatch(SwatchColor=RGB(15, 132, 242)), Justification=7)
panel_32 = Panel(deserialize_json_2.Name)
trigger_2 = Trigger(Interval=5000, TimerInterval=5000, Target=get_request_2)  # disabled
get_request = GETRequest(URL=panel_25)  # -> Status, Content, Response
get_request_2 = GETRequest(URL=concatenate_4)  # -> Status, Content, Response
deserialize_keys_and_values_6 = DeserializeKeysAndValues(JSON=get_request.Content)  # -> Key, Value
deserialize_keys_and_values_7 = DeserializeKeysAndValues(JSON=get_request_2.Content)  # -> Key, Value
panel_33 = Panel(deserialize_keys_and_values_7.Key)
panel_34 = Panel(deserialize_keys_and_values_6.Key)
panel_35 = Panel(deserialize_keys_and_values_6.Value)
deserialize_keys_and_values_8 = DeserializeKeysAndValues(JSON=deserialize_keys_and_values_7.Value)  # -> Key, Value
deserialize_keys_and_values_9 = DeserializeKeysAndValues()  # -> Key, Value
panel_36 = Panel(deserialize_keys_and_values_8.Key)
list_item_2 = ListItem(List=deserialize_keys_and_values_8.Value, Index=0, Wrap=True)  # -> flatten(Item), flatten(Item1)
panel_37 = Panel(deserialize_keys_and_values_8.Value)
deserialize_json_3 = DeserializeJson(JSON=deserialize_keys_and_values_9.Value, OutputsLocked=False)  # -> Msg, Username
panel_38 = Panel(list_item_2.Item1)
panel_39 = Panel(list_item_2.Item)
list_length_2 = ListLength(List=list_item_2.Item)
series = Series(Start=0, Step=Slider(3, range=0..10), Count=list_length_2)
panel_40 = Panel(deserialize_json_3.Msg)
concatenate_5 = Concatenate(Fragment_A=panel_38, Fragment_B="  :  ", A=panel_39)
construct_point = ConstructPoint(XCoordinate=0, YCoordinate=series, ZCoordinate=0)
text_tag_3d_2 = TextTag3D(
    Location=construct_point,
    Text=flatten(concatenate_5),
    Size=1,
    Colour=ColourSwatch(SwatchColor=RGB(207, 36, 255)),
    Justification=7)

layer_name = Text("dan")
member_index_3 = MemberIndex(Set=deserialize_keys_and_values_2.Key, Member=layer_name)  # -> Index, Count
custom_preview = CustomPreview(Material=ColourSwatch(SwatchColor=RGB(255, 254, 254)))

# ---- group: converts 0s to 'false' and everything else to 'true'
boolean = Boolean(member_index_3.Count)

# ----
panel_41 = Panel(boolean)
stream_gate = StreamGate(Stream="(imagine this was geometry, instead of a panel!)", Gate=boolean)  # -> Target0, Target1
panel_42 = Panel(stream_gate.Target0)
panel_43 = Panel(stream_gate.Target1)

layer_name_2 = Text("trees")
member_index_4 = MemberIndex(Set=deserialize_keys_and_values_2.Key, Member=layer_name_2)  # -> Index, Count
custom_preview_2 = CustomPreview(Material=ColourSwatch(SwatchColor=RGB(255, 254, 254)))

# ---- group: converts 0s to 'false' and everything else to 'true'
boolean_2 = Boolean(member_index_4.Count)

# ----
panel_44 = Panel(boolean_2)
stream_gate_2 = StreamGate(Stream="(imagine this was geometry, instead of a panel!)", Gate=boolean_2)  # -> Target0, Target1
panel_45 = Panel(stream_gate_2.Target0)
panel_46 = Panel(stream_gate_2.Target1)
