# Grasshopper definition HungarianAlgorithm.ghx (Grasshopper 0.9.76)
# plug-ins: MeshEdit Components, Owl.Accord.GH, Owl.GH

# 170817 @dantaeyoung https://github.com/dantaeyoung/GrasshopperArsenal
# 
# Hungarian Algorithm T-SNE-> Grid assignment
# Using Hungarian algorithm by Ivan Jurin (https://github.com/antifriz/hungarian-algorithm-n3)
# Using the T-SNE component from Owl, by Mateusz Zwierzycki (http://www.grasshopper3d.com/group/owl)
pt = ConstructPoint(XCoordinate=0, YCoordinate=0, ZCoordinate=0)

# ----
# Geometry Creation
number_slider = Slider(10, range=0..10)
sqgrid = Square(Plane=pt, Size=Slider(33, range=0..100), ExtentX=number_slider, ExtentY=number_slider)  # -> Cells, flatten(Points)

# ---- group: Random Mesh
cluster = Cluster(geo_2=sqgrid.Cells, geo=sqgrid.Points)

# ----
geo = Geometry(cluster)
medges = MeshEdges(Mesh=geo)  # -> NakedEdges, InteriorEdges, NonManifoldEdges

preview = CustomPreview(
    Geometry=[medges.NonManifoldEdges, medges.InteriorEdges, medges.NakedEdges, geo],
    Shader=ColourSwatch(SwatchColor=RGB(255, 255, 255)))

# ----
# Tensor calculation / preparation
geo_2 = Geometry(geo)
demesh = DeconstructMesh(Mesh=geo_2)  # -> Vertices, Faces, Colours, Normals
faceb = FaceBoundaries(Mesh=geo_2)
sfit = SphereFit(Points=demesh.Vertices)  # -> Center, Radius, Sphere
area = Area(Geometry=faceb)  # -> Area, Centroid
volume = MeshVolume(Mesh=sfit.Sphere)  # -> Volume, Centroid
trim = TrimTree(Tree=area.Area, Depth=1)
volume_2 = MeshVolume(Mesh=geo_2)  # -> Volume, Centroid
area_2 = MeshArea(Mesh=geo_2)  # -> Area, Centroid
avr = Average(Input=trim)
standarddeviation = StandardDeviation(data=trim)
division = Division(A=volume.Volume, B=volume_2.Volume)
data = Data(simplify(area_2.Area))
data_2 = Data(simplify(volume_2.Volume))
data_3 = Data(simplify(volume.Volume))
data_4 = Data(simplify(division))
data_5 = Data(simplify(avr))
data_6 = Data(simplify(standarddeviation))
merge = Merge(Data1=data, Data2=data_2, Data3=data_3, Data4=data_4, Data5=data_5, Data6=data_6)

datatree_to_tensorset = DataTreeToTensorSet(DataTree=merge)  # "DT->TS"

# ----
# TSNE
number_slider_2 = Slider(2, range=0..3)
dam = DataDam(DataA=Slider(3.8, range=0..10), BufferDelay=2500000, BufferMode=0)
t_sne = TSNEEx(Data=datatree_to_tensorset, Perplexity=dam, Theta=0.5, Outputs=number_slider_2, Seed=123)
tensorset_to_datatree = TensorSetToDataTree(TensorSet=t_sne)  # "TS->DT"

data_7 = Data(tensorset_to_datatree)
geo_3 = Geometry(flatten(geo))
# TSNE visualization
geo_4 = Geometry(flatten(sqgrid.Points))
item = ListItem(List=data_7, Index=0, Wrap=True)  # -> flatten(Item), flatten(Item1)
number_slider_3 = Slider(450, range=0..1000)
pt_2 = ConstructPoint(XCoordinate=item.Item, YCoordinate=item.Item1, ZCoordinate=0)
avr_2 = Average(Input=flatten(geo_4))
avr_3 = Average(Input=flatten(pt_2))
X = UnitX(Factor=number_slider_3)
data_8 = Data(item.Item)
data_9 = Data(item.Item1)
move = Move(Geometry=avr_2, Motion=X)  # -> Geometry, Transform
bnd = Bounds(Numbers=flatten(data_8))
bnd_2 = Bounds(Numbers=flatten(data_9))
vec2pt = Vector2Pt(PointA=avr_3, PointB=move.Geometry, Unitize=False)  # -> Vector, Length
remap = RemapNumbers(Value=data_8, Source=bnd, Target=Domain(0, 1))  # -> Mapped, Clipped
remap_2 = RemapNumbers(Value=data_9, Source=bnd_2, Target=Domain(0.2, 1))  # -> Mapped, Clipped
move_2 = Move(Geometry=pt_2, Motion=vec2pt.Vector)  # -> Geometry, Transform
scale = Scale(Geometry=move_2.Geometry, Center=move.Geometry, Factor=Slider(3.8, range=0..10))  # -> Geometry, Transform
hsl = ColourHSL(Alpha=1, Hue=remap.Mapped, Saturation=Slider(0.702, range=0..1), Luminance=remap_2.Mapped)
orient = Orient(Geometry=geo_3, Source=geo_4, Target=scale.Geometry)  # -> Geometry, Transform
geo_5 = Geometry(orient.Geometry)
pt_3 = Point(scale.Geometry)
col = Colour(hsl)

geo_6 = Geometry(orient.Geometry)

preview_2 = CustomPreview(Geometry=geo_6, Shader=hsl)

geo_7 = Geometry(flatten(geo_4))
# Hungarian Algorithm
# T-SNE-> Grid assignment
X_2 = UnitX(Factor=number_slider_3)
geo_8 = Geometry(flatten(geo_5))
col_2 = Colour(flatten(col))
geo_9 = Geometry(flatten(pt_3))
move_3 = Move(Geometry=geo_7, Motion=X_2)  # -> Geometry, Transform
hungarian_algorithm_t_sne_to_grid = HungarianAlgorithmTSNEToGrid(geo_2=geo_9, geo=move_3.Geometry)  # -> int_3, geo_6
vec2pt_2 = Vector2Pt(PointA=geo_9, PointB=hungarian_algorithm_t_sne_to_grid.geo_6, Unitize=False)  # -> Vector, Length
preview_3 = CustomPreview(
    Geometry=hungarian_algorithm_t_sne_to_grid.geo_6,
    Shader={ambient=RGB(0, 0, 0), diffuse=RGB(255, 105, 180), emission=RGB(76, 32, 54), shine=0.5, specular=RGB(255, 255, 255), transparency=0})
vdisex = VectorDisplayEx(Point=geo_9, Vector=vec2pt_2.Vector, Colour=col_2, Width=Slider(2, range=0..10))

# ----
# Grid visualization
geo_10 = Geometry(hungarian_algorithm_t_sne_to_grid.geo_6)
col_3 = Colour(flatten(col_2))
geo_11 = Geometry(flatten(geo_8))
geo_12 = Geometry(flatten(geo_9))
orient_2 = Orient(Geometry=geo_11, Source=geo_12, Target=geo_10)  # -> Geometry, Transform
X_3 = UnitX(Factor=number_slider_3)
move_4 = Move(Geometry=orient_2.Geometry, Motion=X_3)  # -> Geometry, Transform
geo_13 = Geometry(simplify(graft(move_4.Geometry)))
medges_2 = MeshEdges(Mesh=geo_13)  # -> simplify(NakedEdges), simplify(InteriorEdges), simplify(NonManifoldEdges)
preview_4 = CustomPreview(Geometry=[geo_13, medges_2.NakedEdges, medges_2.InteriorEdges, medges_2.NonManifoldEdges], Shader=graft(col_3))

# ==== cluster Cluster
geo = ClusterInput()
geo_2 = ClusterInput()
geo_3 = Geometry(geo_2)
geo_4 = Geometry(geo)
number_slider = Slider(19.612, range=0..20)
lng = ListLength(List=geo_4)
preview = CustomPreview(
    Geometry=geo_3,
    Shader={ambient=RGB(0, 0, 0), diffuse=RGB(255, 105, 180), emission=RGB(76, 32, 54), shine=0.5, specular=RGB(255, 255, 255), transparency=0})
series = Series(Start=0, Step=1, Count=lng)  # -> flatten(Series)
dom = ConstructDomain(DomainStart=Slider(4, range=0..10), DomainEnd=number_slider)
random = Random(Range=dom, Number=lng, Seed=number_slider)  # -> flatten(Random)
wbicosahedron = WeaverbirdsMeshMeshIcosahedron(Plane=flatten(geo_4), Radius=random)  # -> graft(OutMesh)
demesh = DeconstructMesh(Mesh=wbicosahedron)  # -> Vertices, Faces, Colours, Normals
dom_2 = ConstructDomain(DomainStart=Slider(0.18, range=0..1), DomainEnd=Slider(1, range=0..1))
lng_2 = ListLength(List=demesh.Vertices)  # -> simplify(Length)
random_2 = Random(Range=dom_2, Number=flatten(lng_2), Seed=series)  # -> simplify(Random)
vec2pt = Vector2Pt(PointA=graft(geo_4), PointB=demesh.Vertices, Unitize=False)  # -> Vector, Length
multiplication = Multiplication(A=random_2, B=graft(random))
panel = Panel(random_2)
line = LineSDL(Start=graft(geo_4), Direction=vec2pt.Vector, Length=multiplication)
end = EndPoints(Curve=line)  # -> Start, End
conmesh = ConstructMesh(Vertices=end.End, Faces=demesh.Faces)
M = ClusterOutput(conmesh)
medges = MeshEdges(Mesh=conmesh)  # -> NakedEdges, InteriorEdges, NonManifoldEdges
mcol = MeshColours(
    Mesh=conmesh,
    Colours=[ColourSwatch(SwatchColor=RGB(255, 206, 255)), ColourSwatch(SwatchColor=RGB(250, 0, 255)), ColourSwatch(SwatchColor=RGB(137, 38, 255)), ColourSwatch(SwatchColor=RGB(159, 212, 255))])
preview_2 = CustomPreview(
    Geometry=[medges.NakedEdges, medges.InteriorEdges, medges.NonManifoldEdges],
    Shader=ColourSwatch(SwatchColor=RGB(255, 255, 255)))

# ==== cluster HungarianAlgorithmTSNEToGrid
geo = ClusterInput()
# 170817 @dantaeyoung https://github.com/dantaeyoung/GrasshopperArsenal
# 
# Hungarian Algorithm T-SNE-> Grid assignment
# Using Hungarian algorithm by Ivan Jurin (https://github.com/antifriz/hungarian-algorithm-n3)
# Using the T-SNE component from Owl, by Mateusz Zwierzycki (http://www.grasshopper3d.com/group/owl)
geo_2 = ClusterInput()
geo_3 = Geometry(flatten(geo))
geo_4 = Geometry(flatten(geo_2))
dist = Distance(PointA=graft(geo_4), PointB=geo_3)
int = Integer(dist)
hungarianassignment = CSharpScript(costMatrix=int)  # -> out, A, xIndices; inputs costMatrix: tree of Int32
# ---------- hungarianassignment: C# ----------
    int[,] CM = new int[costMatrix.BranchCount, costMatrix.Branch(0).Count];

    for(int i = 0; i < costMatrix.BranchCount;i++)
    {
      for (int j = 0; j < costMatrix.Branch(i).Count;j++)
      {
        CM[i, j] = costMatrix.Branch(i)[j];

      }
    }
    HungarianAlgorithm HA = new HungarianAlgorithm(CM);

    xIndices = HA.Run();
# ---------- hungarianassignment: C# additional code ----------
  /*
  C# hungarian algorithm implementation
  Copyright (C) 2015  Ivan Jurin

  This program is free software; you can redistribute it and/or modify
  it under the terms of the GNU General Public License as published by
  the Free Software Foundation; either version 2 of the License, or
  (at your option) any later version.

  This program is distributed in the hope that it will be useful,
  but WITHOUT ANY WARRANTY; without even the implied warranty of
  MERCHANTABILITY or FITNESS FOR A PARTICULAR PURPOSE.  See the
  GNU General Public License for more details.

  You should have received a copy of the GNU General Public License along
  with this program; if not, write to the Free Software Foundation, Inc.,
  51 Franklin Street, Fifth Floor, Boston, MA 02110-1301 USA.
  */


  public sealed class HungarianAlgorithm
  {
    private readonly int[,] _costMatrix;
    private int _inf;
    private int _n; //number of elements
    private int[] _lx; //labels for workers
    private int[] _ly; //labels for jobs
    private bool[] _s;
    private bool[] _t;
    private int[] _matchX; //vertex matched with x
    private int[] _matchY; //vertex matched with y
    private int _maxMatch;
    private int[] _slack;
    private int[] _slackx;
    private int[] _prev; //memorizing paths

    /// <summary>
    ///
    /// </summary>
    /// <param name="costMatrix"></param>
    public HungarianAlgorithm(int[,] costMatrix)
    {
      _costMatrix = costMatrix;
    }

    /// <summary>
    ///
    /// </summary>
    /// <returns></returns>
    public int[] Run()
    {
      _n = _costMatrix.GetLength(0);

      _lx = new int[_n];
      _ly = new int[_n];
      _s = new bool[_n];
      _t = new bool[_n];
      _matchX = new int[_n];
      _matchY = new int[_n];
      _slack = new int[_n];
      _slackx = new int[_n];
      _prev = new int[_n];
      _inf = int.MaxValue;


      InitMatches();

      if (_n != _costMatrix.GetLength(1))
        return null;

      InitLbls();

      _maxMatch = 0;

      InitialMatching();

      var q = new Queue<int>();

      #region augment

      while (_maxMatch != _n)
      {
        q.Clear();

        InitSt();
        //Array.Clear(S,0,n);
        //Array.Clear(T, 0, n);


        //parameters for keeping the position of root node and two other nodes
        var root = 0;
        int x;
        var y = 0;

        //find root of the tree
        for (x = 0; x < _n; x++)
        {
          if (_matchX[x] != -1) continue;
          q.Enqueue(x);
          root = x;
          _prev[x] = -2;

          _s[x] = true;
          break;
        }

        //init slack
        for (var i = 0; i < _n; i++)
        {
          _slack[i] = _costMatrix[root, i] - _lx[root] - _ly[i];
          _slackx[i] = root;
        }

        //finding augmenting path
        while (true)
        {
          while (q.Count != 0)
          {
            x = q.Dequeue();
            var lxx = _lx[x];
            for (y = 0; y < _n; y++)
            {
              if (_costMatrix[x, y] != lxx + _ly[y] || _t[y]) continue;
              if (_matchY[y] == -1) break; //augmenting path found!
              _t[y] = true;
              q.Enqueue(_matchY[y]);

              AddToTree(_matchY[y], x);
            }
            if (y < _n) break; //augmenting path found!
          }
          if (y < _n) break; //augmenting path found!
          UpdateLabels(); //augmenting path not found, update labels

          for (y = 0; y < _n; y++)
          {
            //in this cycle we add edges that were added to the equality graph as a
            //result of improving the labeling, we add edge (slackx[y], y) to the tree if
            //and only if !T[y] &&  slack[y] == 0, also with this edge we add another one
            //(y, yx[y]) or augment the matching, if y was exposed

            if (_t[y] || _slack[y] != 0) continue;
            if (_matchY[y] == -1) //found exposed vertex-augmenting path exists
            {
              x = _slackx[y];
              break;
            }
            _t[y] = true;
            if (_s[_matchY[y]]) continue;
            q.Enqueue(_matchY[y]);
            AddToTree(_matchY[y], _slackx[y]);
          }
          if (y < _n) break;
        }

        _maxMatch++;

        //inverse edges along the augmenting path
        int ty;
        for (int cx = x, cy = y; cx != -2; cx = _prev[cx], cy = ty)
        {
          ty = _matchX[cx];
          _matchY[cy] = cx;
          _matchX[cx] = cy;
        }
      }

      #endregion

      return _matchX;
    }

    private void InitMatches()
    {
      for (var i = 0; i < _n; i++)
      {
        _matchX[i] = -1;
        _matchY[i] = -1;
      }
    }

    private void InitSt()
    {
      for (var i = 0; i < _n; i++)
      {
        _s[i] = false;
        _t[i] = false;
      }
    }

    private void InitLbls()
    {
      for (var i = 0; i < _n; i++)
      {
        var minRow = _costMatrix[i, 0];
        for (var j = 0; j < _n; j++)
        {
          if (_costMatrix[i, j] < minRow) minRow = _costMatrix[i, j];
          if (minRow == 0) break;
        }
        _lx[i] = minRow;
      }
      for (var j = 0; j < _n; j++)
      {
        var minColumn = _costMatrix[0, j] - _lx[0];
        for (var i = 0; i < _n; i++)
        {
          if (_costMatrix[i, j] - _lx[i] < minColumn) minColumn = _costMatrix[i, j] - _lx[i];
          if (minColumn == 0) break;
        }
        _ly[j] = minColumn;
      }
    }

    private void UpdateLabels()
    {
      var delta = _inf;
      for (var i = 0; i < _n; i++)
        if (!_t[i])
          if(delta > _slack[i])
            delta = _slack[i];
      for (var i = 0; i < _n; i++)
      {
        if (_s[i])
          _lx[i] = _lx[i] + delta;
        if (_t[i])
          _ly[i] = _ly[i] - delta;
        else _slack[i] = _slack[i] - delta;
      }
    }

    private void AddToTree(int x, int prevx)
    {
      //x-current vertex, prevx-vertex from x before x in the alternating path,
      //so we are adding edges (prevx, matchX[x]), (matchX[x],x)

      _s[x] = true; //adding x to S
      _prev[x] = prevx;

      var lxx = _lx[x];
      //updateing slack
      for (var y = 0; y < _n; y++)
      {
        if (_costMatrix[x, y] - lxx - _ly[y] >= _slack[y]) continue;
        _slack[y] = _costMatrix[x, y] - lxx - _ly[y];
        _slackx[y] = x;
      }
    }

    private void InitialMatching()
    {
      for (var x = 0; x < _n; x++)
      {
        for (var y = 0; y < _n; y++)
        {
          if (_costMatrix[x, y] != _lx[x] + _ly[y] || _matchY[y] != -1) continue;
          _matchX[x] = y;
          _matchY[y] = x;
          _maxMatch++;
          break;
        }
      }
    }
  }
# ---------- end hungarianassignment ----------
item = ListItem(List=flatten(geo_3), Index=hungarianassignment.xIndices, Wrap=True)
int_2 = Integer(hungarianassignment.xIndices)
geo_5 = Geometry(item)
int_3 = ClusterOutput(int_2)
geo_6 = ClusterOutput(geo_5)

# ==== cluster StandardDeviation: StandardDeviation
data = ClusterInput()
data_2 = Data(data)
avr = Average(Input=data_2)
subtraction = Subtraction(A=data_2, B=avr)
sqr = Square(Value=subtraction)
avr_2 = Average(Input=sqr)
sqrt = SquareRoot(Value=avr_2)
y = ClusterOutput(sqrt)
