# Grasshopper definition JsonReader.ghx (Grasshopper 0.9.76)
# plug-ins: Python Interpreter, gHowl

# JsonReader - reads fron a JSON file and parses it into Grasshopper format. With Citibike example.
# Dan Taeyoung (@dantaeyoung) : http://github.com/provolot/GrasshopperArsenal
panel = Panel("https://www.citibikenyc.com/stations/json")

# ---- group: This is the component that does the JSON reading.
json = PythonScript(URL=panel, Activate=Toggle(False))  # -> JSON, PathStructure, IDs, Values; inputs Activate: Boolean
# ---------- json: Python ----------
import json
import array
import urllib2
import rhinoscriptsyntax as rs
import clr
import Grasshopper
from Grasshopper.Kernel.Data import GH_Path
from Grasshopper import DataTree

def traverseJson(fragment, thispath, prevkey, toReturn):
    thistext = ""
    if(type(fragment) == dict):
        for i in xrange(len(fragment.keys())):
            thispath.append(i)
            thiskey = fragment.keys()[i]
            thistext += traverseJson(fragment[thiskey], thispath, thiskey, toReturn)
            thispath.pop()
        return thistext
    if(type(fragment) == list):
        for i in xrange(len(fragment)):
            thispath.append(i)
            thistext += traverseJson(fragment[i], thispath, prevkey, toReturn)
            thispath.pop()
        return thistext    
        
        
    if(fragment != None):
        if(toReturn == "paths"):
            return unicode(thispath) + "\n"
        if(toReturn == "ids"):
            return prevkey + "\n"
        if(toReturn == "values"):
            return unicode(fragment) + "\n"
        
    else:
        return ""
    
    
def JSONtoTREE(json):
    global PathStructure
    global IDs
    global Values
    
    IDtree = DataTree[object]()
    Valuetree = DataTree[object]()
    
    path = []
    
    PathStructure = traverseJson(json, path, "", "paths").splitlines();
    IDs = traverseJson(json, path, "", "ids").splitlines()
    Values = traverseJson(json, path, "", "values").splitlines()
    NewPathStructure = []
    for i in xrange(len(PathStructure)):
        thispath = PathStructure[i]
        thispath = map(lambda x: int(x), thispath.replace("]","").replace("[","").split(","))
        #print GH_Path(thispath
        newarray = array.array('i')
        newarray.fromlist(thispath)
        IDtree.Add(IDs[i], GH_Path(*newarray))
        Valuetree.Add(Values[i], GH_Path(*newarray))
        
    IDs = IDtree
    Values = Valuetree
    
    return str(json)
    

if(Activate == True):
    
    if URL:
        data = urllib2.urlopen(URL).read()
        data = json.loads(data)
        JSON = JSONtoTREE(data)
        
    else:
        if Path:
            
            file = open(Path)
            data = json.load(file)
            JSON = JSONtoTREE(data)
            
        else:
            if Text:
                data = json.loads(Text)
                JSON = JSONtoTREE(data)
# ---------- end json ----------

# ---- group: Citibike example / lat-long to xyz coordinates
geometry = Geometry(<point referenced from the Rhino model>)
geometry_2 = Geometry(<point referenced from the Rhino model>)

# ---- group: Citibike example
trim_tree = TrimTree(Tree=json.IDs, Depth=1)
trim_tree_2 = TrimTree(Tree=json.Values, Depth=1)

# ----
panel_2 = Panel(trim_tree)
panel_3 = Panel(trim_tree_2)

# ---- group: Citibike example
list_item = ListItem(List=trim_tree_2, Index="11", Wrap=True)
list_item_2 = ListItem(List=trim_tree, Index="11", Wrap=True)
panel_4 = Panel(list_item_2)
panel_5 = Panel(list_item)

list_item_3 = ListItem(List=trim_tree, Index="13", Wrap=True)
list_item_4 = ListItem(List=trim_tree_2, Index="13", Wrap=True)
panel_6 = Panel(list_item_3)
panel_7 = Panel(list_item_4)

list_item_5 = ListItem(List=trim_tree, Index="3", Wrap=True)
list_item_6 = ListItem(List=trim_tree_2, Index="3", Wrap=True)
panel_8 = Panel(list_item_5)
panel_9 = Panel(list_item_6)

list_item_7 = ListItem(List=trim_tree, Index="4", Wrap=True)
list_item_8 = ListItem(List=trim_tree_2, Index="4", Wrap=True)
panel_10 = Panel(list_item_7)
panel_11 = Panel(list_item_8)

longitude = Data(list_item_6)
latitude = Data(list_item_8)
availablebikes = Integer(flatten(list_item))
availabledocks = Integer(flatten(list_item_4))

# ---- group: Citibike example / lat-long to xyz coordinates
bounds = Bounds(Numbers=flatten(longitude))
bounds_2 = Bounds(Numbers=flatten(latitude))
construct_point = ConstructPoint(XCoordinate=longitude, YCoordinate=latitude, ZCoordinate=0)  # -> flatten(Point)
deconstruct_domain = DeconstructDomain(Domain=bounds)  # -> Start, End
deconstruct_domain_2 = DeconstructDomain(Domain=bounds_2)  # -> Start, End
construct_point_2 = ConstructPoint(XCoordinate=deconstruct_domain.Start, YCoordinate=deconstruct_domain_2.Start, ZCoordinate=0)
construct_point_3 = ConstructPoint(XCoordinate=deconstruct_domain.End, YCoordinate=deconstruct_domain_2.End, ZCoordinate=0)
rectangle_2pt = Rectangle2Pt(Plane=PlaneXY(0, 0, 0), PointA=geometry_2, PointB=geometry, Radius=0)  # -> Rectangle, Length
geometry_3 = Geometry(rectangle_2pt.Rectangle)
custom_preview = CustomPreview(
    Geometry=geometry_3,
    Shader={ambient=RGB(0, 0, 0), diffuse=RGB(255, 105, 180), emission=RGB(76, 32, 54), shine=0.5, specular=RGB(255, 255, 255), transparency=0})
geo_to_xyz = GeoToXYZ(
    Geo_IN=construct_point,
    Pt1ReferenceXYZ=geometry_2,
    Pt2ReferenceXYZ=geometry,
    Pt1ReferenceGeo=construct_point_2,
    Pt2ReferenceGeo=construct_point_3)

# ---- group: Citibike example (continued)
geometry_4 = Geometry(geo_to_xyz)

# ---- group: Citibike example / available bikes and docks data to cones
multiplication = Multiplication(A=availablebikes, B=Slider(2, range=0..3))
multiplication_2 = Multiplication(A=availabledocks, B=Slider(2, range=0..3))
number_slider = Slider(1.5, range=0..10)
negative = Negative(Value=multiplication_2)
cone = Cone(Base=geometry_4, Radius=number_slider, Length=multiplication)  # -> Cone, Tip
cone_2 = Cone(Base=geometry_4, Radius=number_slider, Length=negative)  # -> Cone, Tip
custom_preview_2 = CustomPreview(Geometry=cone.Cone, Shader=ColourSwatch(SwatchColor=RGB(115, 145, 255)))
custom_preview_3 = CustomPreview(Geometry=cone_2.Cone, Shader=ColourSwatch(SwatchColor=RGB(255, 115, 239)))
