# Grasshopper definition KeyboardAndMouseTools.gh (Grasshopper 1.0.7)
# plug-ins: InteracTool, Human

boolean_toggle = BooleanToggle(False)
trigger = Trigger(Interval=50, TimerInterval=50, Target=[ghpython_mouse_movement, timerlocker])  # disabled
# Other Inputs - Keyboard and Mouse
# Dan Taeyoung (@dantaeyoung) : http://github.com/provolot/GrasshopperArsenal
libraries_this_script_uses = Panel("""Human
InteracTool""")
timerlocker = CreateSnippet(EnableTimers=boolean_toggle)  # inputs EnableTimers: Boolean
# ---------- timerlocker: C# ----------
foreach(IGH_DocumentObject obj in GrasshopperDocument.Objects) { //for all objs in GH doc
      
      //Try to cast the object to a GH_Timer
      if(obj is Grasshopper.Kernel.Special.GH_Timer) {
        Grasshopper.Kernel.Special.GH_Timer timer = obj as Grasshopper.Kernel.Special.GH_Timer;
        if (timer.Targets.Contains(this.Component.InstanceGuid)) {
          
          if(!EnableTimers) { timer.Locked = true; }
          else { timer.Locked = false; }
        }
      }
    }
# ---------- end timerlocker ----------
number_slider = Slider(6.92, range=0..10)
number_slider_2 = Slider(7.66, range=0..10)
# Data Dam / Stream tools
number_slider_3 = Slider(5.66, range=0..10)  # disabled
ghpython_mouse_movement = GhPythonScript(activate=boolean_toggle)  # -> out, xPos, yPos, left, right
# ---------- ghpython_mouse_movement: Python ----------
import System

if(activate):
    # Get the mouse position
    mp = System.Windows.Forms.Control.MousePosition

    mb = System.Windows.Forms.Control.MouseButtons
    
    left = str(mb) == "Left"
    right = str(mb) == "Right"
        


    # Extract the coordinates
    xPos = mp.X
    yPos = mp.Y

    print xPos,yPos
# ---------- end ghpython_mouse_movement ----------
panel = Panel("""1
22
333
Example Geometry""")
mouse = MouseEvent(Start=<missing>)  # -> Line, Point, Button, Double, SPoint; disabled
construct_point = ConstructPoint(XCoordinate=ghpython_mouse_movement.xPos, YCoordinate=ghpython_mouse_movement.yPos, ZCoordinate=0)
panel_2 = Panel(construct_point)
dam = DataDam(DataA=number_slider_2, BufferDelay=5000000, BufferMode=2)
dam_2 = DataDam(DataA=number_slider, BufferDelay=5000000, BufferMode=2)
panel_3 = Panel(number_slider_2)
panel_4 = Panel(number_slider)

# ---- group: "Stream Filter" can operate like a switch
filter = StreamFilter(Gate=Toggle(False), Stream1=panel)

# ---- group: This component is called "Data Dam"
dam_3 = DataDam(DataA=number_slider_3, BufferDelay=10000000, BufferMode=2)  # disabled

# ----
panel_5 = Panel(dam)
panel_6 = Panel(dam_2)

# ---- group: Data Dam can help slow down user input. This is helpful when making a script.
dam_4 = DataDam(DataA=construct_point, BufferDelay=5000000, BufferMode=2)

# ----
panel_7 = Panel(filter)

# ---- group: This setup can help detect "When data is changing".
equals = Equality(FirstNumber=dam, SecondNumber=number_slider_2)  # -> Equality, Inequality

equals_2 = Equality(FirstNumber=dam_2, SecondNumber=number_slider)  # -> Equality, Inequality

# ----
sph = Sphere(Base=dam_4, Radius=1)
panel_8 = Panel(dam_3)  # disabled
is_data_changing = Panel(equals.Inequality)
filter_2 = StreamFilter(Gate=equals_2.Inequality, Stream1=number_slider)
preview = CustomPreview(Geometry=sph, Material=ColourSwatch(SwatchColor=RGB(112, 108, 108)))
data_only_when_changing = Panel(filter_2)
boolean_toggle_2 = BooleanToggle(False)
panel_9 = Panel(ghpython_mouse_movement.left)
trigger_2 = Trigger(Interval=50, TimerInterval=50, Target=[ghpython_mouse_movement_2, timerlocker_2])  # disabled
timerlocker_2 = CreateSnippet(EnableTimers=boolean_toggle_2)  # inputs EnableTimers: Boolean; same code as timerlocker
ghpython_mouse_movement_2 = GhPythonScript(activate=boolean_toggle_2)  # -> out, xPos, yPos, left, right; same code as ghpython_mouse_movement
toggle = BooleanToggle(True)  # disabled
number_slider_4 = Slider(33, range=0..100)  # disabled
mouse_2 = MouseEvent(Start=<missing>)  # -> Line, Point, Button, Double, SPoint; disabled
timer = Timer(Interval=100, TimerInterval=100, Target=selobj)  # disabled
timer_2 = Timer(Interval=100, TimerInterval=100, Target=selobj_2)
bool = Boolean(ghpython_mouse_movement_2.left)

# ---- group: This selects objects that you've selected with the mouse in Rhino!
# Mouse Input
selobj = ObjectsBySelection(Reset=toggle, LiveMode=False)  # disabled

# ----
selobj_2 = ObjectsBySelection(Reset=Toggle(False), LiveMode=False)
Z = UnitZ(Factor=Slider(33, range=0..100))
Z_2 = UnitZ(Factor=number_slider_4)  # disabled

# ---- group: If we use mouse clicks to generate a "True" value, everything updates only when we click.
dam_5 = DataDam(DataA=bool, BufferDelay=2500000, BufferMode=2)

# ----
selobj_3 = ObjectsBySelection(Reset=dam_5, LiveMode=False)
swatch = ColourSwatch(SwatchColor=RGB(110, 235, 137))  # disabled
Z_3 = UnitZ(Factor=Slider(33, range=0..100))
extr = Extrude(Base=selobj_2, Direction=Z)
extr_2 = Extrude(Base=selobj, Direction=Z_2)  # disabled
panel_10 = Panel(selobj_2)
panel_11 = Panel(selobj)  # disabled
extr_3 = Extrude(Base=selobj_3, Direction=Z_3)
preview_2 = CustomPreview(Geometry=extr_2, Material=swatch)  # disabled

# ---- group: Having a Timer upstream means that everything downstream refreshes constantly.
dam_6 = DataDam(DataA=extr, BufferDelay=2500000, BufferMode=2)

# ----
# Notice how this is only updating when we click!
# Now everything downstream won't refresh constantly.
panel_12 = Panel(dam_5)
preview_3 = CustomPreview(Geometry=extr_3, Material=ColourSwatch(SwatchColor=RGB(110, 235, 137)))
dam_7 = DataDam(DataA=extr_3, BufferDelay=2500000, BufferMode=2)
preview_4 = CustomPreview(Geometry=dam_6, Material=ColourSwatch(SwatchColor=RGB(110, 235, 137)))
number_slider_5 = Slider(1, range=0..4)  # disabled
# Keyboard Input
number_slider_6 = Slider(1, range=0..4)  # disabled
panel_13 = Panel("""a
b
c
d
e
f""")  # disabled
keyboard = KeyBoardEvent(Start=number_slider_5, Keys=panel_13)  # -> Current, Pressed, Toggled; disabled
keyboard_2 = KeyBoardEvent(Start=number_slider_6)  # -> Current, Pressed, Toggled; disabled
panel_14 = Panel(keyboard_2.Current)  # disabled
panel_15 = Panel(keyboard.Pressed)  # disabled
panel_16 = Panel(keyboard.Toggled)  # disabled
panel_17 = Panel(keyboard.Current)  # disabled
dispatch = Dispatch(List=panel_13, DispatchPattern=panel_15)  # -> ListA, ListB; disabled
dispatch_2 = Dispatch(List=panel_13, DispatchPattern=panel_16)  # -> ListA, ListB; disabled
panel_18 = Panel(dispatch.ListA)  # disabled
panel_19 = Panel(dispatch_2.ListA)  # disabled
panel_20 = Panel("2")  # disabled
panel_21 = Panel("2")  # disabled
mouse_3 = MouseEvent(Start=panel_20)  # -> Line, Point, Button, Double, SPoint; disabled
# Object Attributes
mouse_4 = MouseEvent(Start=panel_21)  # -> Line, Point, Button, Double, SPoint; disabled
# We can display all of the geometry names
pipeline = GeometryPipeline(
    GroupByLayer=False,
    GroupByType=False,
    IncludeHidden=True,
    IncludeLocked=True,
    LayerFilter="*",
    NameFilter="*",
    SublayerFiltering=True,
    TypeFilter=4)  # disabled
panel_22 = Panel("HELLO123")  # disabled
bool_2 = Boolean(mouse_3.Point)  # disabled
bool_3 = Boolean(mouse_4.Point)  # disabled
# These two components help you set
# the 'name' of a referenced Rhino object.
# This is one way to store user input
# from a keyboard into a Rhino object.
createatts = CreateAttributes(Name=panel_22, enableFullPath=False)  # disabled
dam_8 = DataDam(DataA=bool_2, BufferDelay=2500000, BufferMode=2)  # disabled
dam_9 = DataDam(DataA=bool_3, BufferDelay=2500000, BufferMode=2)  # disabled

# ---- group: "PointOnCurve" helps us quickly get the midpoint of lines
curvepoint = PointOnCurve(pipeline, parameter=0.5)  # disabled

# ----
objatts = ObjectAttributes(ObjectOrAttributes=pipeline)  # -> Name, LayerName, LayerFullPath, Color, MaterialName, LinetypeName, GroupIndices, PlotWeight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; disabled
# This component helps you retrieve attributes
# from a referenced Rhino object.
selobj_4 = ObjectsBySelection(Reset=dam_8, LiveMode=False)  # disabled
selobj_5 = ObjectsBySelection(Reset=dam_9, LiveMode=False)  # disabled
panel_23 = Panel(objatts.Name)  # disabled
objatts_2 = ObjectAttributes(ObjectOrAttributes=selobj_4)  # -> Name, LayerName, LayerFullPath, Color, MaterialName, LinetypeName, GroupIndices, PlotWeight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; disabled
swatch_2 = ColourSwatch(SwatchColor=RGB(255, 255, 255))  # disabled
modatts = ModifyObjectAttributes(Objects=selobj_5, Attributes=createatts)  # disabled

# ---- group: This generates 'text tags'
tag = TextTag(Location=curvepoint, Text=panel_23, Colour=swatch_2)  # disabled

# ----
panel_24 = Panel(objatts_2.Name)  # disabled
panel_25 = Panel(objatts_2.LayerName)  # disabled
pipeline_2 = GeometryPipeline(
    GroupByLayer=False,
    GroupByType=False,
    IncludeHidden=True,
    IncludeLocked=True,
    LayerFilter="*",
    NameFilter="*",
    SublayerFiltering=True,
    TypeFilter=1073741852)  # disabled
getroughmidpoint = GetRoughMidpoint(geo=pipeline_2)  # disabled
number_slider_7 = Slider(1, range=0..4)  # disabled
# This sets geometry names
panel_26 = Panel("2")  # disabled
panel_27 = Panel("""a
b
c
d
e
f""")  # disabled
# And this changes the geometry based on the name
objatts_3 = ObjectAttributes(ObjectOrAttributes=pipeline_2)  # -> Name, LayerName, LayerFullPath, Color, MaterialName, LinetypeName, GroupIndices, PlotWeight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; disabled
# WallMaker with Keyboard Control
mouse_5 = MouseEvent(Start=panel_26)  # -> Line, Point, Button, Double, SPoint; disabled
bool_4 = Boolean(mouse_5.Point)  # disabled
keyboard_3 = KeyBoardEvent(Start=number_slider_7, Keys=panel_27)  # -> Current, Pressed, Toggled; disabled
swatch_3 = ColourSwatch(SwatchColor=RGB(255, 255, 255))  # disabled
dam_10 = DataDam(DataA=bool_4, BufferDelay=2500000, BufferMode=2)  # disabled
dispatch_3 = Dispatch(List=panel_27, DispatchPattern=keyboard_3.Pressed)  # -> ListA, ListB; disabled
all_geometry_names = Data(objatts_3.Name)  # disabled
tag_2 = TextTag(Location=getroughmidpoint, Text=objatts_3.Name, Colour=swatch_3)  # disabled

# ---- group: This component will find all the currently selected geometry.
selobj_6 = ObjectsBySelection(Reset=dam_10, LiveMode=False)  # disabled

# ----
all_geometry = Geometry(pipeline_2)  # disabled

# ---- group: Is the first item null? or: do we have no input?
item = ListItem(List=dispatch_3.ListA, Index=0, Wrap=True)  # disabled
null = NullItem(Item=item)  # -> NullFlags, InvalidFlags, Description; disabled

# ----
createatts_2 = CreateAttributes(Name=dispatch_3.ListA, enableFullPath=False)  # disabled
geo = Geometry(selobj_6)  # disabled
all_geometry_names_2 = Data(all_geometry_names)  # disabled
panel_28 = Panel(null.NullFlags)  # disabled
panel_29 = Panel("c")  # disabled
all_geometry_names_3 = Data(all_geometry_names)  # disabled

# ---- group: Only pass data on if we've just pressed a key
filter_3 = StreamFilter(Gate=null.NullFlags, Stream0=createatts_2)  # disabled

# ----
# This creates geometry for objects with name "c"
all_geometry_2 = Geometry(all_geometry)  # disabled
panel_30 = Panel("a")  # disabled
all_geometry_names_4 = Data(all_geometry_names)  # disabled
# This creates geometry for objects with name "a"
all_geometry_3 = Geometry(all_geometry)  # disabled
panel_31 = Panel("b")  # disabled
# This creates geometry for objects with name "b"
all_geometry_4 = Geometry(all_geometry)  # disabled
tmatch = MatchText(Text=all_geometry_names_2, Pattern=panel_29, Case=True)  # disabled
number_slider_8 = Slider(8, range=0..10)  # disabled
modatts_2 = ModifyObjectAttributes(Objects=geo, Attributes=filter_3)  # disabled
tmatch_2 = MatchText(Text=all_geometry_names_3, Pattern=panel_30, RegEx=panel_30, Case=True)  # disabled
number_slider_9 = Slider(6, range=0..10)  # disabled
number_slider_10 = Slider(1, range=0..1)  # disabled
tmatch_3 = MatchText(Text=all_geometry_names_4, Pattern=panel_31, Case=True)  # disabled
dispatch_4 = Dispatch(List=all_geometry_2, DispatchPattern=tmatch)  # -> ListA, ListB; disabled
number_slider_11 = Slider(20, range=0..30)  # disabled
number_slider_12 = Slider(20, range=0..30)  # disabled
dispatch_5 = Dispatch(List=all_geometry_3, DispatchPattern=tmatch_2)  # -> ListA, ListB; disabled
divlength = DivideLength(Curve=dispatch_4.ListA, Length=number_slider_8)  # -> Points, Tangents, Parameters; disabled
dispatch_6 = Dispatch(List=all_geometry_4, DispatchPattern=tmatch_3)  # -> ListA, ListB; disabled
Z_4 = UnitZ(Factor=number_slider_9)  # disabled
polygon = Polygon(Plane=divlength.Points, Radius=number_slider_10, Segments=6, FilletRadius=0)  # -> Polygon, Length; disabled
Z_5 = UnitZ(Factor=number_slider_11)  # disabled
Z_6 = UnitZ(Factor=number_slider_12)  # disabled
extr_4 = Extrude(Base=dispatch_5.ListA, Direction=Z_4)  # disabled
swatch_4 = ColourSwatch(SwatchColor=RGB(115, 240, 231))  # disabled
extr_5 = Extrude(Base=dispatch_6.ListA, Direction=Z_5)  # disabled
swatch_5 = ColourSwatch(SwatchColor=RGB(130, 122, 207))  # disabled
extr_6 = Extrude(Base=polygon.Polygon, Direction=Z_6)  # disabled
swatch_6 = ColourSwatch(SwatchColor=RGB(114, 93, 145))  # disabled
preview_5 = CustomPreview(Geometry=extr_4, Material=swatch_4)  # disabled
preview_6 = CustomPreview(Geometry=extr_5, Material=swatch_5)  # disabled
cap = CapHoles(Brep=extr_6)  # disabled
preview_7 = CustomPreview(Geometry=cap, Material=swatch_6)  # disabled

# ==== cluster GetRoughMidpoint
geo = ClusterInput()
number_slider = Slider(0.5, range=0..1)
geo_2 = Geometry(geo)
crv = Curve(geo_2)
bbox = BoundingBox(Content=geo_2, Plane=PlaneXY(0, 0, 0))  # -> Box, Box_2
srf = Surface(geo_2)
pt = ConstructPoint(XCoordinate=number_slider, YCoordinate=number_slider, ZCoordinate=0)
curvepoint = PointOnCurve(crv, parameter=0.5)
volume = Volume(Geometry=bbox.Box)  # -> Volume, Centroid
evalsrf = EvaluateSurface(Surface=reparameterize(srf), Point=pt)  # -> Point, Normal, UDirection, VDirection, Frame
combine = CombineData(Input0=evalsrf.Point, Input1=curvepoint, Input2=volume.Centroid)  # -> Result, Index
roughmidpt = Point(combine.Result)
roughmidpt_2 = ClusterOutput(roughmidpt)
