# Grasshopper definition LispHopper.ghx (Grasshopper 0.9.76)
# plug-ins: Python Interpreter, Human, GH_CPython

# LispHopper?
# Hy-gh (pronounced 'hygge')?
# 
# 170821  @dantaeyoung https://github.com/dantaeyoung/GrasshopperArsenal
# Using Hy (https://github.com/hylang/hy)
path = FilePath("C:\Users\provolot\Desktop\hytest.hy")
panel = Panel(path)
panel_2 = Panel("""(import [rhinoscriptsyntax :as rs])
(import [ghpythonlib.components :as ghcomp])
(import Rhino)
(require [hy.extra.anaphoric [*]])

(setv result_ [])

(print "hey hey!")

(print (+ 3 4 5))

(print (range 5))

(print (reduce (fn [a b] (+ a b)) (range 10)))

(print (reduce (xi + x1 x2) (range 10)))

(defn adder [n]
  (fn [x] (+ n x)))

(defn addthree [x]
  (adder 3))

(setv threeadder (addthree 3))

(print (threeadder 3))

(print (map threeadder (range 5)))

(->
  (list-comp
    (+ (str val) (str lim))
    (lim (range 5)
      val (range lim)))
  (print))

(defn flatt [list_of_lists]
  (import collections)
  (if (isinstance list_of_lists list)
    (list-comp
      val
      (sublist list_of_lists
        val sublist))
    list_of_lists))


(result_.append (rs.AddPoint 0 0 0))

(result_.append (rs.AddCircle (rs.AddPoint 0 0 2) 5))

(->
  (rs.AddPoint 0 0 4)
  (rs.AddCircle 5)
  (result_.append))

(ap-pipe
  (rs.AddPoint 0 0 6)
  (rs.AddCircle it 5)
  (result_.append it))


(defn moreCircles [circ n]
  (ap-pipe
    (rs.DivideCurve circ n)
    (map (xi rs.AddCircle x1 5) it)
    it))

(ap-pipe
  (rs.AddPoint 0 0 0)
  (rs.AddCircle it 5)
  (moreCircles it 5)
  (map (xi moreCircles x1 5) it)
  (flatt it)
  (map (xi moreCircles x1 5) it)
  (result_.append it))


(def ra result_.append)

(print (rs.AddPoint 0 50 0))

(defn makeBranch [b deg scl]
  (setv csp (rs.CurveStartPoint b))
  (setv cep (rs.CurveEndPoint b))
  (setv v (rs.VectorCreate cep csp))
  (setv yaxis (. (rs.WorldXYPlane) YAxis))
  (ap-pipe
    (rs.CopyObject b v)
    (rs.ScaleObject it cep [scl scl scl])
    (rs.RotateObject it cep deg yaxis)))

(defn makeTree [branch level]
  (if (= 0 level)
    branch
    [branch
      (makeTree (makeBranch branch -20 0.8) (- level 1))
      (makeTree (makeBranch branch 40 0.7) (- level 1))]))

(setv p1 (rs.AddPoint 0 0 0))
(setv p2 (rs.AddPoint 0 0 10))
(setv cc (rs.AddCurve [p1 p2]))

(ra
  (makeTree cc 9))

(print "hello world!")""")
file = ReadFile(F=panel, PerLineParse=True)  # -> C
#   port F: Uri of file to read
# ---------- file: VB line parser ----------
    action = GH_LineParserAction.Include
    Return line

    'Parse the line and return some data that represents the line.
    'If the line cannot be parsed, you can return Nothing and
    'assign a different action.
    'The default implementation is to just return the line itself.
    'If you return types that implement IGH_Goo, this component
    'will work substantially faster.
# ---------- end file ----------
# Hy -> Python from text
python = PythonScript(rawHyCode=panel_2)  # -> hyCode; inputs rawHyCode: list
# ---------- python: Python ----------
import re
def notcomments(line):
    print ">",
    print line
    if line == "   ":
        print "ho"
        return False
    return False if re.match(r";", line) else True
    
if type(_rawHyCode) != list:
    print "x"
if len(_rawHyCode) <= 1:
    _rawHyCode = _rawHyCode[0].split("\n")
    print "k"
print _rawHyCode

hyCode_ = "\"\"\"" + "\n".join(filter(notcomments, _rawHyCode)) + "\"\"\""
# ---------- end python ----------
# Hy -> Python from file
gh_cpython = GH_CPython(hyPath=panel)  # -> pycode; inputs hyPath: list, hyCode: list, updateTrigger: list
# ---------- gh_cpython: Python ----------
# -*- coding: utf-8 -*-

from hy.cmdline import pretty_error
from hy.importer import (import_file_to_ast, import_buffer_to_ast)
import astor.codegen

module_name = "<STDIN>"

def file_to_pycode(filename):
    _ast = pretty_error(import_file_to_ast, filename, module_name)
    pycode = astor.codegen.to_source(_ast)
    return pycode

def text_to_pycode(stdin_text):
    _ast = pretty_error(import_buffer_to_ast, stdin_text, module_name)
    pycode = astor.codegen.to_source(_ast)
    return pycode

####


if _hyPath:
    pycode_ = file_to_pycode(_hyPath)
else:
    pycode_ = text_to_pycode(_hyCode)
# ---------- end gh_cpython ----------
gh_cpython_2 = GH_CPython(hyCode=python)  # -> out, pycode; inputs hyPath: list, hyCode: list, updateTrigger: list
# ---------- gh_cpython_2: Python ----------
# -*- coding: utf-8 -*-

from hy.cmdline import pretty_error
from hy.importer import (import_file_to_ast, import_buffer_to_ast)
import astor.codegen

module_name = "<STDIN>"

def clean_of_hy(pycode):
    import re

    def not_matches_hylib(line):
        return False if re.match(r"from hy", line) else True

    return "\n".join(filter(not_matches_hylib, pycode.split("\n")))
    

def file_to_pycode(filename):
    _ast = pretty_error(import_file_to_ast, filename, module_name)
    pycode = astor.codegen.to_source(_ast)
    return pycode
    return clean_of_hy(pycode)
    
def text_to_pycode(stdin_text):
    _ast = pretty_error(import_buffer_to_ast, stdin_text, module_name)
    pycode = astor.codegen.to_source(_ast)
    return pycode
    return clean_of_hy(pycode)
    

####


if _hyPath:
    pycode_ = file_to_pycode(_hyPath)
else:
    pycode_ = text_to_pycode(_hyCode)
# ---------- end gh_cpython_2 ----------
panel_3 = Panel(gh_cpython)  # disabled
# Add library import and GH Data tree output
panel_4 = Panel("""def list_to_tree(input, none_and_holes=False, base_path=[0]):
    \"\"\"Transforms nestings of lists or tuples to a Grasshopper DataTree\"\"\"
    from Grasshopper import DataTree as Tree
    from Grasshopper.Kernel.Data import GH_Path as Path
    from System import Array
    def process_one_item(input,tree,track):
        path = Path(Array[int](track))
        if len(input) == 0 and none_and_holes: tree.EnsurePath(path); return
        for i,item in enumerate(input):
            if hasattr(item, '__iter__'): #if list or tuple
                track.append(i); process_one_item(item,tree,track); track.pop()
            else:
                if none_and_holes: tree.Insert(item,path,i)
                elif item is not None: tree.Add(item,path)
    tree = Tree[object]()
    if input is not None: process_one_item(input,tree,base_path[:]); return tree
    

result_ = list_to_tree(result_)""")
panel_5 = Panel("""## MAKE LIBRARIES IMPORTABLE ##
import sys, os
libraryPath = os.path.dirname(sys.path[0]) + "\_LIBRARIES"
if not libraryPath in sys.path:
    sys.path.append(libraryPath)
################################""")
# Execute Hy->Python code in IronPython
concat = Concatenate(FragmentC=panel_5, FragmentA=gh_cpython_2.pycode, FragmentB=panel_4)
python_2 = PythonScript(Code=concat)  # -> Out, Result_
data = Data(python_2.Result_)

# ---- group: Word wrap screen output
md_slider = MDSlider(
    slider_value=Point(0.6214737056, 0.7346970395, 0.5),
    SliderMode=0,
    x_domain=Domain(-100, 100),
    y_domain=Domain(-100, 100),
    z_domain=Domain(0, 1))
wordwrap = WordWrap(T=python_2.Out, S=Slider(51, range=0..100))
texttoscreen = RenderTextToScreen(
    Text=wordwrap,
    Location=md_slider,
    Size=12,
    Color=ColourSwatch(SwatchColor=RGB(43, 44, 151)),
    Font="Courier New",
    m_scWithvp=False)

# ----
panel_6 = Panel(python_2.Out)
preview = CustomPreview(Geometry=data, Shader=ColourSwatch(SwatchColor=RGB(83, 93, 255)))

# ==== cluster WordWrap
T = ClusterInput()
join = TextJoin(Text=T)
S = ClusterInput()
chars = Characters(Text=join)  # -> Result, Unicode
chars_2 = Characters(Text=T)  # -> Result, Unicode
partition = PartitionList(List=chars_2.Result, Size=S)
join_2 = TextJoin(Text=partition)
trim = TrimTree(Tree=join_2, Depth=1)
join_3 = TextJoin(Text=trim)  # -> flatten(Result)
join_4 = TextJoin(Text=join_3)
panel = Panel(join_4)
R = ClusterOutput(join_4)
