# Grasshopper definition LispHopper_Clojure.ghx (Grasshopper 0.9.76)
# plug-ins: Python Interpreter, GH_CPython

panel = Panel("""(def x 5)
(+ 4 x)
(+ x x)""")
python = PythonScript(str=panel)  # -> quotedstr
# ---------- python: Python ----------
print map(lambda x: x.strip(), _str.split("\n"))
quotedstr_ = "\"\"\"" + _str + "\"\"\""

print quotedstr_
# ---------- end python ----------
python_2 = PythonScript()  # -> libraryPath
# ---------- python_2: Python ----------
## MAKE LIBRARIES IMPORTABLE ##
import sys, os
libraryPath = os.path.dirname(sys.path[0]) + "\_LIBRARIES"
if not libraryPath in sys.path:
    sys.path.append(libraryPath)
################################
# ---------- end python_2 ----------
panel_2 = Panel(python_2)
panel_3 = Panel(python)
gh_cpython = GH_CPython(libraryPath=python_2)  # -> comp; inputs libraryPath: list
# ---------- gh_cpython: Python ----------
# -*- coding: utf-8 -*-

## MAKE LIBRARIES IMPORTABLE ##
import sys, os
if not _libraryPath in sys.path:
    sys.path.append(_libraryPath)
################################



import clojure

from clojure.gh import initCompiler

comp_ = initCompiler()
# ---------- end gh_cpython ----------
gh_cpython_2 = GH_CPython(comp=gh_cpython, libraryPath=python_2, lines=python)  # -> output, result; inputs comp: list, libraryPath: list, lines: list
# ---------- gh_cpython_2: Python ----------
# -*- coding: utf-8 -*-

## MAKE LIBRARIES IMPORTABLE ##
import sys, os
if not _libraryPath in sys.path:
    sys.path.append(_libraryPath)
################################




if _lines:

    ## needs to be multiline
    print _lines

    import clojure

    from clojure.gh import process

    (result_, output_) = process(_lines)

    print output_

    print result_

    result_ = range(3, 8)
# ---------- end gh_cpython_2 ----------
panel_4 = Panel(gh_cpython_2.result)
