# Grasshopper definition MetaDataWriter_v0.1.ghx (Grasshopper 0.9.76)

# ---- group: Test geometry
# MetaDataWriter v0.1: Writing and reading metadata into Rhino geometry
# Dan Taeyoung (@dantaeyoung) : http://github.com/provolot/GrasshopperArsenal
number_slider = Slider(5, range=0..10)
sphere = Sphere(Base=PlaneXY(0, 0, 0), Radius=number_slider)

# ---- group: Write Metadata
panel = Panel("""GeometryName
Creator
ArbitraryKey""")
panel_2 = Panel("""FunSphere
Dan
ArbitraryValue""")
geometry = Geometry(sphere)
metadatawriter = MetaDataWriter(metadatakeys=panel, metadatavalues=panel_2, geometry=geometry, write=Toggle(True))

# ---- group: Try baking 'MetadataSphere' and referencing it from 'GeoInput'.
metadatasphere = Geometry(metadatawriter)
geoinput = Geometry(<brep referenced from the Rhino model>)

# ---- group: MetaDataReader
metadatareader = MetaDataReader(geometry=geoinput, read=Toggle(True))  # -> keys, values
panel_3 = Panel(metadatareader.keys)
panel_4 = Panel(metadatareader.values)

# ==== cluster MetaDataWriter: MetaDataWriter
metadatakeys = ClusterInput()
metadatavalues = ClusterInput()
geometry = ClusterInput()
write = ClusterInput()
metadatawriter = PythonScript(MetadataKeys=metadatakeys, MetadataValues=metadatavalues, Geometry=geometry, Write=write)  # -> out, MetadataGeometry; inputs MetadataKeys: list, MetadataValues: list, Geometry: GeometryBase
# ---------- metadatawriter: Python ----------
import os
import sys
import System.Text
bodyname = System.Text.Encoding.Default.BodyName
sys.setdefaultencoding(bodyname)

import struct, datetime, decimal, itertools
from struct import unpack
import Rhino

def addUserStrings(data, geom):
    for (k, v) in data:
        geom.SetUserString(k, v)
    return geom

if (Write):
    MetadataGeometry = addUserStrings(zip(MetadataKeys, MetadataValues), Geometry)
# ---------- end metadatawriter ----------
metadatageometry = ClusterOutput(metadatawriter.MetadataGeometry)

# ==== cluster MetaDataReader: MetaDataReader
read = ClusterInput()
geometry = ClusterInput()
key = ClusterInput()
metadatareader = PythonScript(Geometry=geometry, Key=key, Read=read)  # -> out, Keys, Values; inputs Geometry: GeometryBase
# ---------- metadatareader: Python ----------
if Geometry and Read:
    data = Geometry.GetUserStrings()
    k = []
    v = []
    if Key:
        for datakey in data: 
            if(datakey == Key):            
                k = datakey
                v = data[datakey]
    else:
        for datakey in data:   
            k.append(datakey)
            v.append(data[datakey])
    Keys = k
    Values = v
# ---------- end metadatareader ----------
values = ClusterOutput(metadatareader.Values)
keys = ClusterOutput(metadatareader.Keys)
