# Grasshopper definition PoseNet_Receiver_example.gh (Grasshopper 1.0.7)
# plug-ins: Human, gHowl

# PoseNetOSC Receiver Example
# Dan Taeyoung (@dantaeyoung) : http://github.com/provolot/GrasshopperArsenal
# First, run PoseOSC.exe (inside of PoseOSC-win32-x64.zip) !
# 
# Required Libraries - gHowl
# Optional Libraries - Human
udp_receiver = UDPReceiver(Port="9527", Pattern=999)  # -> Info, Data
data_dam = DataDam(DataA=udp_receiver.Data, BufferDelay=10000000, BufferMode=1)
arr_to_posedata = ARRToPoseData(data=data_dam)  # -> xmax_2, ymax_2, numposes_2, posescore_2, posedata_2
body_part = ValueList({"nose": 0, "leftEye": 1, "rightEye": 2, "leftEar": 3, "rightEar": 4, "leftShoulder": 5, "rightShoulder": 6, "leftElbow": 7, "rightElbow": 8, "leftWrist": 9, "rightWrist": 10, "leftHip": 11, "rightHip": 12, "leftKnee": 13, "rightKnee": 14, "leftAnkle": 15, "rightAnkle": 16}, selected="rightWrist")
body_part_2 = ValueList({"nose": 0, "leftEye": 1, "rightEye": 2, "leftEar": 3, "rightEar": 4, "leftShoulder": 5, "rightShoulder": 6, "leftElbow": 7, "rightElbow": 8, "leftWrist": 9, "rightWrist": 10, "leftHip": 11, "rightHip": 12, "leftKnee": 13, "rightKnee": 14, "leftAnkle": 15, "rightAnkle": 16}, selected="nose")
body_part_3 = ValueList({"nose": 0, "leftEye": 1, "rightEye": 2, "leftEar": 3, "rightEar": 4, "leftShoulder": 5, "rightShoulder": 6, "leftElbow": 7, "rightElbow": 8, "leftWrist": 9, "rightWrist": 10, "leftHip": 11, "rightHip": 12, "leftKnee": 13, "rightKnee": 14, "leftAnkle": 15, "rightAnkle": 16}, selected="rightEye")
pose_info = PoseInfo(tree=arr_to_posedata.posedata_2, path=body_part)  # -> pose_number_2, body_part_2, x_coordinate_2, y_coordinate_2, pose_score_2, coordinate_point_2
pose_info_2 = PoseInfo(tree=arr_to_posedata.posedata_2, path=body_part_2)  # -> pose_number_2, body_part_2, x_coordinate_2, y_coordinate_2, pose_score_2, coordinate_point_2
pose_info_3 = PoseInfo(tree=arr_to_posedata.posedata_2, path=body_part_3)  # -> pose_number_2, body_part_2, x_coordinate_2, y_coordinate_2, pose_score_2, coordinate_point_2
data_recorder = DataRecorder(pose_info_2.coordinate_point_2, DataLimit=-10, RecordData=False)
coordinate_point = Geometry(pose_info_3.coordinate_point_2)
display_pose = DisplayPose(showpointinfo=Toggle(True), activate=Toggle(True), _1=arr_to_posedata.posedata_2)  # -> textlocation_2, textdata_2, body_geometry_2
pose_number = Data(pose_info_3.pose_number_2)
body_part_4 = Data(pose_info_3.body_part_2)
x_coordinate = Data(pose_info_3.x_coordinate_2)
y_coordinate = Data(pose_info_3.y_coordinate_2)
pose_score = Data(pose_info_3.pose_score_2)
distance = Distance(PointA=pose_info_2.coordinate_point_2, PointB=pose_info.coordinate_point_2)
number = Number(pose_info.pose_score_2)
panel = Panel(pose_score)
panel_2 = Panel(distance)
panel_3 = Panel(number)
text_tag = TextTag(Location=display_pose.textlocation_2, Text=display_pose.textdata_2, Colour=ColourSwatch(SwatchColor=RGB(255, 237, 145)))
custom_preview = CustomPreview(Geometry=display_pose.body_geometry_2, Material=ColourSwatch(SwatchColor=RGB(255, 255, 255)))
larger_than = LargerThan(FirstNumber=number, SecondNumber=Slider(0.7, range=0..1))  # -> LargerThan, OrEqualTo
smaller_than = SmallerThan(FirstNumber=distance, SecondNumber=Slider(200, range=50..400))  # -> SmallerThan, OrEqualTo
gate_and = GateAnd(A=smaller_than.SmallerThan, B=larger_than.LargerThan)
stream_filter = StreamFilter(Gate=gate_and, Stream1="Facepalm")
screen_oriented_text = ScreenOrientedText(
    Text=stream_filter,
    Justification=7,
    Location=pose_info.coordinate_point_2,
    SizeFactor=Slider(44, range=0..100),
    Depth=0,
    Absolute=False)

# ==== cluster ARRToPoseData
data = ClusterInput()
data_2 = Data(data)
split_list = SplitList(List=data_2, Index="4")  # -> ListA, ListB
partition_list = PartitionList(List=split_list.ListB, Size="52")  # -> simplify(Chunks)
list_item = ListItem(List=split_list.ListA, Index=0, Wrap=True)  # -> Item, Item1, Item2, Item3
split_list_2 = SplitList(List=partition_list, Index="1")  # -> ListA, ListB
xmax = Data(list_item.Item1)
numposes = Data(list_item.Item3)
ymax = Data(list_item.Item2)
posescore = Data(split_list_2.ListA)
panel = Panel("""nose
leftEye
rightEye
leftEar
rightEar
leftShoulder
rightShoulder
leftElbow
rightElbow
leftWrist
rightWrist
leftHip
rightHip
leftKnee
rightKnee
leftAnkle
rightAnkle""")
xmax_2 = ClusterOutput(xmax)
ymax_2 = ClusterOutput(ymax)
numposes_2 = ClusterOutput(numposes)
posescore_2 = ClusterOutput(posescore)
partition_list_2 = PartitionList(List=split_list_2.ListB, Size="3")  # -> simplify(Chunks)
list_item_2 = ListItem(List=partition_list_2, Index=0, Wrap=True)
list_length = ListLength(List=flatten(list_item_2))
repeat_data = RepeatData(Data=panel, Length=list_length)  # -> simplify(graft(Data))
match_tree = MatchTree(Tree=repeat_data, Guide=list_item_2)
tree_statistics = TreeStatistics(Tree=match_tree)  # -> Paths, Length, Count
deconstruct_path = DeconstructPath(Branch=tree_statistics.Paths)
list_item_3 = ListItem(List=deconstruct_path, Index=0, Wrap=True)  # -> simplify(Item)
larger_than = LargerThan(FirstNumber=numposes, SecondNumber="1")  # -> LargerThan, OrEqualTo
match_tree_2 = MatchTree(Tree=list_item_3, Guide=list_item_2)
repeat_data_2 = RepeatData(Data="0", Length="17")  # -> graft(Data)
stream_filter = StreamFilter(Gate=larger_than.LargerThan, Stream0=repeat_data_2, Stream1=match_tree_2)
merge = Merge(Data1=simplify(stream_filter), Data2=simplify(match_tree), Data3=simplify(partition_list_2))
posedata = Data(merge)
posedata_2 = ClusterOutput(posedata)

# ==== cluster PoseInfo
path = ClusterInput()
tree = ClusterInput()
shift_paths = ShiftPaths(Data=tree, Offset=-1)
null_item = NullItem(Item=shift_paths)  # -> NullFlags, InvalidFlags, Description
mass_addition = MassAddition(Input=flatten(null_item.NullFlags))  # -> Result, PartialResults
tree_branch = TreeBranch(Tree=shift_paths, Path=path, MaintainPaths=True)
tree_branch_2 = TreeBranch(Tree=tree, Path=path, MaintainPaths=True)
panel = Panel(tree)
partition_list = PartitionList(List=tree_branch, Size="5")
boolean = Boolean(mass_addition.Result)
stream_filter = StreamFilter(Gate=boolean, Stream0=partition_list, Stream1=tree_branch_2)
list_item = ListItem(List=stream_filter, Index=0, Wrap=True)  # -> Item, Item1, Item2, Item3, Item4
panel_2 = Panel(partition_list)
construct_point = ConstructPoint(XCoordinate=list_item.Item2, YCoordinate=list_item.Item3, ZCoordinate=0)
pose_number = Data(list_item.Item)
body_part = Data(list_item.Item1)
x_coordinate = Data(list_item.Item2)
y_coordinate = Data(list_item.Item3)
pose_score = Data(list_item.Item4)
body_part_2 = ClusterOutput(body_part)
pose_score_2 = ClusterOutput(pose_score)
y_coordinate_2 = ClusterOutput(y_coordinate)
coordinate_point = Data(construct_point)
x_coordinate_2 = ClusterOutput(x_coordinate)
pose_number_2 = ClusterOutput(pose_number)
coordinate_point_2 = ClusterOutput(coordinate_point)

# ==== cluster DisplayPose
activate = ClusterInput()
_1 = ClusterInput()
activate_2 = Boolean(activate)
stream_filter = StreamFilter(Gate=activate_2, Stream1=_1)
list_item = ListItem(List=stream_filter, Index=0, Wrap=True)  # -> Item, Item1, Item2, Item3, Item4
maybeshiftpaths = MaybeShiftPaths(data=list_item.Item2)
maybeshiftpaths_2 = MaybeShiftPaths(data=list_item.Item3)
panel = Panel("""nose
leftEye
rightEye
leftEar
rightEar
leftShoulder
rightShoulder
leftElbow
rightElbow
leftWrist
rightWrist
leftHip
rightHip
leftKnee
rightKnee
leftAnkle
rightAnkle""")
construct_point = ConstructPoint(XCoordinate=maybeshiftpaths, YCoordinate=maybeshiftpaths_2, ZCoordinate=0)
list_length = ListLength(List=panel)
showpointinfo = ClusterInput()
series = Series(Start=0, Step=1, Count=list_length)
panel_2 = Panel("""4
2
0
1
3""")
panel_3 = Panel("""11
12""")
showpointinfo_2 = Boolean(showpointinfo)
panel_4 = Panel("""5
7
9""")
panel_5 = Panel("""6
8
10""")
panel_6 = Panel("""5
11
13
15""")
panel_7 = Panel("""5
6""")
panel_8 = Panel("""6
12
14
16""")
panel_9 = Panel(maybeshiftpaths_2)
concatenate = Concatenate(Fragment_A=series, Fragment_B="-", A=panel)
stream_filter_2 = StreamFilter(Gate=showpointinfo_2, Stream1=construct_point)
list_item_2 = ListItem(List=construct_point, Index=panel_2, Wrap=True)
list_item_3 = ListItem(List=construct_point, Index=panel_6, Wrap=True)
list_item_4 = ListItem(List=construct_point, Index=panel_8, Wrap=True)
list_item_5 = ListItem(List=construct_point, Index=panel_4, Wrap=True)
list_item_6 = ListItem(List=construct_point, Index=panel_5, Wrap=True)
list_item_7 = ListItem(List=construct_point, Index=panel_7, Wrap=True)
list_item_8 = ListItem(List=construct_point, Index=panel_3, Wrap=True)
textlocation = Data(stream_filter_2)
textdata = Data(concatenate)
polyline = PolyLine(Vertices=list_item_2, Closed=False)
polyline_2 = PolyLine(Vertices=list_item_3, Closed=False)
polyline_3 = PolyLine(Vertices=list_item_4, Closed=False)
polyline_4 = PolyLine(Vertices=list_item_5, Closed=False)
polyline_5 = PolyLine(Vertices=list_item_6, Closed=False)
textlocation_2 = ClusterOutput(textlocation)
textdata_2 = ClusterOutput(textdata)
polyline_6 = PolyLine(Vertices=list_item_7, Closed=False)
polyline_7 = PolyLine(Vertices=list_item_8, Closed=False)
merge = Merge(
    Data1=polyline,
    Data2=polyline_2,
    Data3=polyline_3,
    Data4=polyline_7,
    Data5=polyline_6,
    Data6=polyline_4,
    Data7=polyline_5)
body_geometry = Data(merge)
body_geometry_2 = ClusterOutput(body_geometry)
panel_10 = Panel(merge)

# ==== cluster MaybeShiftPaths
data = ClusterInput()
data_2 = Data(data)
shift_paths = ShiftPaths(Data=data_2, Offset=-1)
null_item = NullItem(Item=shift_paths)  # -> NullFlags, InvalidFlags, Description
mass_addition = MassAddition(Input=null_item.NullFlags)  # -> Result, PartialResults
stream_filter = StreamFilter(Gate=mass_addition.Result, Stream0=shift_paths, Stream1=flatten(data_2))
s_1 = ClusterOutput(stream_filter)
