# Grasshopper definition PostUploader.ghx (Grasshopper 0.9.76)
# plug-ins: Firefly.Core

# 171014 @dantaeyoung https://github.com/dantaeyoung/GrasshopperArsenal
# 
# PostUploader
# (Upload file to https://imagebin.ca)
panel = Panel("https://imagebin.ca/upload.php")
c_script = CSharpScript(
    activate=Button(),
    api_url=panel,
    api_key="api_key_here",
    filename="      C:\\Users\\provolot\\Downloads\\171014\\test123.jpg")  # -> out, server_response, img_url; inputs activate: Boolean, api_url: String, api_key: String, filename: String
# ---------- c_script: C# ----------
    if(_activate) {

      System.Collections.Specialized.NameValueCollection nvc = new System.Collections.Specialized.NameValueCollection();
      nvc.Add("key", _api_key);

      string s_r = HttpUploadFile(_api_url, _filename, "file", "image/jpeg", nvc);
      server_response = s_r;
      img_url = s_r.Split(new string[] { "url:" }, StringSplitOptions.None)[1];
    }
# ---------- c_script: C# additional code ----------
  public static string HttpUploadFile(string url, string file, string paramName, string contentType, System.Collections.Specialized.NameValueCollection nvc) {
    //Print(string.Format("Uploading {0} to {1}", file, url));
    string boundary = "---------------------------" + DateTime.Now.Ticks.ToString("x");
    byte[] boundarybytes = System.Text.Encoding.ASCII.GetBytes("\r\n--" + boundary + "\r\n");

    System.Net.HttpWebRequest wr = (System.Net.HttpWebRequest) System.Net.WebRequest.Create(url);
    wr.ContentType = "multipart/form-data; boundary=" + boundary;
    wr.Method = "POST";
    wr.KeepAlive = true;
    wr.Credentials = System.Net.CredentialCache.DefaultCredentials;

    Stream rs = wr.GetRequestStream();

    string formdataTemplate = "Content-Disposition: form-data; name=\"{0}\"\r\n\r\n{1}";
    foreach (string key in nvc.Keys)
    {
      rs.Write(boundarybytes, 0, boundarybytes.Length);
      string formitem = string.Format(formdataTemplate, key, nvc[key]);
      byte[] formitembytes = System.Text.Encoding.UTF8.GetBytes(formitem);
      rs.Write(formitembytes, 0, formitembytes.Length);
    }
    rs.Write(boundarybytes, 0, boundarybytes.Length);

    string headerTemplate = "Content-Disposition: form-data; name=\"{0}\"; filename=\"{1}\"\r\nContent-Type: {2}\r\n\r\n";
    string header = string.Format(headerTemplate, paramName, file, contentType);
    byte[] headerbytes = System.Text.Encoding.UTF8.GetBytes(header);
    rs.Write(headerbytes, 0, headerbytes.Length);

    FileStream fileStream = new FileStream(file, FileMode.Open, FileAccess.Read);
    byte[] buffer = new byte[4096];
    int bytesRead = 0;
    while ((bytesRead = fileStream.Read(buffer, 0, buffer.Length)) != 0) {
      rs.Write(buffer, 0, bytesRead);
    }
    fileStream.Close();

    byte[] trailer = System.Text.Encoding.ASCII.GetBytes("\r\n--" + boundary + "--\r\n");
    rs.Write(trailer, 0, trailer.Length);
    rs.Close();

    System.Net.WebResponse wresp = null;
    try {
      wresp = wr.GetResponse();
      Stream stream2 = wresp.GetResponseStream();
      StreamReader reader2 = new StreamReader(stream2);
      //Print(string.Format("File uploaded, server response is: {0}", reader2.ReadToEnd()));

      string servresp = reader2.ReadToEnd();
      return servresp;
      //System.Windows.Forms.MessageBox.Show(string.Format("File uploaded, server response is: {0}", servresp));

    } catch(Exception ex) {
      //log.Error("Error uploading file", ex);

      if(wresp != null) {
        wresp.Close();
        wresp = null;
      }
      return "Error uploading file";

    } finally {
      wr = null;
    }
  }
# ---------- end c_script ----------

# ---- group: Only record last value when values are non/null
data = Data(c_script.img_url)
null = NullItem(Item=data)  # -> NullFlags, InvalidFlags, Description
not = GateNot(A=null.NullFlags)
log = DataLog(IncomingData=data, ResetLog=False, StartRecording=not, WrapValues=True, RecordingLength=1)

# ----
panel_2 = Panel(log)
