# Grasshopper definition Reactivision to Grasshopper.gh (Grasshopper 1.0.7)
# plug-ins: RugOscGH, jSwan

# ---- group: Turn this off and one if data seems to stop flowing
# Reactivision to Grasshopper
# https://github.com/dantaeyoung/grasshopperarsenal
# @dantaeyoung
boolean_toggle = BooleanToggle(True)

# ----
tailscale_ip_address_of_this_computer = Panel("127.0.0.1")
port = Panel("3333")
oscreceiver = OscReceiver(
    Receive=boolean_toggle,
    KeepLastData=Toggle(False),
    IPAddress=tailscale_ip_address_of_this_computer,
    Port=port,
    PacketSize=2048,
    BufferSize=600)

# ---- group: "Debounces" or stabilizes input -- gets the most recent data out of the last 10 samples / right click and change "record limit" # - the larger the number, the more stable; the smaller the number, the more responsive
data_recorder = DataRecorder(oscreceiver, DataLimit=10, RecordData=True)

# ---- group: "Debounces" or stabilizes input -- gets the most recent data out of the last 10 samples
clean_tree = CleanTree(RemoveNulls=True, RemoveInvalid=True, RemoveEmpty=False, Tree=data_recorder)
list_item = ListItem(List=clean_tree, Index=0, Wrap=True)  # -> Item1, Item
panel = Panel(list_item.Item1)

# ----
data = Data(list_item.Item1)

# ---- group: Right click to change the data flow.
data_dam = DataDam(DataDataA=data, BufferDelay=10000000, BufferMode=2)

# ----
ghpython_script = GhPythonScript(data=data_dam)  # -> out, obj
# ---------- ghpython_script: Python ----------
import re, json

tags = [{}]
visible = []

try:

    # Extract tag data
    tag_data = re.findall(r'"set", (\d+), (\d+), (\d+\.\d+f), (\d+\.\d+f), (\d+\.\d+f)', data)
    tags = [{"id": tag[1], "x": tag[2].replace("f",""), "y": tag[3].replace("f",""), "z": tag[4].replace("f","")} for tag in tag_data]

    # Create output dictionary

    visible = [t["id"] for t in tags]

except:
    print("no data!")
    
obj = json.dumps({"visible": visible, "tags": tags})


# Print output
print(obj)
# ---------- end ghpython_script ----------
deserialize_json = DeserializeJson(JSON=ghpython_script.obj, OutputsLocked=True)  # -> graft(Tags), graft(Visible)
deserialize_json_2 = DeserializeJson(JSON=deserialize_json.Tags, OutputsLocked=False)  # -> X, Y, Id, Z
check_for_tag = CheckForTag(number=deserialize_json.Visible, second_number="1")
check_for_tag_2 = CheckForTag(number=deserialize_json.Visible, second_number="0")
construct_point = ConstructPoint(XCoordinate=deserialize_json_2.Z, YCoordinate=deserialize_json_2.Y, ZCoordinate=deserialize_json_2.X)
panel_2 = Panel("! Sphere 0,0,0 5 _Enter !")
panel_3 = Panel(check_for_tag)
text_tag_3d = TextTag3D(Location=construct_point, Text=deserialize_json_2.Id, Size=1, Justification=7)
run_rhino_command = GhPythonScript(activate=check_for_tag, command="! _Top !")  # -> out, a; inputs activate: Boolean
# ---------- run_rhino_command: Python ----------
import rhinoscriptsyntax as rs
if(activate):
    rs.Command(command)
# ---------- end run_rhino_command ----------
run_rhino_command_2 = GhPythonScript(activate=check_for_tag_2, command="! _Perspective !")  # -> out, a; inputs activate: Boolean; same code as run_rhino_command

# ==== cluster CheckForTag
number = ClusterInput()
second_number = ClusterInput()
number_2 = Number(number)
equality = Equality(FirstNumber=number_2, SecondNumber=second_number)  # -> Equality, Inequality
mass_addition = MassAddition(Input=flatten(equality.Equality))  # -> Result, PartialResults
boolean = Boolean(mass_addition.Result)
boolean_2 = ClusterOutput(boolean)
