# Grasshopper definition ScreenshotTaker.ghx (Grasshopper 0.9.76)
# plug-ins: Python Interpreter

path = FilePath("C:\Users\provolot\Downloads\171014\fds.txt")
# 171014 @dantaeyoung https://github.com/dantaeyoung/GrasshopperArsenal
# 
# ScreenshotTaker
# (just a wrapper around ViewCaptureToFile)
getdirectoryoffile = PythonScript(file_location=path)  # -> dir_location
# ---------- getdirectoryoffile: Python ----------
dir_location_ = "\\".join(_file_location.split("\\")[:-1]) +"\\"
# ---------- end getdirectoryoffile ----------
panel = Panel(getdirectoryoffile)
python = PythonScript(
    take_screenshot=Button(),
    dir_location=getdirectoryoffile,
    filename="test1234.jpg",
    Width=Slider(2000, range=0..10000),
    Height=Slider(1000, range=0..1000))  # -> out, fullfilename
# ---------- python: Python ----------
import rhinoscriptsyntax as rs


def take_screenshot():
 
    rs.Command("-ViewCaptureToFile "+ str(filename) +" _Width " + str(_Width) + " _Height " + str(_Height) + " _Enter")




if(_take_screenshot):
    filename = _dir_location + _filename 
    take_screenshot()
    fullfilename_ = filename
# ---------- end python ----------

# ---- group: (optional) Only record last value when values are non/null
rec = DataRecorder(python.fullfilename, DataLimit=10, RecordData=True)
clean = CleanTree(RemoveNulls=True, RemoveInvalid=True, RemoveEmpty=False, Tree=rec)
item = ListItem(List=reverse(clean), Index=0, Wrap=True)

# ----
panel_2 = Panel(item)
