# Grasshopper definition SketchGestures.gh (Grasshopper 1.0.7)

# Sketch Gestures
# Dan Taeyoung (@dantaeyoung) : http://github.com/provolot/GrasshopperArsenal
# Try drawing three shapes like this with the 'sketch' command.
geometry_pipeline = GeometryPipeline(
    GroupByLayer=False,
    GroupByType=False,
    IncludeHidden=True,
    IncludeLocked=True,
    LayerFilter="*",
    NameFilter="*",
    SublayerFiltering=True,
    TypeFilter=4)
curve_self = CurveSelf(Curve=geometry_pipeline)  # -> Points, Params
list_length = ListLength(List=curve_self.Points)  # -> flatten(Length)
division = Division(A=list_length, B="2")

# ---- group: You can zoom in on this component and click on the 'plus' signs to create more outputs
sift_pattern = SiftPattern(List=geometry_pipeline, SiftPattern=division)  # -> Output0, Output1, Output2

# ----
geometry = Geometry(sift_pattern.Output2)
geometry_2 = Geometry(sift_pattern.Output1)
curve_self_2 = CurveSelf(Curve=geometry_2)  # -> Points, Params
geometry_3 = Geometry(sift_pattern.Output0)
length = Length(Curve=geometry_2)
bounding_box = BoundingBox(Content=geometry, Plane=PlaneXY(0, 0, 0))  # -> Box, Box_2
length_2 = Length(Curve=geometry)
list_item = ListItem(List=curve_self_2.Points, Index=0, Wrap=True)  # -> flatten(Item)
list_item_2 = ListItem(List=curve_self_2.Points, Index=0, Wrap=True)  # -> flatten(Item)
unit_z = UnitZ(Factor=1)
unit_z_2 = UnitZ(Factor=Slider(2, range=0..10))
volume = Volume(Geometry=bounding_box.Box)  # -> Volume, Centroid
division_2 = Division(A=length_2, B=Slider(16, range=0..110))
division_3 = Division(A=length, B=Slider(10, range=0..10))
division_4 = Division(A=length, B=Slider(4, range=0..10))
panel = Panel(geometry_3)
line_sdl = LineSDL(Start=volume.Centroid, Direction=unit_z, Length=Slider(5, range=0..100))
extrude = Extrude(Base=geometry_3, Direction=unit_z_2)
cone = Cone(Base=list_item, Radius=division_3, Length=division_4)  # -> Cone, Tip
divide_curve = DivideCurve(Curve=line_sdl, Count=Slider(4, range=0..10), Kinks=False)  # -> Points, Tangents, Parameters
custom_preview = CustomPreview(Geometry=extrude, Material=ColourSwatch(SwatchColor=RGB(109, 118, 252)))
sphere = Sphere(Base=divide_curve.Points, Radius=graft(division_2))
custom_preview_2 = CustomPreview(Geometry=cone.Cone, Material=ColourSwatch(SwatchColor=RGB(109, 118, 252)))
custom_preview_3 = CustomPreview(Geometry=sphere, Material=ColourSwatch(SwatchColor=RGB(109, 118, 252)))
