# Grasshopper definition SnippetTransferer.ghx (Grasshopper 0.9.76)

# ---- group: 2. Press the button to update SnippetBinary.
button = Button()

# ----
# SnippetTransferer - uses Andrew Heumann's Snippet creator to transfer snippets as data.
# Dan Taeyoung (@dantaeyoung) : http://github.com/provolot/GrasshopperArsenal
# 1. Group the 'SnippetSend' object with the Grasshopper components you want to send
cir = Circle(Plane=PlaneXY(0, 0, 0), Radius=1)
divide = DivideCurve(Curve=cir, Count=10, Kinks=False)  # -> Points, Tangents, Parameters
cir_2 = Circle(Plane=divide.Points, Radius=1)
divide_2 = DivideCurve(Curve=cir_2, Count=10, Kinks=False)  # -> Points, Tangents, Parameters
cir_3 = Circle(Plane=divide_2.Points, Radius=1)
divide_3 = DivideCurve(Curve=cir_3, Count=10, Kinks=False)  # -> Points, Tangents, Parameters
cir_4 = Circle(Plane=divide_3.Points, Radius=1)
snippetsend = CreateSnippet(Reset=button)  # -> SnippetBinary; inputs Reset: Boolean
# ---------- snippetsend: C# ----------
    if(Reset) return;
    GH_DocumentIO docIO = new GH_DocumentIO(GrasshopperDocument);
    List<Guid> objectsToCopy = new List<Guid>();
    foreach(IGH_DocumentObject obj in GrasshopperDocument.Objects){ //for all objs in GH doc
      if(obj is Grasshopper.Kernel.Special.GH_Group){ //if it's a group
        Grasshopper.Kernel.Special.GH_Group grp = obj as Grasshopper.Kernel.Special.GH_Group;
        if(grp.Objects().Exists(x => x.InstanceGuid == this.Component.InstanceGuid)){ //if the group contains this script
          foreach(IGH_DocumentObject grpObj in grp.Objects()){ // for all the objects in the group
            if(grpObj.InstanceGuid != this.Component.InstanceGuid){ // if the object isn't this component
              //save the guid of the objects to copy
              objectsToCopy.Add(grpObj.InstanceGuid);
            }
          }
        }

      }
    }

    //create a binary representation of the objects from the group by copying them and serializing the XML from the clipboard
    docIO.Copy(GH_ClipboardType.System, objectsToCopy);
    string snippet = System.Windows.Forms.Clipboard.GetText();
    string binary = BinaryFromSnip(snippet);
    docIO.ClearClipboard(GH_ClipboardType.System);
    // SnippetXML = snippet;
    SnippetBinary = binary;

    /*

    //create an XML representation of a different component - the script that can instantiate the snippet
    string scriptXML = XMLFromSnip(scriptSnip);

    //insert the code for the snippet into the c# instantiator component
    scriptXML = scriptXML.Replace(tokenToReplace, binary);

    // A = scriptXML;
    //add the instantiator object to the canvas
    System.Windows.Forms.Clipboard.SetText(scriptXML);
    Paste();
    */
# ---------- snippetsend: C# additional code ----------
  //  string tokenToReplace = "REPLACETHISWITHSNIP";

  //create a binary representation of a given XML snip
  string BinaryFromSnip(string snip){
    GH_Archive archive = new GH_Archive();
    archive.Deserialize_Xml(snip);
    string binary = System.Convert.ToBase64String(archive.Serialize_Binary());
    return binary;
  }

  //add components to the canvas, in the same manner as a grasshopper "Paste" operation
  void Paste(){
    //set up a GH documentIO object
    GH_DocumentIO documentIO = new GH_DocumentIO();
    //paste into the virtual documentIO
    documentIO.Paste(GH_ClipboardType.System);

    //Relocate the pasted objects in the virtual document to appear where the snippet object was placed
    var thispivot = this.Component.Attributes.Pivot;

    int smallestX = Int32.MaxValue;
    int smallestY = Int32.MaxValue;
    foreach(IGH_DocumentObject obj in documentIO.Document.Objects){
      var pivot = obj.Attributes.Pivot;
      if(pivot.X < smallestX) smallestX = (int) pivot.X;
      if(pivot.Y < smallestY) smallestY = (int) pivot.Y;
    }

    System.Drawing.Size offset = new System.Drawing.Size((int) thispivot.X - smallestX, (int) thispivot.Y - smallestY);

    documentIO.Document.TranslateObjects(offset, false);

    //clean up
    documentIO.Document.SelectAll();
    documentIO.Document.ExpireSolution();
    documentIO.Document.MutateAllIds();
    System.Collections.Generic.IEnumerable<IGH_DocumentObject> objs = documentIO.Document.Objects;
    GrasshopperDocument.DeselectAll();
    GrasshopperDocument.MergeDocument(documentIO.Document);
    GrasshopperDocument.UndoUtil.RecordAddObjectEvent("Paste", objs);
    GrasshopperDocument.ScheduleSolution(10);
  }

  //convert from a 64-bit string of a binary snip back into XML
  string XMLFromSnip(string snip){
    GH_Archive archive = new GH_Archive();
    archive.Deserialize_Binary(System.Convert.FromBase64String(snip));
    string XML = archive.Serialize_Xml();
    return XML;
  }

  //binary representation of the snippet instantiator object. Inside its XML representation is a string "REPLACETHISWITHSNIP" which will
  //get replaced by the binary representation of the other objects in the group.
  //string scriptSnip = "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";
# ---------- end snippetsend ----------

# ---- group: 3. You can now store this string, send this over Flux, etc.
panel = Panel(snippetsend)
# http://www.grasshopper3d.com/profiles/blogs/create-snippets-with-grasshopper
snippetbinary = Data(snippetsend)

# ---- group: 4. Click the button to 'paste' the contents of the snippet as Grasshopper objects. You've now transfered Grasshopper objects as data!
snippetbinary_2 = Data(snippetbinary)
snippetreceive = CreateSnippet(Run=Button(), SnippetBinary=snippetbinary_2)  # inputs Run: Boolean, SnippetBinary: String
# ---------- snippetreceive: C# ----------
    if(!Run) return;

    //create an XML representation of a different component - the script that can instantiate the snippet
    if(SnippetBinary.Length != 0) {
      string scriptXML = XMLFromSnip(SnippetBinary);
      System.Windows.Forms.Clipboard.SetText(scriptXML);
      Paste();
    }
# ---------- snippetreceive: C# additional code ----------
  //  string tokenToReplace = "REPLACETHISWITHSNIP";

  //create a binary representation of a given XML snip
  string BinaryFromSnip(string snip){
    GH_Archive archive = new GH_Archive();
    archive.Deserialize_Xml(snip);
    string binary = System.Convert.ToBase64String(archive.Serialize_Binary());
    return binary;
  }

  //add components to the canvas, in the same manner as a grasshopper "Paste" operation
  void Paste(){
    //set up a GH documentIO object
    GH_DocumentIO documentIO = new GH_DocumentIO();
    //paste into the virtual documentIO
    documentIO.Paste(GH_ClipboardType.System);

    //Relocate the pasted objects in the virtual document to appear where the snippet object was placed
    var thispivot = this.Component.Attributes.Pivot;

    int smallestX = Int32.MaxValue;
    int smallestY = Int32.MaxValue;
    foreach(IGH_DocumentObject obj in documentIO.Document.Objects){
      var pivot = obj.Attributes.Pivot;
      if(pivot.X < smallestX) smallestX = (int) pivot.X;
      if(pivot.Y < smallestY) smallestY = (int) pivot.Y;
    }

    System.Drawing.Size offset = new System.Drawing.Size((int) thispivot.X - smallestX, (int) thispivot.Y - smallestY);

    documentIO.Document.TranslateObjects(offset, false);

    //clean up
    documentIO.Document.SelectAll();
    documentIO.Document.ExpireSolution();
    documentIO.Document.MutateAllIds();
    System.Collections.Generic.IEnumerable<IGH_DocumentObject> objs = documentIO.Document.Objects;
    GrasshopperDocument.DeselectAll();
    GrasshopperDocument.MergeDocument(documentIO.Document);
    GrasshopperDocument.UndoUtil.RecordAddObjectEvent("Paste", objs);
    GrasshopperDocument.ScheduleSolution(10);
  }

  //convert from a 64-bit string of a binary snip back into XML
  string XMLFromSnip(string snip){
    GH_Archive archive = new GH_Archive();
    archive.Deserialize_Binary(System.Convert.FromBase64String(snip));
    string XML = archive.Serialize_Xml();
    return XML;
  }

  //binary representation of the snippet instantiator object. Inside its XML representation is a string "REPLACETHISWITHSNIP" which will
  //get replaced by the binary representation of the other objects in the group.
  //string scriptSnip = "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";
# ---------- end snippetreceive ----------
