# Grasshopper definition SoundTower.gh (Grasshopper 1.0.7)
# plug-ins: Firefly.X, Human

# Other Inputs - SoundTower
# Dan Taeyoung (@dantaeyoung) : http://github.com/provolot/GrasshopperArsenal
libraries_this_script_uses = Panel("""Human
Firefly""")

# ---- group: This example requires the Firefly plugin.
# The audio output is a result of an FFT (Fast Fourier Transform), which is to say:
# The list represents a series of amplitudes (how loud it is) of frequencies (the pitch of the sound),
# going from low frequency to high frequency.
# 
# In other words, the list represents the loudness of the lowest sound,
# the loudness of a slightly low sound,
# the loudness of a medium low sound... all the way to the loudness of a high pitched sound
# If you don't see anything here..
# 
# You need a plugin called Firefly!
# 
# See here for more info. https://github.com/dantaeyoung/GrasshopperArsenal/tree/master/SoundTower
frequency_spectrum = FrequencySpectrum()  # -> NoteVolume, PeakFrequency, PeakNote

# ---- group: This captures a specific part of the audio input.
construct_domain = ConstructDomain(DomainStart=Slider(3, range=0..10), DomainEnd=Slider(123, range=0..1000))
sub_list = SubList(List=frequency_spectrum.NoteVolume, Domain=construct_domain, Wrap=True)  # -> List, Index

# ---- group: This generates X numbers between 0 and 1 (move the slider around)
number_slider = Slider(10, range=0..10)
division = Division(A="1", B=number_slider)
# Notice how the values going in are transformed to different numbers on their way out.
# Try playing with the graph (the white circles) to change the values.
# You can also right-click on the graph and select a different graph type.
series = Series(Start=0, Step=division, Count=number_slider)

# ---- group: try sliding me around
number_slider_2 = Slider(0.92, range=0..1)

# ----
# GraphMapper receives inputs and plots them as x-values;
# it then finds where the graph intersects with the x-value
# and then outputs the y value of the intersection as an output.
panel = Panel(series)

# ---- group: We multiply by some number (the exact number doesn't matter) and use a graph mapper to change the numbers until they're not super small fractions anymore.
multiplication = Multiplication(A=Slider(1666, range=0..2100), B=sub_list.List)
graph_mapper = GraphMapper(
    multiplication,
    x0=0,
    x1=1,
    y0=0,
    y1=1,
    container_name="Bezier",
    cpx=[0, 0.1987179518, 0.788461566, 1],
    cpy=[0.3282594681, 0.7681159377, 0.5326086879, 1])

# ----
panel_2 = Panel(number_slider_2)
quick_graph = QuickGraph(sub_list.List, SortOrder=0)
graph_mapper_2 = GraphMapper(number_slider_2, x0=0, x1=1, y0=0, y1=1, container_name="Bezier", cpx=[0, 1, 1, 1], cpy=[0, 0, 0.576086998, 1])
panel_3 = Panel(series)
panel_4 = Panel(graph_mapper_2)
graph_mapper_3 = GraphMapper(
    series,
    x0=0,
    x1=1,
    y0=0,
    y1=1,
    container_name="Bezier",
    cpx=[0, 0.8985507488, 0.3876501918, 1],
    cpy=[0, 0.04710143805, 0.6152715683, 1])

# ---- group: "Partition List" divides the list into chunks of 4, etc. This is so we reduce a list of 100 frequencies to a list of 25 'bunches' of 4 frequencies.
partition_list = PartitionList(List=graph_mapper, Size=Slider(4, range=0..10))

# ----
panel_5 = Panel(graph_mapper_3)
panel_6 = Panel(graph_mapper)

# ---- group: This averages each list of frequencies (each 'bunch'), effectively lowering our resolution and giving us fewer frequencies
average = Average(Input=partition_list)  # -> flatten(ArithmeticMean)

# ---- group: We figure out how long the list is and make a polygon with that many sides.. around the zero point
construct_point = ConstructPoint(XCoordinate=0, YCoordinate=0, ZCoordinate=0)
list_length = ListLength(List=average)
polygon = Polygon(Plane=construct_point, Radius=3, Segments=list_length, FilletRadius=0)  # -> Polygon, Length

# ---- group: We get all the points on the polygon (minus the first one, because on closed curves the first control point and the last control point are the same)
control_points = ControlPoints(Curve=polygon.Polygon)  # -> Points, Weights, Knots
split_list = SplitList(List=control_points.Points, Index=Slider(1, range=0..1))  # -> ListA, ListB

# ---- group: We get the vector from the center of the polygon to each control point, and then multiply/amplify it by each audio frequency amplitude -- the louder the amplitude, the longer the vector)
vector_2pt = Vector2Pt(PointA=construct_point, PointB=split_list.ListB, Unitize=False)  # -> Vector, Length
multiplication_2 = Multiplication(A=average, B=vector_2pt.Vector)

# ---- group: Then we move the points from the center with the vectors, creating a distorted polygon, and make a closed polyline!
move = Move(Geometry=construct_point, Motion=multiplication_2)  # -> Geometry, Transform
polyline = PolyLine(Vertices=move.Geometry, Closed=Toggle(True))

# ---- group: We can slow down the data if need be (right-click for options to do so)
data_dam = DataDam(DataDataA=polyline, BufferDelay=20000000, BufferMode=1)

# ---- group: And then we record (in Grasshopper) the last X items. Right-click to find the option 'Record Limit'.
data_recorder = DataRecorder(data_dam, DataLimit=55, RecordData=True)

# ---- group: Make a series of vectors pointing 'up', and make as many as we have items recorded
list_length_2 = ListLength(List=data_recorder)
series_2 = Series(Start=0, Step=Slider(1, range=0..10), Count=list_length_2)
unit_z = UnitZ(Factor=series_2)

# ---- group: Move them upwards! Now they're in a stack
move_2 = Move(Geometry=data_recorder, Motion=unit_z)  # -> Geometry, Transform

# ---- group: Get the length of each polyline, and map it to 0 and 1
length = Length(Curve=move_2.Geometry)
bounds = Bounds(Numbers=length)
remap_numbers = RemapNumbers(Value=length, Source=bounds, Target=Domain(0, 1))  # -> Mapped, Clipped

# ---- group: Turn a value from 0 to 1 into a color along a gradient. Right-click to edit the gradient!
gradient = Gradient(
    LowerLimit=0,
    UpperLimit=1,
    Parameter=remap_numbers.Mapped,
    stops=[0: RGB(234, 38, 0), 0.25: RGB(234, 126, 0), 0.5: RGB(254, 244, 84), 0.75: RGB(173, 203, 249), 1: RGB(75, 107, 169)])

# ----
material = Shader(gradient)
geometry = Geometry(move_2.Geometry)

# ---- group: Use Custom Preview Lineweights (if you have Human) to preview the lines as thick colored lines
custom_preview_lineweights = CustomPreviewLineweights(Geometry=geometry, Shader=material, Thickness=Slider(9, range=0..10), Absolute=False)
custom_preview = CustomPreview(Geometry=geometry, Material=material)
