# Grasshopper definition StreamHacks.gh (Grasshopper 1.0.7)
# Copyright: Robert McNeel & Associates
# plug-ins: InteracTool, Human

number_slider = Slider(5.66, range=0..10)  # disabled
pipeline = GeometryPipeline(
    GroupByLayer=False,
    GroupByType=False,
    IncludeHidden=True,
    IncludeLocked=True,
    LayerFilter="*",
    NameFilter="*",
    SublayerFiltering=True,
    TypeFilter=1073741852)
number_slider_2 = Slider(6.92, range=0..10)
number_slider_3 = Slider(7.66, range=0..10)
# Stream Hacks
# Dan Taeyoung (@dantaeyoung) : http://github.com/provolot/GrasshopperArsenal
libraries = Libraries()
panel = Panel("1")  # disabled
panel_2 = Panel("""1
22
333
Example Geometry""")
panel_3 = Panel(libraries)
mouse = MouseEvent(Start="2")  # -> Line, Point, Button, Double, SPoint
mouse_2 = MouseEvent(Start=panel)  # -> Line, Point, Button, Double, SPoint; disabled
bool = Boolean(mouse.Point)

# ---- group: Data Dam can help slow down user input. This is helpful when making a script.
dam = DataDam(DataA=mouse_2.Point, BufferDelay=2500000, BufferMode=2)  # disabled

# ---- group: This component is called "Data Dam"
dam_2 = DataDam(DataA=number_slider, BufferDelay=10000000, BufferMode=2)  # disabled

# ----
dam_3 = DataDam(DataA=number_slider_3, BufferDelay=5000000, BufferMode=2)
dam_4 = DataDam(DataA=number_slider_2, BufferDelay=5000000, BufferMode=2)

# ---- group: This component will find all the currently selected geometry.
selobj = ObjectsBySelection(Reset=Toggle(False), LiveMode=False)

# ----
getroughmidpoint = GetRoughMidpoint(geo=pipeline)
dam_5 = DataDam(DataA=bool, BufferDelay=2500000, BufferMode=2)
panel_4 = Panel(number_slider_3)

# ---- group: "Stream Filter" can operate like a switch
filter = StreamFilter(Gate=Toggle(False), Stream1=panel_2)

# ----
panel_5 = Panel(number_slider_2)
objdet = ObjectDetails(Object=pipeline)  # -> Referenced, Available, Name, Layer, Colour, Guid
swatch = ColourSwatch(SwatchColor=RGB(112, 108, 108))  # disabled
sph = Sphere(Base=dam, Radius=1)  # disabled
panel_6 = Panel(dam_3)
panel_7 = Panel(dam_4)
panel_8 = Panel(dam_2)  # disabled
panel_9 = Panel(filter)

# ---- group: This component will find all the currently selected geometry.
selobj_2 = ObjectsBySelection(Reset=dam_5, LiveMode=False)

# ----
preview = CustomPreview(Geometry=sph, Material=swatch)  # disabled

# ---- group: This setup can help detect "When data is changing".
equals = Equality(FirstNumber=dam_3, SecondNumber=number_slider_3)  # -> Equality, Inequality

equals_2 = Equality(FirstNumber=dam_4, SecondNumber=number_slider_2)  # -> Equality, Inequality

# ----
panel_10 = Panel(objdet.Name)
tag = TextTag(Location=getroughmidpoint, Text=objdet.Name, Colour=ColourSwatch(SwatchColor=RGB(255, 255, 255)))
filter_2 = StreamFilter(Gate=equals_2.Inequality, Stream1=number_slider_2)
is_data_changing = Panel(equals.Inequality)
panel_11 = Panel("""a
b
c
d
e
f""")
data_only_when_changing = Panel(filter_2)
keyboard = KeyBoardEvent(Start=Slider(1, range=0..4), Keys=panel_11)  # -> Current, Pressed, Toggled
geo = Geometry(selobj_2)
dispatch = Dispatch(List=panel_11, DispatchPattern=keyboard.Pressed)  # -> ListA, ListB
item = ListItem(List=dispatch.ListA, Index=0, Wrap=True)
dam_6 = DataDam(DataA=geo, BufferDelay=2500000, BufferMode=2)
null = NullItem(Item=item)  # -> NullFlags, InvalidFlags, Description
createatts = CreateAttributes(Name=dispatch.ListA, enableFullPath=False)
filter_3 = StreamFilter(Gate=null.NullFlags, Stream0=createatts)
modatts = ModifyObjectAttributes(Objects=geo, Attributes=filter_3)
toggle = BooleanToggle(False)
merge = Merge()
timerlocker = TimerLocker(EnableTimers=toggle)  # inputs EnableTimers: Boolean
# ---------- timerlocker: C# ----------
foreach(IGH_DocumentObject obj in GrasshopperDocument.Objects) { //for all objs in GH doc
      
      //Try to cast the object to a GH_Timer
      if(obj is Grasshopper.Kernel.Special.GH_Timer) {
        Grasshopper.Kernel.Special.GH_Timer timer = obj as Grasshopper.Kernel.Special.GH_Timer;
        if (timer.Targets.Contains(this.Component.InstanceGuid)) {
          
          if(!EnableTimers) { timer.Locked = true; }
          else { timer.Locked = false; }
        }
      }
    }
# ---------- end timerlocker ----------

# ---- group: This timer helps keep things updated
timer = Timer(TimerInterval=100, Target=[selobj_3, timerlocker])  # disabled

# ---- group: This component will find all the currently selected geometry.
selobj_3 = ObjectsBySelection(Reset=toggle, LiveMode=False)

# ----
geo_2 = Geometry(selobj_3)
currentguid = Guid(geo_2)
merge_2 = Merge(Data1=currentguid, Data2="1234")  # -> flatten(Result)
join = TextJoin(Text=merge_2)
dam_7 = DataDam(DataA=join, BufferDelay=2500000, BufferMode=2)
tmatch = MatchText(Text=join, Pattern=dam_7, Case=True)
merge_3 = Merge(Data1="1234", Data2=geo_2)  # -> flatten(Result)
not = GateNot(A=tmatch)
expire_dam = ExpireDam(Expire=not, InputValue=merge_3)
split = SplitList(List=expire_dam, Index="1")  # -> ListA, ListB
geo_3 = Geometry(split.ListB)

# ==== cluster Libraries: Lists third-party libraries used in this definition
unused = ClusterInput()  # Dummy input; used to trigger refresh of C# script only.
c_script = CSharpScript(unused=unused)  # -> out, L
# ---------- c_script: C# usings ----------
using System.Linq;
# ---------- c_script: C# ----------
    var libs = new Dictionary<Guid, GH_AssemblyInfo>();

    // get doc
    var doc = Component.OnPingDocument();
    if (doc.Owner != null)
    {
      // if script is inside cluster/user object, use parent doc
      doc = doc.Owner.OwnerDocument();
    }

    // loop through objects on canvas
    foreach (var op in doc.Objects)
    {
      // get library that contains object
      var lib = Instances.ComponentServer.FindAssemblyByObject(op);
      if (lib != null && !lib.IsCoreLibrary && !libs.ContainsKey(lib.Id))
      {
        // add unique third-party libs to list
        libs[lib.Id] = lib;
      }
    }

    // output library names
    L = libs.Values.OrderBy(x => x.Name).Select(y => y.Name);
# ---------- end c_script ----------
L = ClusterOutput(c_script.L)

# ==== cluster GetRoughMidpoint
geo = ClusterInput()
number_slider = Slider(0.5, range=0..1)
geo_2 = Geometry(geo)
bbox = BoundingBox(Content=geo_2, Plane=PlaneXY(0, 0, 0))  # -> Box, Box_2
crv = Curve(geo_2)
srf = Surface(geo_2)
pt = ConstructPoint(XCoordinate=number_slider, YCoordinate=number_slider, ZCoordinate=0)
curvepoint = PointOnCurve(crv, parameter=0.5)
volume = Volume(Geometry=bbox.Box)  # -> Volume, Centroid
evalsrf = EvaluateSurface(Surface=reparameterize(srf), Point=pt)  # -> Point, Normal, UDirection, VDirection, Frame
combine = CombineData(Input0=evalsrf.Point, Input1=curvepoint, Input2=volume.Centroid)  # -> Result, Index
roughmidpt = Point(combine.Result)
roughmidpt_2 = ClusterOutput(roughmidpt)
