# Grasshopper definition StreamTricks.gh (Grasshopper 1.0.7)

# StreamTricks
# Dan Taeyoung (@dantaeyoung) : http://github.com/provolot/GrasshopperArsenal
# Momentary True/False event --> 1 second-long True/False event
button = Button()
# This creates a random number guaranteed to change based on each button press
panel = Panel("Now")

# ---- group: This Stream Filter is a way to pass the solution expiration message downstream without having the data change.
stream_filter = StreamFilter(Gate=button, Stream0=panel, Stream1=panel)

# ----
stufftriggerstrue = StuffTriggersTrue(item=[Slider(4, range=0..10), "FDSA"])
time = Time(stream_filter)
deconstruct_date = DeconstructDate(Date=time)  # -> Year, Month, Day, Hour, Minute, Second
panel_2 = Panel(stufftriggerstrue)
multiplication = Multiplication(A=deconstruct_date.Hour, B=deconstruct_date.Minute, C=deconstruct_date.Second)

# ---- group: This Data Dam controls the duration of the true/false event
data_dam = DataDam(DataDataA=multiplication, BufferDelay=10000000, BufferMode=2)

# ----
equality = Equality(FirstNumber=data_dam, SecondNumber=multiplication)  # -> Equality, Inequality
boolean = Boolean(equality.Equality)
panel_3 = Panel(boolean)

# ==== cluster StuffTriggersTrue
item = ClusterInput()
null_item = NullItem(Item=item)  # -> NullFlags, InvalidFlags, Description
gate_not = GateNot(A=null_item.NullFlags)
massor = MassOr(boolean=gate_not)
boolean = Boolean(massor)
boolean_2 = ClusterOutput(boolean)

# ==== cluster MassOr
boolean = ClusterInput()
boolean_2 = Boolean(boolean)
mass_addition = MassAddition(Input=boolean_2)  # -> Result, PartialResults
boolean_3 = Boolean(mass_addition.Result)
boolean_4 = ClusterOutput(boolean_3)
