# Grasshopper definition SwivelFigures.ghx (Grasshopper 0.9.76)
# plug-ins: getFlounderCamera

pipeline = GeometryPipeline(
    GroupByLayer=False,
    GroupByType=False,
    IncludeHidden=True,
    IncludeLocked=True,
    LayerFilter="PEOPLE BOUNDARY*",
    NameFilter="*",
    TypeFilter=4)
peopleboundary = Geometry(pipeline)

# ----
# SwivelFigures - instantiate scale figures and rotate them to be visible from the camera
# Dan Taeyoung (@dantaeyoung) : http://github.com/provolot/GrasshopperArsenal
pipeline_2 = GeometryPipeline(
    GroupByLayer=False,
    GroupByType=False,
    IncludeHidden=True,
    IncludeLocked=True,
    LayerFilter="SCALE FIGURES*",
    NameFilter="*",
    TypeFilter=1073741848)
scalefigures = Geometry(simplify(pipeline_2))

# ---- group: Get the vector direction the camera is pointing in, but remove the z value so that the vector lies on the XY plane.
boolean = Boolean(Toggle(True))
gate_not = GateNot(A=boolean)
timerlocker = TimerLocker(DisableTimers=gate_not)  # -> out
# ---------- timerlocker: VB ----------
    'We need to disable the timer that is associated with this VB component.
    'First, find the document that contains this VB component
      Dim ghdoc As GH_Document = owner.OnPingDocument()
      If (ghdoc Is Nothing) Then Return
      'Then, iterate over all objects in the document to find all timers.
      For Each docobj As IGH_DocumentObject In ghdoc.Objects
        'Try to cast the object to a GH_Timer
        Dim timer As Special.GH_Timer = TryCast(docobj, Special.GH_Timer)
        If (timer Is Nothing) Then Continue For
        'If the cast was successful, then see if this component is
        'part of the timer target list.
        If (timer.Targets.Contains(owner.InstanceGuid)) Then

          'If it is,

          If(DisableTimers) Then
            'lock the timer.
            print("Timer Locked")
            timer.Locked = True
          Else
            print("Timer Unlocked")
            Timer.Locked = False
          End If

        End If
      Next
# ---------- end timerlocker ----------
timer = Timer(TimerInterval=20, Target=[getfloundercamera, timerlocker])
getfloundercamera = GetFlounderCamera(Activate=boolean, ViewportName="DiagramView1")  # -> Location, Target, Lens, Up
vec2pt = Vector2Pt(PointA=getfloundercamera.Target, PointB=getfloundercamera.Location, Unitize=False)  # -> Vector, Length
cameravector = Vector(vec2pt.Vector)
getunitvectoronxyplane = GetUnitVectorOnXYPlane(vector=cameravector)

# ----
people_no_approx = Slider(40, range=0..400)
randompointsinside = RandomPointsInside(geo=peopleboundary, num=people_no_approx)
data_dam = DataDam(DataDataA=randompointsinside, BufferDelay=5000000, BufferMode=2)

# ---- group: Randomly choose scale figures
getbottomcenter = GetBottomCenter(C=scalefigures)
lng = ListLength(List=data_dam)
chooserandomnfromlist = ChooseRandomNFromList(data=scalefigures, N=lng)  # -> data_4, index_2
list_item = ListItem(List=getbottomcenter, Index=chooserandomnfromlist.index_2, Wrap=True)

# ----
unit_y = UnitY(Factor=1)

# ---- group: Place and rotate scale figures
orient_direction = OrientDirection(
    Geometry=chooserandomnfromlist.data_4,
    PointA=list_item,
    DirectionA=unit_y,
    PointB=data_dam,
    DirectionB=getunitvectoronxyplane)  # -> Geometry, Transform
geo = Geometry(orient_direction.Geometry)

# ----
colour = ColourPicker(PickedColour=RGB(69, 40, 184))
geo_2 = Geometry(geo)
preview = CustomPreview(Geometry=geo_2, Shader=colour)

# ==== cluster GetBottomCenter
C = ClusterInput()
bbox = BoundingBox(Content=C, Plane=PlaneXY(0, 0, 0))  # -> Box, Box_2
geo = Geometry(bbox.Box)
debox = DeconstructBox(Box=geo)  # -> Plane, X, Y, Z
dedomain = DeconstructDomain(Domain=debox.Z)  # -> Start, End
boxprop = BoxProperties(Box=geo)  # -> Center, Diagonal, Area, Volume, Degeneracy
pdecon = Deconstruct(Point=boxprop.Center)  # -> XComponent, YComponent, ZComponent
pt = ConstructPoint(XCoordinate=pdecon.XComponent, YCoordinate=pdecon.YComponent, ZCoordinate=dedomain.Start)
pt_2 = ClusterOutput(pt)

# ==== cluster RandomPointsInside
num = ClusterInput()
geo = ClusterInput()
geo_2 = Geometry(geo)
num_2 = Number(num)
bbox = BoundingBox(Content=geo_2, Plane=PlaneXY(0, 0, 0))  # -> Box, Box_2
area = Area(Geometry=geo_2)  # -> Area, Centroid
area_2 = Area(Geometry=bbox.Box)  # -> Area, Centroid
division = Division(A=area_2.Area, B=area.Area)
multiplication = Multiplication(A=division, B=Slider(1.3, range=0..10))
multiplication_2 = Multiplication(A=num_2, B=multiplication)
debox = DeconstructBox(Box=bbox.Box)  # -> Plane, X, Y, Z

number = Number(multiplication_2)
num_3 = Number(debox.X)
multiplication_3 = Multiplication(A=num_3, B=number)
addition = Addition(A=num_3, B=number)
addition_2 = Addition(A=multiplication_3, B=addition)
addition_3 = Addition(A=addition_2, B=addition)

panel = Panel(division)
random = Random(Range=debox.Y, Number=multiplication_2, Seed=addition_3)
random_2 = Random(Range=debox.X, Number=multiplication_2, Seed=addition_2)
pt = ConstructPoint(XCoordinate=random_2, YCoordinate=random, ZCoordinate=0)
incurve = PointInCurve(Point=pt, Curve=geo_2)  # -> Relationship, Point
dispatch = Dispatch(List=pt, DispatchPattern=incurve.Relationship)  # -> ListA, ListB
split_list = SplitList(List=dispatch.ListA, Index=num_2)  # -> ListA, ListB
list_a = ClusterOutput(split_list.ListA)

# ==== cluster ChooseRandomNFromList
data = ClusterInput()
seed = ClusterInput()
data_2 = Data(data)
seed_2 = Number(seed)
N = ClusterInput()
lng = ListLength(List=data_2)
dom = ConstructDomain(DomainStart="0", DomainEnd=expr("x-1", lng))
addition = Addition(A=N, B=seed_2)
random = Random(Range=dom, Number=N, Seed=addition)
int = Integer(random)
item = ListItem(List=data_2, Index=int, Wrap=True)
index = Integer(int)
data_3 = Data(item)
index_2 = ClusterOutput(index)
data_4 = ClusterOutput(data_3)

# ==== cluster GetUnitVectorOnXYPlane
vector = ClusterInput()
unit_vector = UnitVector(Vector=vector)
deconstruct_vector = DeconstructVector(Vector=unit_vector)  # -> XComponent, YComponent, ZComponent
vector_xyz = VectorXYZ(XComponent=deconstruct_vector.XComponent, YComponent=deconstruct_vector.YComponent, ZComponent=0)  # -> Vector, Length
vector_2 = ClusterOutput(vector_xyz.Vector)
