# Grasshopper definition ListenToTeachableMachine.gh (Grasshopper 1.0.7)

# ---- group: You may need to click this to 'reset' the connection with the server
button = Button()

# ----
# Teachable Machine websocket message receiver
# from https://github.com/dantaeyoung/GrasshopperArsenal/tree/master/TeachableMachine/
panel = Panel("ws://localhost:8080")
websocket_client_start = WebsocketClientStart(Address=panel, InitalMessage="Hello World", Reset=button)
websocket_client_receiver = WebsocketClientReceiver(WebsocketObjects=websocket_client_start, AutoUpdate=Toggle(True))  # -> Message, Status
teachable_machine_msg_to_keys_values = TeachableMachineMsgToKeysValues(msg=websocket_client_receiver.Message)  # -> keys, values
panel_2 = Panel(teachable_machine_msg_to_keys_values.keys)
panel_3 = Panel(teachable_machine_msg_to_keys_values.values)

# ==== cluster TeachableMachineMsgToKeysValues
msg = ClusterInput()
ghpython_script = GhPythonScript(msg=msg)  # -> out, Keys, Values
# ---------- ghpython_script: Python ----------
__author__ = "provolot"
__version__ = "2019.12.12"

import rhinoscriptsyntax as rs

splitmsg = msg.replace('\"', '').split(",")
if(splitmsg[-1] == ''):
    splitmsg.pop()

Keys = splitmsg[::2]
Values = splitmsg[1::2]
# ---------- end ghpython_script ----------
keys = ClusterOutput(ghpython_script.Keys)
values = ClusterOutput(ghpython_script.Values)
