# Grasshopper definition TimerLocker.ghx (Grasshopper 1.0.7)

# TimerLocker: Enable/Disable timers with Grasshopper Boolean values
# Dan Taeyoung (@dantaeyoung) : http://github.com/provolot/GrasshopperArsenal
boolean_toggle = BooleanToggle(False)
timer = Timer(Interval=2000, TimerInterval=2000, Target=timerlocker)  # disabled
timer_2 = Timer(Interval=10000, TimerInterval=10000, Target=timerlocker)  # disabled
timerlocker = CreateSnippet(EnableTimers=boolean_toggle)  # inputs EnableTimers: Boolean
# ---------- timerlocker: C# ----------
foreach(IGH_DocumentObject obj in GrasshopperDocument.Objects) { //for all objs in GH doc
      
      //Try to cast the object to a GH_Timer
      if(obj is Grasshopper.Kernel.Special.GH_Timer) {
        Grasshopper.Kernel.Special.GH_Timer timer = obj as Grasshopper.Kernel.Special.GH_Timer;
        if (timer.Targets.Contains(this.Component.InstanceGuid)) {
          
          if(!EnableTimers) { timer.Locked = true; }
          else { timer.Locked = false; }
        }
      }
    }
# ---------- end timerlocker ----------
timer_3 = Timer(Interval=50, TimerInterval=50, Target=timerlocker)  # disabled
