# Grasshopper definition TimerLocker_v1.ghx (Grasshopper 0.9.76)

# TimerLocker: Enable/Disable timers with Grasshopper Boolean values
# Dan Taeyoung (@dantaeyoung) : http://github.com/provolot/GrasshopperArsenal
boolean_toggle = BooleanToggle(True)
timer = Timer(TimerInterval=2000, Target=timerlocker)  # disabled
timer_2 = Timer(TimerInterval=10000, Target=timerlocker)  # disabled
timerlocker = TimerLocker(DisableTimers=boolean_toggle)
# ---------- timerlocker: VB ----------
    'We need to disable the timer that is associated with this VB component.
    'First, find the document that contains this VB component
      Dim ghdoc As GH_Document = owner.OnPingDocument()
      If (ghdoc Is Nothing) Then Return
      'Then, iterate over all objects in the document to find all timers.
      For Each docobj As IGH_DocumentObject In ghdoc.Objects
        'Try to cast the object to a GH_Timer
        Dim timer As Special.GH_Timer = TryCast(docobj, Special.GH_Timer)
        If (timer Is Nothing) Then Continue For
        'If the cast was successful, then see if this component is
        'part of the timer target list.
        If (timer.Targets.Contains(owner.InstanceGuid)) Then

          'If it is,

          If(DisableTimers) Then
            'lock the timer.
            print("Timer Locked")
            timer.Locked = True
          Else
            print("Timer Unlocked")
            Timer.Locked = False
          End If

        End If
      Next
# ---------- end timerlocker ----------
