# Grasshopper definition TrackKeyboard.ghx (Grasshopper 0.9.76)
# plug-ins: Python Interpreter, Firefly.X

panel = Panel("""a
b
c
d
e
f
g
h
i
j
k
l
m
n
o
p
q
r
s
t
u
v
w
x
y
z
0
1
2
3
4
5
6
7
8
9
 """)
timer = Timer(TimerInterval=20, Target=python)
timer_2 = Timer(TimerInterval=50, Target=[pressed, timerlocker])
pressed = IsKeyPressed(KeyToTest=panel)
timerlocker = TimerLocker(EnableTimers=Toggle(True))  # inputs EnableTimers: Boolean
# ---------- timerlocker: C# ----------
foreach(IGH_DocumentObject obj in GrasshopperDocument.Objects) { //for all objs in GH doc
      
      //Try to cast the object to a GH_Timer
      if(obj is Grasshopper.Kernel.Special.GH_Timer) {
        Grasshopper.Kernel.Special.GH_Timer timer = obj as Grasshopper.Kernel.Special.GH_Timer;
        if (timer.Targets.Contains(this.Component.InstanceGuid)) {
          
          if(!EnableTimers) { timer.Locked = true; }
          else { timer.Locked = false; }
        }
      }
    }
# ---------- end timerlocker ----------
python = PythonScript()  # -> history, lastline, commands, lastcommand
# ---------- python: Python ----------
import rhinoscriptsyntax as rs
import re

history = rs.CommandHistory().split("\n")
lastline = history[-2]

commands = map(lambda y: y.split(": ")[1], filter(lambda x: re.match("Command: ", x), history))
lastcommand = commands[-1]
# ---------- end python ----------
dispatch = Dispatch(List=panel, DispatchPattern=pressed)  # -> ListA, ListB
panel_2 = Panel(python.lastcommand)
rec = DataRecorder(dispatch.ListA, DataLimit=-10, RecordData=True)
panel_3 = Panel(python.history)
panel_4 = Panel(rec)
