# Grasshopper definition TrackMouse.ghx (Grasshopper 1.0.7)
# plug-ins: InteracTool

# TrackMouse
# Dan Taeyoung (@dantaeyoung) : http://github.com/provolot/GrasshopperArsenal
toggle = BooleanToggle(False)
timer = Timer(TimerInterval=20, Target=[timerlocker, trackmouse])  # disabled
timerlocker = TimerLocker(EnableTimers=toggle)  # inputs EnableTimers: Boolean
# ---------- timerlocker: C# ----------
foreach(IGH_DocumentObject obj in GrasshopperDocument.Objects) { //for all objs in GH doc
      
      //Try to cast the object to a GH_Timer
      if(obj is Grasshopper.Kernel.Special.GH_Timer) {
        Grasshopper.Kernel.Special.GH_Timer timer = obj as Grasshopper.Kernel.Special.GH_Timer;
        if (timer.Targets.Contains(this.Component.InstanceGuid)) {
          
          if(!EnableTimers) { timer.Locked = true; }
          else { timer.Locked = false; }
        }
      }
    }
# ---------- end timerlocker ----------

# ---- group: This component makes the above code obsolete! Use this instead, unless you need to get mouse movement by viewport.
mouse = MouseEvent(Start=0)  # -> Line, Point, Button, Double, SPoint; disabled

# ----
trackmouse = TrackMouse(toggle=toggle, viewportname="Perspective")  # -> screencoords, viewportcoords, worlddirection, viewportplane
plx = LinePlane(Line=trackmouse.worlddirection, Plane=trackmouse.viewportplane)  # -> Point, ParamL, ParamP
rec = DataRecorder(plx.Point, DataLimit=100, RecordData=True)
geo = Geometry(rec)
panel = Panel(geo)

# ==== cluster TrackMouse
toggle = ClusterInput()
viewportname = ClusterInput()
python = PythonScript(toggle=toggle, ViewportName=viewportname)  # -> out, screencoords, viewportcoords, worlddirection, viewportplane
# ---------- python: Python ----------
import System
import Rhino
import scriptcontext
import System.Guid
"""
 Dim Point1 As  System.Drawing.Point = System.Windows.Forms.Cursor.Position
    Dim point2 As  System.Drawing.Point

    point2 = doc.Views.ActiveView.ScreenToClient(Point1)

    screenCoordinates = point1 ' doc.Views.ActiveView.ActiveViewport.ClientToWorld(point2)
    ViewportCoordinates = Point2

    WorldDirection = doc.Views.ActiveView.ActiveViewport.ClientToWorld(point2)
    ViewportConstructionPlane = doc.Views.ActiveView.ActiveViewport.ConstructionPlane()
"""
"""
            screencoords = System.Windows.Forms.Control.MousePosition
            viewportcoords = scriptcontext.doc.Views.ActiveView.ScreenToClient(screencoords)
            worlddirection = scriptcontext.doc.Views.ActiveView.ActiveViewport.ClientToWorld(viewportcoords)
            viewportplane = scriptcontext.doc.Views.ActiveView. ActiveViewport.ConstructionPlane()

"""
if toggle:
    for thisview in scriptcontext.doc.Views:
        if(ViewportName == thisview.ActiveViewport.Name) :
                
            screencoords = System.Windows.Forms.Control.MousePosition
            
            viewportcoords = thisview.ScreenToClient(screencoords)
            worlddirection = thisview.ActiveViewport.ClientToWorld(viewportcoords)
            viewportplane = thisview.ActiveViewport.ConstructionPlane()
# ---------- end python ----------
screencoords = ClusterOutput(python.screencoords)
viewportcoords = ClusterOutput(python.viewportcoords)
worlddirection = ClusterOutput(python.worlddirection)
viewportplane = ClusterOutput(python.viewportplane)
