# Grasshopper definition TreeExamples.gh (Grasshopper 1.0.7)
# plug-ins: Human

point = Point(graft([Point(16.27001429, 4.36582998, 0), Point(17.62852593, 0.165425598, 0), Point(18.88443599, -6.406360011, 0), Point(18.30104035, -3.235535322, 0)]))
panel = Panel("""1
10
100
1000""")
panel_2 = Panel("""1
2
3
4""")
# Tree Examples
# Dan Taeyoung (@dantaeyoung) : http://github.com/provolot/GrasshopperArsenal
# 'First Principles' of how lists & trees work
panel_3 = Panel("""1
2
3
4""")
panel_4 = Panel("""1
2
3
4""")
panel_5 = Panel("""1
10000""")
panel_6 = Panel("""10
10000""")
panel_7 = Panel("""1
2
3
4""")
point_2 = Point([Point(23.69153234, 6.29345854, 0), Point(24.69218905, 3.325989082, 0)])
point_3 = Point([Point(7.421518056, 1.927628561, 0), Point(8.422174764, -1.039840897, 0)])
panel_8 = Panel("""1
2
3
4""")
point_4 = Point([Point(0, 0, 0), Point(1.358511644, -4.200404382, 0), Point(2.614421707, -10.77218999, 0), Point(2.03102606, -7.601365301, 0)])
panel_9 = Panel("""1
2
3
4""")
panel_10 = Panel("""10
10000""")
panel_11 = Panel("""1
2
3
4""")
line = Line(StartPoint=point_4, EndPoint=point_3)
multiplication = Multiplication(A=panel_2, B=panel)
multiplication_2 = Multiplication(A=panel_3, B="10")
multiplication_3 = Multiplication(A=panel_7, B="10000")
multiplication_4 = Multiplication(A=panel_8, B=panel_5)
graft_tree = GraftTree(Tree=panel_4, IncludeEmptyLists=True, IncludeNullItems=True)
panel_12 = Panel(point)
panel_13 = Panel(point_2)
graft_tree_2 = GraftTree(Tree=panel_9, IncludeEmptyLists=True, IncludeNullItems=True)
line_2 = Line(StartPoint=graft(point), EndPoint=point_2)
panel_14 = Panel("""10
10000""")
graft_tree_3 = GraftTree(Tree=panel_10, IncludeEmptyLists=True, IncludeNullItems=True)
panel_15 = Panel(multiplication_2)
panel_16 = Panel(multiplication)
panel_17 = Panel(multiplication_3)
panel_18 = Panel(multiplication_4)
panel_19 = Panel(graft_tree)
panel_20 = Panel(graft_tree_2)
panel_21 = Panel(graft_tree_3)
multiplication_5 = Multiplication(A=graft_tree, B=panel_6)
panel_22 = Panel(line_2)
multiplication_6 = Multiplication(A=graft_tree_2, B=panel_14)
panel_23 = Panel(multiplication_5)
multiplication_7 = Multiplication(A=panel_11, B=graft_tree_3)
panel_24 = Panel(multiplication_6)
flatten_tree = FlattenTree(Tree=multiplication_7, Path="{0}")
list_item = ListItem(List=multiplication_6, Index=Slider(0, range=0..1), Wrap=True)  # -> simplify(Item)
param_viewer = ParamViewer(multiplication_6)
panel_25 = Panel(flatten_tree)
panel_26 = Panel(list_item)

# ---- group: Grafting this gives us all the distances/lines "from the perspective of / focused on" each point
points = Geometry(graft([Point(35.28732062, 16.48396165, 0), Point(65.03923722, -10.23226518, 0), Point(60.42751748, 6.574842083, 0), Point(62.8610991, -4.679844931, 0), Point(71.94949285, 6.585517408, 0), Point(53.26553759, 31.64116345, 0)]))

# ---- group: breps go in here
buildings = Geometry([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])

# ----
volume = Volume(Geometry=buildings)  # -> Volume, Centroid
panel_27 = Panel(volume.Centroid)
line_3 = Line(StartPoint=points, EndPoint=volume.Centroid)  # -> simplify(Line)
distance = Distance(PointA=points, PointB=volume.Centroid)  # -> simplify(Distance)

# ---- group: This helps us preview a specific branch of the tree
tree_branch = TreeBranch(Tree=line_3, Path=Slider(0, range=0..10), MaintainPaths=True)

# ---- group: The distances are grouped into groups of three -- six lists of three points each. Each of the six lists corresponds to each of the six points
panel_28 = Panel(distance)

# ---- group: Sort the lines based on the distance from each point to buildings
sort_list = SortList(Keys=distance, ValuesValuesA=line_3)  # -> Keys, ValuesValuesA

# ---- group: Get the first item in the list -- AKA the shortest line
list_item_2 = ListItem(List=sort_list.ValuesValuesA, Index=Slider(0, range=0..100), Wrap=True)  # -> flatten(Item)

# ---- group: This is an example of how 'Sort List' can sort things synchronously
panel_29 = Panel("""120
3000
5402
234""")
panel_30 = Panel("""Amy
Brian
Chen
Dana""")
sort_list_2 = SortList(Keys=panel_29, ValuesValuesA=panel_30)  # -> Keys, ValuesValuesA
panel_31 = Panel(sort_list_2.Keys)
panel_32 = Panel(sort_list_2.ValuesValuesA)

# ---- group: Use 'Custom Preview' (or if you have the Human plug-in, 'Custom Preview Lineweights' to preview thick lines)
custom_preview_lineweights = CustomPreviewLineweights(
    Geometry=list_item_2,
    Shader={diffuse=RGB(255, 105, 180), emission=RGB(76, 32, 54), shine=0.5, specular=RGB(255, 255, 255), transparency=0},
    Thickness=Slider(16, range=0..100),
    Absolute=False)
custom_preview = CustomPreview(
    Geometry=list_item_2,
    Material={diffuse=RGB(221, 160, 221), emission=RGB(66, 48, 66), shine=0.5, specular=RGB(255, 255, 255), transparency=0})
