# Grasshopper definition TruckDriver.gh (Grasshopper 1.0.7)
# plug-ins: Firefly.X, Anemone, Human, Telepathy

circle = Circle(Plane=PlaneXY(0, 0, 0), Radius=1)
geometry = Geometry([<curve referenced from the Rhino model> x7])
geometry_2 = Geometry([<curve referenced from the Rhino model> x7])
point = Point(<point referenced from the Rhino model>)
point_2 = Point(<point referenced from the Rhino model>)
point_3 = Point(<point referenced from the Rhino model>)
point_4 = Point(<point referenced from the Rhino model>)
aspirationalcurve = Geometry(<curve referenced from the Rhino model>)
truckgeo = RemoteSender(geometry)
trailergeo = RemoteSender(geometry_2)
trailerfrontpoint = RemoteSender(point_3)
trailerbackpoint = RemoteSender(point_4)
truckfrontpoint = RemoteSender(point)
truckbackpoint = RemoteSender(point_2)
aspirationalcurve_2 = RemoteSender(aspirationalcurve)
trailerfrontpoint_2 = RemoteReceiver(trailerfrontpoint)
trailerbackpoint_2 = RemoteReceiver(trailerbackpoint)
truckfrontpoint_2 = RemoteReceiver(truckfrontpoint)
truckbackpoint_2 = RemoteReceiver(truckbackpoint)
aspirationalcurve_3 = RemoteReceiver(aspirationalcurve_2)
trailergeo_2 = RemoteReceiver(trailergeo)
truckgeo_2 = RemoteReceiver(truckgeo)
truckfrontpoint_3 = RemoteReceiver(truckfrontpoint)
truckbackpoint_3 = RemoteReceiver(truckbackpoint)
trailerbackpoint_3 = RemoteReceiver(trailerbackpoint)
trailerfrontpoint_3 = RemoteReceiver(trailerfrontpoint)
aspirationalcurve_4 = RemoteReceiver(aspirationalcurve_2)
distance = Distance(PointA=truckfrontpoint_3, PointB=truckbackpoint_3)
division = Division(A=distance, B=Slider(3, range=1..5))
vehiclepointstoplane = VehiclePointsToPlane(point=trailerfrontpoint_3, point_b=trailerbackpoint_3)
divide_length = DivideLength(Curve=aspirationalcurve_4, Length=division)  # -> Points, Tangents, Parameters
aspirationalcurvepoints = RemoteSender(divide_length.Points)

aspirationalcurvepoints_2 = RemoteReceiver(aspirationalcurvepoints)
list_item = ListItem(List=aspirationalcurvepoints_2, Index="0", Wrap=True)  # -> Item, Item1
prevpathpoint = Geometry(list_item.Item)
thispathpoint = Geometry(list_item.Item1)
truckbackpoint_4 = RemoteReceiver(truckbackpoint)
truckfrontpoint_4 = RemoteReceiver(truckfrontpoint)
vehiclepointstoplane_2 = VehiclePointsToPlane(point=truckfrontpoint_4, point_b=truckbackpoint_4)
vehiclepointstoplane_3 = VehiclePointsToPlane(point=thispathpoint, point_b=prevpathpoint)
truckgeo_3 = RemoteReceiver(truckgeo)
truckfrontpoint_5 = RemoteReceiver(truckfrontpoint)
truckbackpoint_5 = RemoteReceiver(truckbackpoint)
trailerfrontpoint_4 = RemoteReceiver(trailerfrontpoint)
trailergeo_3 = RemoteReceiver(trailergeo)
trailerbackpoint_4 = RemoteReceiver(trailerbackpoint)
orient = Orient(Geometry=truckgeo_3, Source=vehiclepointstoplane_2, Target=vehiclepointstoplane_3)  # -> Geometry, Transform
orient_2 = Orient(Geometry=truckbackpoint_5, Source=vehiclepointstoplane_2, Target=vehiclepointstoplane_3)  # -> Geometry, Transform
orient_3 = Orient(Geometry=trailerfrontpoint_4, Source=vehiclepointstoplane_2, Target=vehiclepointstoplane_3)  # -> Geometry, Transform
orient_4 = Orient(Geometry=truckfrontpoint_5, Source=vehiclepointstoplane_2, Target=vehiclepointstoplane_3)  # -> Geometry, Transform
orient_5 = Orient(Geometry=trailerbackpoint_4, Source=vehiclepointstoplane_2, Target=vehiclepointstoplane_3)  # -> Geometry, Transform
orient_6 = Orient(Geometry=trailergeo_3, Source=vehiclepointstoplane_2, Target=vehiclepointstoplane_3)  # -> Geometry, Transform
thistrailerfrontpoint = Geometry(orient_3.Geometry)
thistruckbackpoint = Geometry(orient_2.Geometry)
thistruckfrontpoint = Geometry(orient_4.Geometry)
thistruckgeo = Geometry(orient.Geometry)
thistrailerbackpoint = Geometry(orient_5.Geometry)
thistrailergeo = Geometry(orient_6.Geometry)

trailerplane = RemoteSender(vehiclepointstoplane)
aspirationalcurvepoints_3 = RemoteReceiver(aspirationalcurvepoints)
list_length = ListLength(List=aspirationalcurvepoints_3)
firsttrailerback = Geometry(thistrailerbackpoint)
subtraction = Subtraction(A=list_length, B=Slider(3, range=0..10))
fast_loop_start = FastLoopStart(Iterations=subtraction, D0=Slider(1, range=0..100), D1=firsttrailerback, D2=thistruckgeo, D3=thistrailergeo)  # -> port, Counter, Data, Data_2, Data_3, Data_4

prevtrailergeo = Geometry(fast_loop_start.Data_4)
prevtruckgeo = Geometry(fast_loop_start.Data_3)

thispathindex = Number(fast_loop_start.Data)
prevtrailerback = Geometry(fast_loop_start.Data_2)

aspirationalcurvepoints_4 = RemoteReceiver(aspirationalcurvepoints)
list_item_2 = ListItem(List=aspirationalcurvepoints_4, Index=thispathindex, Wrap=True)  # -> Item, Item1
thispathpoint_2 = Geometry(list_item_2.Item1)
prevpathpoint_2 = Geometry(list_item_2.Item)
truckbackpoint_6 = RemoteReceiver(truckbackpoint)
truckfrontpoint_6 = RemoteReceiver(truckfrontpoint)
addition = Addition(A=thispathindex, B=Slider(1, range=0..1))
vehiclepointstoplane_4 = VehiclePointsToPlane(point=truckfrontpoint_6, point_b=truckbackpoint_6)
vehiclepointstoplane_5 = VehiclePointsToPlane(point=thispathpoint_2, point_b=prevpathpoint_2)
truckgeo_4 = RemoteReceiver(truckgeo)
truckfrontpoint_7 = RemoteReceiver(truckfrontpoint)
truckbackpoint_7 = RemoteReceiver(truckbackpoint)
trailerfrontpoint_5 = RemoteReceiver(trailerfrontpoint)
orient_7 = Orient(Geometry=truckgeo_4, Source=vehiclepointstoplane_4, Target=vehiclepointstoplane_5)  # -> Geometry, Transform
orient_8 = Orient(Geometry=truckbackpoint_7, Source=vehiclepointstoplane_4, Target=vehiclepointstoplane_5)  # -> Geometry, Transform
orient_9 = Orient(Geometry=trailerfrontpoint_5, Source=vehiclepointstoplane_4, Target=vehiclepointstoplane_5)  # -> Geometry, Transform
orient_10 = Orient(Geometry=truckfrontpoint_7, Source=vehiclepointstoplane_4, Target=vehiclepointstoplane_5)  # -> Geometry, Transform
thistrailerfrontpoint_2 = Geometry(orient_9.Geometry)
thistruckbackpoint_2 = Geometry(orient_8.Geometry)
thistruckfrontpoint_2 = Geometry(orient_10.Geometry)
thistruckgeo_2 = Geometry(orient_7.Geometry)
prevtrailerbackpoint = Geometry(prevtrailerback)
thistrailerfrontpoint_3 = Geometry(orient_9.Geometry)
vector_2pt = Vector2Pt(PointA=thistrailerfrontpoint_3, PointB=prevtrailerbackpoint, Unitize=False)  # -> Vector, Length
xy_plane = XYPlane(Origin=thistrailerfrontpoint_3)
align_plane = AlignPlane(Plane=xy_plane, Direction=vector_2pt.Vector)  # -> Plane, Angle
trailerbackpoint_5 = RemoteReceiver(trailerbackpoint)
trailerplane_2 = RemoteReceiver(trailerplane)
trailergeo_4 = RemoteReceiver(trailergeo)
trailerplane_3 = RemoteReceiver(trailerplane)
orient_11 = Orient(Geometry=trailergeo_4, Source=trailerplane_2, Target=align_plane.Plane)  # -> Geometry, Transform
orient_12 = Orient(Geometry=trailerbackpoint_5, Source=trailerplane_3, Target=align_plane.Plane)  # -> Geometry, Transform
thistrailerfrontpoint_4 = Geometry(thistrailerfrontpoint_3)
thistrailerbackpoint_2 = Geometry(orient_12.Geometry)
line = Line(StartPoint=thistrailerfrontpoint_4, EndPoint=thistrailerbackpoint_2)
truckline = RemoteSender(line)

thistrailerbackpoint_3 = Geometry(thistrailerbackpoint_2)
nextpathindex = Number(addition)
thistrailergeo_2 = Geometry(orient_11.Geometry)
thistruckgeo_3 = Geometry(thistruckgeo_2)

animation_on = BooleanToggle(False)

fast_loop_end = FastLoopEnd(
    port=fast_loop_start.port,
    Exit=False,
    Data=nextpathindex,
    Data_2=thistrailerbackpoint_3,
    Data_3=thistruckgeo_3,
    Data_4=thistrailergeo_2,
    RecordData=True,
    TimeOutVal=0)  # -> D0, D1, D2, D3
timerlocker = TimerLocker(EnableTimers=animation_on)  # inputs EnableTimers: Boolean
# ---------- timerlocker: C# ----------
foreach(IGH_DocumentObject obj in GrasshopperDocument.Objects) { //for all objs in GH doc
      
      //Try to cast the object to a GH_Timer
      if(obj is Grasshopper.Kernel.Special.GH_Timer) {
        Grasshopper.Kernel.Special.GH_Timer timer = obj as Grasshopper.Kernel.Special.GH_Timer;
        if (timer.Targets.Contains(this.Component.InstanceGuid)) {
          
          if(!EnableTimers) { timer.Locked = true; }
          else { timer.Locked = false; }
        }
      }
    }
# ---------- end timerlocker ----------
timer = Timer(TimerInterval=20, Target=[counter, timerlocker])  # disabled
geometry_3 = Geometry(simplify(fast_loop_end.D3))
geometry_4 = Geometry(simplify(fast_loop_end.D2))
counter = Counter(CountDirection=True, Step=1, StartStop=animation_on, Reset=False, OptionalCounterDomain=Domain(0, 0))
tree_statistics = TreeStatistics(Tree=geometry_4)  # -> Paths, Length, Count
modulus = Modulus(A=counter, B=tree_statistics.Count)
number = Number(modulus)
custom_preview = CustomPreview(Geometry=[geometry_4, geometry_3], Material=ColourSwatch(SwatchColor=RGB(245, 149, 149)))
tree_branch = TreeBranch(Tree=geometry_3, Path=number, MaintainPaths=True)
panel = Panel(modulus)
tree_branch_2 = TreeBranch(Tree=geometry_4, Path=number, MaintainPaths=True)
custom_preview_lineweights = CustomPreviewLineweights(
    Geometry=[tree_branch_2, tree_branch],
    Shader=ColourSwatch(SwatchColor=RGB(125, 105, 255)),
    Thickness=Slider(5, range=0..10),
    Absolute=False)

# ==== cluster VehiclePointsToPlane
point = ClusterInput()
point_2 = Point(point)
point_b = ClusterInput()
vector_2pt = Vector2Pt(PointA=point_2, PointB=point_b, Unitize=False)  # -> Vector, Length
xy_plane = XYPlane(Origin=point_2)
align_plane = AlignPlane(Plane=xy_plane, Direction=vector_2pt.Vector)  # -> Plane, Angle
plane = ClusterOutput(align_plane.Plane)
