# Grasshopper definition WallMaker.gh (Grasshopper 1.0.7)
# plug-ins: setFlounderCamera, getFlounderCamera

# ---- group: Be sure to create a Rhino layer called "WallMaker"
# WallMaker - example Metatool file
# Dan Taeyoung (@dantaeyoung) : http://github.com/provolot/GrasshopperArsenal
pipeline = GeometryPipeline(
    GroupByLayer=False,
    GroupByType=False,
    IncludeHidden=True,
    IncludeLocked=True,
    LayerFilter="WallMaker",
    NameFilter="*",
    SublayerFiltering=True,
    TypeFilter=4)

# ---- group: Double click this to set to 'true'
toggle = BooleanToggle(False)

# ----
timer = Timer(TimerInterval=20, Target=getfloundercamera)
Z = UnitZ(Factor=Slider(8, range=0..100))
getfloundercamera = GetFlounderCamera(Activate=toggle, ViewportName="ModelPerspective")  # -> Location, Target, Lens, Up
extr = Extrude(Base=pipeline, Direction=Z)
pipe = Pipe(Curve=pipeline, Radius=Slider(0.3, range=0..1), Caps=0)
panel = Panel(getfloundercamera.Up)
panel_2 = Panel(getfloundercamera.Lens)
panel_3 = Panel(getfloundercamera.Location)
panel_4 = Panel(getfloundercamera.Target)
syncfloundercamera = SyncFlounderCamera(
    Activate=toggle,
    ViewportName="ViewPerspective",
    Location=getfloundercamera.Location,
    Target=getfloundercamera.Target,
    Lens=getfloundercamera.Lens,
    Up=getfloundercamera.Up)

# ---- group: Right click and notice that there is a viewport filter. Create a named view called 'ModelPerspective'
preview = CustomPreview(Geometry=pipe, Material=ColourSwatch(SwatchColor=RGB(255, 0, 208)))

# ---- group: Right click and notice that there is a viewport filter. Create a named view called 'ViewPerspective'
preview_2 = CustomPreview(Geometry=extr, Material=ColourSwatch(SwatchColor=RGB(82, 220, 255)))
