# Grasshopper definition WekinatorExamples_1_Basic_Structure.gh (Grasshopper 0.9.76)
# plug-ins: gHowl

# 171109 @dantaeyoung https://github.com/dantaeyoung/GrasshopperArsenal
# WekinatorExample_1_Basic_Structure
# (This is a simple example to help share the general structure of input/outputs with Grasshopper, Processing, and Wekinator.)
# Processing script: grasshopper_ghowl_to_wekinator
# Put as many inputs here as in Wekinator.
number_slider = Slider(0.5823, range=0..1)

# ---- group: This should stay the same
# 1. Sending data out (via OSC)
panel = Panel("/wek/inputs")

# ----
merge = Merge(Data1=panel, Data2=number_slider)
port = Panel("6447")
txt = Text(merge)
panel_2 = Panel(merge)

# ---- group: Sending message via OSC
# 2. Using Grasshopper_Ghowl_To_Wekinator (Processing script)
# to receive messages on port 6447, convert to numbers,
# and pass to Wekinator on port 6448
udp = UDPSender(Port=port, Pattern="999", Data=txt)

# ----
# 3. Wekinator
# 4. Receiving data from Wekinator (via OSC)
panel_3 = Panel("12000")

# ---- group: Receiving OSC messages from Wekinator
udp_2 = UDPReceiver(Port=panel_3, Pattern="999")  # -> Info, Data

# ----
split = SplitList(List=udp_2.Data, Index="1")  # -> ListA, ListB
item = ListItem(List=split.ListB, Index=0, Wrap=True)  # -> Item, Item1, Item2, Item3
panel_4 = Panel(item.Item)
panel_5 = Panel(item.Item1)
panel_6 = Panel(item.Item2)
panel_7 = Panel(item.Item3)
