# Grasshopper definition WekinatorExamples_1_Morphing.ghx (Grasshopper 0.9.76)
# plug-ins: Human UI, gHowl

udp = UDPReceiver(Port="12000", Pattern="999")  # -> Info, Data
split = SplitList(List=udp.Data, Index="1")  # -> ListA, ListB
multiplication = Multiplication(A=split.ListB, B=Slider(39, range=0..110))
# 171109 @dantaeyoung https://github.com/dantaeyoung/GrasshopperArsenal
md_slider = MDSlider(
    slider_value=Point(0.5071037106, 0.4487680575, 0.5),
    SliderMode=0,
    x_domain=Domain(0, 1),
    y_domain=Domain(0, 1),
    z_domain=Domain(0, 1))
item = ListItem(List=split.ListB, Index=0, Wrap=True)  # -> Item, Item1, Item2, Item3
# Spiky
toggle = BooleanToggle(True)
panel = Panel(split.ListB)

# ---- group: Use data from wekinator?
toggle_2 = BooleanToggle(True)

# ----
# Tall
md_slider_2 = CreateMultidimensionalSlider(StartingValue=md_slider)
launchwin = LaunchWindow(Show=toggle, Name="Control Window", Width=370, Height=400, ChildStatus=0, EnableHorizScroll=False)
values = ValueListener(Elements=md_slider_2, SomeProperty=True)  # -> Values, Indices
# Sending to Wekinator
# Sending values to Processing script: grasshopper_ghowl_to_wekinator
addelems = AddElements(Window=launchwin, Elements=flatten(md_slider_2))  # -> AddedElements, ElementNames
geo = Geometry(<curve referenced from the Rhino model>)
pt = Point(values.Values)
multiplication_2 = Multiplication(A=pt, B=100)
filter = StreamFilter(Gate=toggle_2, Stream0=Slider(61, range=0..100), Stream1=item.Item)
pdecon = Deconstruct(Point=multiplication_2)  # -> XComponent, YComponent, ZComponent
port = Panel("6447")
divide = DivideCurve(Curve=geo, Count=filter, Kinks=False)  # -> Points, Tangents, Parameters
filter_2 = StreamFilter(Gate=toggle_2, Stream0=Slider(47, range=0..100), Stream1=item.Item2)
merge = Merge(Data1="/wek/inputs", Data2=pdecon.XComponent, Data3=pdecon.YComponent)
Z = UnitZ(Factor=1)
rad = Radians(Degrees=filter_2)
dam = DataDam(DataA=merge, BufferDelay=2500000, BufferMode=1)
vrot = Rotate(Vector=divide.Tangents, Axis=Z, Angle=rad)
txt = Text(dam)
sift = SiftPattern(List=vrot, SiftPattern=[0, 1])  # -> Output0, Output1
panel_2 = Panel(dam)
rev = Reverse(Vector=sift.Output1)

# ---- group: Processing script will receive data, convert to floats, and send OSC message to port 6448
udp_2 = UDPSender(Port=port, Pattern="999", Data=txt)

# ----
combine = CombineData(Input0=sift.Output0, Input1=rev)  # -> Result, Index
filter_3 = StreamFilter(Gate=toggle_2, Stream0=Slider(0, range=0..1), Stream1=item.Item1)
amp = Amplitude(Vector=combine.Result, Amplitude=filter_3)
move = Move(Geometry=divide.Points, Motion=amp)  # -> Geometry, Transform
filter_4 = StreamFilter(Gate=toggle_2, Stream0=Slider(37.606, range=0..50), Stream1=item.Item3)
pline = PolyLine(Vertices=move.Geometry, Closed=True)
Z_2 = UnitZ(Factor=filter_4)
move_2 = Move(Geometry=pline, Motion=Z_2)  # -> Geometry, Transform
merge_2 = Merge(Data1=flatten(geo), Data2=flatten(move_2.Geometry))
loft = Loft(Curves=merge_2, Options={Adjust=False, Closed=False, LoftEnds=0, LoftSimp=0, LoftType=0, Rebuild=10, Refit=0.01})
cap = CapHoles(Brep=loft)
preview = CustomPreview(
    Geometry=cap,
    Shader={ambient=RGB(0, 0, 0), diffuse=RGB(255, 105, 180), emission=RGB(76, 32, 54), shine=0.5, specular=RGB(255, 255, 255), transparency=0})
