# Grasshopper definition WekinatorExamples_2_Morphing_and_Controlling_Wekinator.gh (Grasshopper 0.9.76)
# plug-ins: gHowl

# 2. Sending values to Wekinator (via Processing)
# This is our INPUT: What we want to control, and what we want Wekinator to be trained to REACT to.
# This is our OUTPUTs: What we want the result to be,
# and what we want Wekinator to PREDICT based on the input.
input_1 = Slider(0.7185, range=0..1)

output_1 = Slider(0.471, range=0..1)
# 3. Using Grasshopper_Ghowl_To_Wekinator (Processing script)
# to receive messages on port 6447, convert to numbers,
# and pass to Wekinator on port 6448
output_4 = Slider(0.916, range=0..1)
output_3 = Slider(0.583, range=0..1)
output_2 = Slider(1, range=0..1)

# ----
# 171109 @dantaeyoung https://github.com/dantaeyoung/GrasshopperArsenal
# WekinatorExample_2_Morphing
# This is a example of having the Wekinator neural net
# 'morph' between different shapes, using a single slider.
# 
# In some ways, this is about creating a 'metaslider'
# which controls 4 data sources, or dimensions
#  which stores an 'encoded' understanding of how
# those 4 data sources should act.
# 
# (See also: neural net autoencoders.)
# 1. Creating a 3d model to train Wekinator with
pt = ConstructPoint(XCoordinate=0, YCoordinate=0, ZCoordinate=0)
output_1_2 = Number(output_1)
output_1_3 = Number(output_1_2)
output_2_2 = Number(output_2)
output_2_3 = Number(output_2_2)
output_3_2 = Number(output_3)
output_3_3 = Number(output_3_2)
output_4_2 = Number(output_4)
output_4_3 = Number(output_4_2)

# ---- group: Make some geometry
cluster = Cluster(pt=pt, B=output_1_3, B_3=output_2_3, B_2=output_3_3, B_4=output_4_3)

# ---- group: This will control Wekinator to set these as desired outputs.
panel = Panel("/wekinator/control/outputs")

# ----
preview = CustomPreview(Geometry=cluster, Shader=ColourSwatch(SwatchColor=RGB(135, 230, 164)))
merge = Merge(Data1=panel, Data2=output_1_2, Data3=output_2_2, Data4=output_3_2, Data5=output_4_2)
merge_2 = Merge(Data1="/wek/inputs", Data2=input_1)
panel_2 = Panel(merge)
port = Panel("6447")
panel_3 = Panel(merge_2)
txt = Text(merge_2)
txt_2 = Text(panel_2)
udp = UDPSender(Port=port, Pattern="999", Data=txt)
udp_2 = UDPSender(Port=port, Pattern="999", Data=txt_2)
# 1. Creating a 3d model to train Wekinator with
# and
# 6. Receiving prediction input from Wekinator to change the 3d model
number_slider = Slider(13, range=0..100)
pt_2 = ConstructPoint(XCoordinate=0, YCoordinate=number_slider, ZCoordinate=0)
# 4. Wekinator
panel_4 = Panel("999")
# 5. Receiving data from Wekinator
panel_5 = Panel("12000")

# ---- group: Receiving OSC messages from Wekinator
udp_3 = UDPReceiver(Port=panel_5, Pattern=panel_4)  # -> Info, Data

# ----
split = SplitList(List=udp_3.Data, Index="1")  # -> ListA, ListB
item = ListItem(List=split.ListB, Index=0, Wrap=True)  # -> Item, Item1, Item2, Item3
wekinator_output_1 = Number(item.Item)
wekinator_output_1_2 = Number(wekinator_output_1)
wekinator_output_2 = Number(item.Item1)
wekinator_output_2_2 = Number(wekinator_output_2)
wekinator_output_3 = Number(item.Item2)
wekinator_output_3_2 = Number(wekinator_output_3)
wekinator_output_4 = Number(item.Item3)
wekinator_output_4_2 = Number(wekinator_output_4)
cluster_2 = Cluster(pt=pt_2, B=wekinator_output_1_2, B_3=wekinator_output_2_2, B_2=wekinator_output_3_2, B_4=wekinator_output_4_2)
preview_2 = CustomPreview(Geometry=cluster_2, Shader=ColourSwatch(SwatchColor=RGB(149, 93, 232)))
panel_6 = Panel(wekinator_output_1)
panel_7 = Panel(wekinator_output_2)
panel_8 = Panel(wekinator_output_3)
panel_9 = Panel(wekinator_output_4)

# ==== cluster Cluster
B = ClusterInput()
B_2 = ClusterInput()
B_3 = ClusterInput()
B_4 = ClusterInput()
pt = ClusterInput()
multiplication = Multiplication(A=Slider(10, range=0..10), B=B)
multiplication_2 = Multiplication(A=Slider(360, range=0..360), B=B_2)
multiplication_3 = Multiplication(A=Slider(10, range=0..10), B=B_3)
multiplication_4 = Multiplication(A=Slider(10, range=0..10), B=B_4)
rad = Radians(Degrees=multiplication_2)
Z = UnitZ(Factor=multiplication_4)
pt_2 = Point(pt)
polygon = Polygon(Plane=pt_2, Radius=multiplication, Segments=multiplication_3, FilletRadius=0)  # -> Polygon, Length
polygon_2 = Polygon(Plane=pt_2, Radius=multiplication, Segments=multiplication_3, FilletRadius=0)  # -> Polygon, Length
move = Move(Geometry=polygon_2.Polygon, Motion=Z)  # -> Geometry, Transform
rotate = Rotate(Geometry=polygon.Polygon, Angle=rad, Plane=pt_2)  # -> Geometry, Transform
merge = Merge(Data1=rotate.Geometry, Data2=move.Geometry)
loft = Loft(Curves=merge, Options={Adjust=False, Closed=False, LoftEnds=0, LoftSimp=0, LoftType=0, Rebuild=10, Refit=0.01})
cap = CapHoles(Brep=loft)
B_5 = ClusterOutput(cap)
